# Grasshopper definition GraphBuilder.gh (Grasshopper 1.0.7)
# plug-ins: Human UI

pt = Point([<point referenced from the Rhino model> x5])

# ---- group: Centering nodes
ma = MassAddition(Input=pt)  # -> Result, PartialResults
lng = ListLength(List=pt)
division = Division(A=ma.Result, B=lng)
subtraction = Subtraction(A=pt, B=division)

# ----
pt_2 = Point(subtraction)

# ---- group: Scaling nodes
multiplication = Multiplication(A=pt_2, B=Slider(3.97, range=0..10))

# ---- group: Displacement vector into X, -Y quadrant
devec = DeconstructVector(Vector=multiplication)  # -> XComponent, YComponent, ZComponent
sort = SortList(Keys=devec.XComponent)  # -> Keys, ValuesA
sort_2 = SortList(Keys=devec.YComponent)  # -> Keys, ValuesA
rev = ReverseList(List=sort_2.Keys)
int = Integer(0)
item = ListItem(List=sort.Keys, Index=int, Wrap=True)
item_2 = ListItem(List=rev, Index=int, Wrap=True)
int_2 = Integer(-1)
multiplication_2 = Multiplication(A=item, B=int_2)
multiplication_3 = Multiplication(A=int_2, B=item_2)
vec = VectorXYZ(XComponent=multiplication_2, YComponent=multiplication_3, ZComponent=0)  # -> Vector, Length

# ----
number_slider = Slider(0, range=0..10)
addition = Addition(A=multiplication, B=vec.Vector)
pt_3 = Point(addition)
int_3 = Integer(-1)
multiplication_4 = Multiplication(A=number_slider, B=int_3)
vec_2 = VectorXYZ(XComponent=number_slider, YComponent=multiplication_4, ZComponent=0)  # -> Vector, Length
addition_2 = Addition(A=addition, B=vec_2.Vector)
node_positions = Point(addition_2)
lng_2 = ListLength(List=node_positions)
ma_2 = MassAddition(Input=node_positions)  # -> Result, PartialResults
swatch = ColourSwatch(SwatchColor=RGBA(255, 0, 0, 0))
lng_3 = ListLength(List=node_positions)
graph_size = Slider(3.7, range=0..10)
pt_4 = Point(ma_2.Result)
division_2 = Division(A=pt_4, B=lng_2)
subtraction_2 = Subtraction(A=node_positions, B=division_2)
pt_5 = Point(subtraction_2)
hex_names_color_palette = Text(["#f72585", "#b5179e", "#7209b7", "#560bad", "#480ca8", "#3a0ca3", "#3f37c9", "#4361ee", "#4895ef", "#4cc9f0"])
cir = Circle(Plane=node_positions, Radius=1)
col = Colour(hex_names_color_palette)
radiobtn = CreateRadioButton(RadioButtonName="Kitchen", RadioButtonGroup="Room IDs", InitiallySelected=False)
radiobtn_2 = CreateRadioButton(RadioButtonName="Patient Room", RadioButtonGroup="Room IDs", InitiallySelected=False)
radiobtn_3 = CreateRadioButton(RadioButtonName="Medical Clinic", RadioButtonGroup="Room IDs", InitiallySelected=False)
radiobtn_4 = CreateRadioButton(RadioButtonName="Nurse Station", RadioButtonGroup="Room IDs", InitiallySelected=False)
shapes = CreateShapes(Shapes=cir, FillColor=swatch, StrokeColor=swatch, Scale=graph_size, ClickMode=1)
colorpicker = CreateColorPicker(AvailableColors=col)
shapes_2 = CreateShapes(Shapes=cir, FillColor=swatch, StrokeColor=swatch, Scale=graph_size, ClickMode=1)
shapes_3 = CreateShapes(Shapes=cir, FillColor=swatch, StrokeColor=swatch, Scale=graph_size, ClickMode=1)
colorpicker_2 = CreateColorPicker(AvailableColors=col)
colorpicker_3 = CreateColorPicker(AvailableColors=col)
shapes_4 = CreateShapes(Shapes=cir, FillColor=swatch, StrokeColor=swatch, Scale=graph_size, ClickMode=1)
colorpicker_4 = CreateColorPicker(AvailableColors=col)
launchwin = LaunchWindow(Show=Toggle(True), Name="Graph Builder", Width=370, Height=400, ChildStatus=0, EnableHorizScroll=False)
merge = Merge(Data1=colorpicker, Data2=colorpicker_2, Data3=colorpicker_3, Data4=colorpicker_4)
merge_2 = Merge(Data1=radiobtn_2, Data2=radiobtn_4, Data3=radiobtn_3, Data4=radiobtn)
bool = Boolean(True)
values = ValueListener(Elements=merge_2, SomeProperty=True)  # -> flatten(Values), Indices
flatten = FlattenTree(Tree=merge, Path="{0}")
flatten_2 = FlattenTree(Tree=merge_2, Path="{1}")
bool_2 = Boolean(values.Values)
data = Data([flatten_2, flatten])
mindex = MemberIndex(Set=bool_2, Member=bool)  # -> Index, Count
panel = Panel(values.Values)
merge_3 = Merge(Data1=shapes_3, Data2=shapes_2, Data3=shapes, Data4=shapes_4)
filter = StreamFilter(Gate=mindex.Index, Stream0=shapes_3, Stream1=shapes_2, Stream2=shapes, Stream3=shapes_4)
values_2 = ValueListener(Elements=merge, SomeProperty=True)  # -> flatten(Values), Indices
values_3 = ValueListener(Elements=merge_3, SomeProperty=True)  # -> flatten(Values), Indices
col_2 = Colour(values_2.Values)
python = GhPythonScript(
    Labels=values_3.Values,
    ColorsPerLabel=col_2,
    NodeNumber=lng_3,
    NodePositions=node_positions,
    DeadColor=ColourSwatch(SwatchColor=RGB(214, 214, 214)))  # -> out, Geometry, Colors; inputs Labels: list of Boolean, ColorsPerLabel: list of Color, NodePositions: list of Point3d, DeadColor: Color
# ---------- python: Python ----------
__author__ = "rapha"
__version__ = "2022.01.30"

import rhinoscriptsyntax as rs

Geometry = []
Colors = []

labels_per_room_type = [Labels[x:x+NodeNumber] for x in range(0, len(Labels), NodeNumber)]

for i in range(NodeNumber):
    
    # Isolate all labels per node.
    labels_per_node = [label[i] for label in labels_per_room_type]
    
    # Determine how many labels are assigned to the node.
    num_labels = len([bool for bool in labels_per_node if bool])
    
    # Create circle around node position.
    center = NodePositions[i]
    circle = rs.AddCircle(center, 1.0)
    
    if (num_labels > 1):
        # Subdivide circle to create outer boundaries for segments.
        split_points = [rs.CurveDomain(circle)[1] / num_labels * j for j in range(num_labels)]
        split_circle = rs.SplitCurve(circle, split_points)
        split_circle_idx = 0
        for j, label in enumerate(labels_per_node):
            
            # This room type is not assigned to the current node.
            if not label:
                continue
            
            # Construct sector.
            sector_border = split_circle[split_circle_idx]
            sector_start = rs.CurveStartPoint(sector_border)
            sector_end = rs.CurveEndPoint(sector_border)
            mid_to_start = rs.AddLine(center, sector_start)
            mid_to_end = rs.AddLine(center, sector_end)
            sector = rs.JoinCurves([mid_to_start, sector_border, mid_to_end])[0]
            Geometry.append(sector)
            Colors.append(ColorsPerLabel[j])
            split_circle_idx += 1
    else:
        Geometry.append(circle)
        if (num_labels == 1):
            Colors.append(ColorsPerLabel[labels_per_node.index(True)])
        else:
            Colors.append(DeadColor)
# ---------- end python ----------
arc = Arc(Plane=PlaneXY(0, 0, 0), Radius=1, Angle=Domain(0, 3.141592654))  # -> Arc, Length
crv = Curve(python.Geometry)
crv_2 = Curve(python.Geometry)
material = CreateMaterial(Diffuse=python.Colors, Specular=RGB(255, 255, 255), Emission=RGB(0, 0, 0), Transparency=0, Shine=0)
boundary = BoundarySurfaces(Edges=crv_2)
simplegrid = CreateSimpleGrid(UIElements=data, RowDefinitions="Auto", ColumnDefinitions="Auto")
preview = CustomPreview(Geometry=boundary, Material=material)
shapes_5 = CreateShapes(Shapes=crv, FillColor=python.Colors, StrokeColor=python.Colors, Scale=graph_size, ClickMode=3)
merge_4 = Merge(Data1=simplegrid, Data2=shapes_5)  # -> flatten(Result)
merge_5 = Merge(Data1=shapes_5, Data2=filter, Data3=shapes_2, Data4=shapes, Data5=shapes_4)  # -> flatten(Result)
lng_4 = ListLength(List=merge_4)
adjustpos = AdjustElementPositioning(ElementsToAdjust=merge_5, Margin="0, 100, 100, 0", AbsolutePositioning=Toggle(True))
true_button = CreateTrueOnlyButton(ButtonStyle=0)
ins = InsertItems(List=merge_4, Item=filter, Indices=lng_4, Wrap=True)
panel_2 = Panel(merge_5)
panel_3 = Panel(ins)
addelems = AddElements(Window=launchwin, Elements=[ins, true_button], DoVLChecking=False)  # -> AddedElements, ElementNames
