# Grasshopper definition metrics_new.gh (Grasshopper 1.0.7)
# plug-ins: ScriptParasite, Human, Kangaroo2 Components, Human UI, Shortest Walk in Gh, EleFront, DeCodingSpaces

# ---- group: Medial Axis Parameters
visualize_medial_axis = BooleanToggle(True)
medial_axis_color = ColourSwatch(SwatchColor=RGB(0, 0, 0))
medial_axis_weight = Slider(4, range=0..10)

# ---- group: Floor
visualize_floor = BooleanToggle(False)
floor_color = ColourSwatch(SwatchColor=RGB(36, 36, 36))

# ---- group: YTI Parameters
visualize_yti = BooleanToggle(False)
number_slider = Slider(10, range=0..10)
yti_maximal_path_width = Slider(0.7, range=0..1)

# ---- group: SCI Parameters
visualize_sci = BooleanToggle(False)
number_of_beds_per_patient_room = Number(2)
isovist_sample_distance = Slider(20, range=0.1..1000)
sci_vantage_point_size = Slider(30, range=1..50)
use_gpu = BooleanToggle(True)

# ---- group: Normalization
reference_line = Line(Line((-992.3812343, 1836.877208, 0), (-947.2065156, 1836.877208, 0)))
reallength = Slider(1.5, range=0..10)

# ---- group: Graph Builder Visualization
displacement_left_pixels = Slider(50, range=0..1000)
displacement_top_pixels = Slider(250, range=0..1000)
graph_size = Slider(1.5, range=0..10)

# ---- group: Visualization of Numerical Metrics
measures_position = Point(<point referenced from the Rhino model>)
measures_displacement = Vector(Vector(0, -257.1890814, 0))

# ----
layout_curves = Curve(flatten([<curve referenced from the Rhino model> x301]))

# ---- group: Script Editor Synchronization
toggle = BooleanToggle(True)
panel = Panel("C:\Users\rapha\Documents\ebdwebsite.github.io\toolkit\scripts")

# ---- group: Coloring Boundary
material = CreateMaterial(
    Diffuse=ColourSwatch(SwatchColor=RGB(135, 135, 135)),
    Specular=RGB(255, 255, 255),
    Emission=RGB(0, 0, 0),
    Transparency=0,
    Shine=0)
previewlw = CustomPreviewLineweights(Geometry=layout_curves, Shader=material, Thickness=Slider(10, range=0..100), Absolute=False)

# ----
synchronization_enabled = Boolean(toggle)
script_directory = Text(panel)

# ---- group: Split Boundary in Straight Segments
topoly = CurveToPolyline(Curve=layout_curves, ToleranceDistance=0, ToleranceAngle=0)  # -> Polyline, Segments
explode = Explode(Curve=topoly.Polyline, Recursive=True)  # -> reparameterize(flatten(Segments)), Vertices
pairwisesplitting = CSharpScript(Segments=explode.Segments)  # -> out, PairwiseSplitSegments; inputs Segments: list of Curve
# ---------- pairwisesplitting: C# usings ----------
using Rhino.Geometry.Intersect;
# ---------- pairwisesplitting: C# ----------
    List<Curve> pairwiseSplitCurves = new List<Curve>();
    foreach (Curve seg0 in Segments)
    {
      List<double> splitParams = new List<double>();
      foreach (Curve seg1 in Segments)
      {
        if (seg0 == seg1)
        {
          continue;
        }
        CurveIntersections intersects = Intersection.CurveCurve(seg0, seg1, 0.1, 0.1);
        if (intersects == null)
        {
          continue;
        }
        foreach (IntersectionEvent intersect in intersects)
        {
          if (intersect.IsPoint)
          {
            splitParams.Add(intersect.ParameterA);
          }
        }
      }
      if (splitParams.Count == 0)
      {
        // No intersection.
        pairwiseSplitCurves.Add(seg0);
      }
      Curve[] splitCurves = seg0.Split(splitParams);
      Print(splitCurves.Length.ToString());
      if (splitCurves == null)
      {
        throw new Exception("Splitting curve did not yield correct result.");
      }
      pairwiseSplitCurves.AddRange(splitCurves);
    }
    PairwiseSplitSegments = pairwiseSplitCurves;
# ---------- end pairwisesplitting ----------
scriptpar = ScriptParasite(Enable=synchronization_enabled, Folder=script_directory)
dupln = RemoveDuplicateLines(Lines=pairwisesplitting.PairwiseSplitSegments, Tolerance=0.01)

# ---- group: Sample Boundary
boundarysampling = CSharpScript(BoundarySegmentCurveList=dupln, StepSize=Slider(2.5, range=0.5..20), RelativeNoise=Slider(0.05, range=0..1))  # -> out, SamplePoints; inputs BoundarySegmentCurveList: list of Curve, StepSize: Double, RelativeNoise: Double
# ---------- boundarysampling: C# ----------
    // Each element is a list of points where the boundary should be sampled.
    List<Point3d> sampleLocations = new List<Point3d>();
    Random rand = new Random();
    foreach (Curve boundarySegment in BoundarySegmentCurveList)
    {
      double curveLength = boundarySegment.GetLength();
      int regularlySpacedSampleNum = (int)Math.Floor(curveLength / (2 * StepSize));
      boundarySegment.Domain.MakeIncreasing();
      Interval boundaryDomain = boundarySegment.Domain;
      double stepSizeParamSpace = boundaryDomain.Length * (StepSize / curveLength);
      for (int i = 1; i < regularlySpacedSampleNum + 1; i++)
      {
        // Adding some uniform noise to sample location according to prevent artifacts in Voronoi diagram, as suggested in:
        // https://www.grasshopper3d.com/forum/topics/voronoi-component-errors
        double randomDisp0 = -0.5 * RelativeNoise * stepSizeParamSpace + rand.NextDouble() * RelativeNoise * stepSizeParamSpace;
        double randomDisp1 = -0.5 * RelativeNoise * stepSizeParamSpace + rand.NextDouble() * RelativeNoise * stepSizeParamSpace;
        sampleLocations.Add(boundarySegment.PointAt(boundaryDomain.Min + i * stepSizeParamSpace + randomDisp0));
        sampleLocations.Add(boundarySegment.PointAt(boundaryDomain.Max - i * stepSizeParamSpace + randomDisp1));
      }
      sampleLocations.Add(boundarySegment.PointAt(boundaryDomain.Mid));
    }
    SamplePoints = sampleLocations;
# ---------- boundarysampling: C# additional code ----------
  DataTree<T> ListOfListsToTree<T>(List<List<T>> list)
  {
    DataTree<T> tree = new DataTree<T>();
    int i = 0;
    foreach (List<T> innerList in list)
    {
      tree.AddRange(innerList, new GH_Path(new int[] { 0, i }));
      i++;
    }
    return tree;
  }
# ---------- end boundarysampling ----------
scriptpar_2 = ScriptParasite(Enable=synchronization_enabled, Folder=script_directory)
duppt = RemoveDuplicatePts(Points=boundarysampling.SamplePoints, Tolerance=0.01)

# ---- group: All Points that could possibly be corners of the layout curves
crv = Curve(dupln)
disc = Discontinuity(Curve=layout_curves, Level=1)  # -> flatten(Points), Parameters
end = EndPoints(Curve=crv)  # -> Start, End
pt = Point(flatten([disc.Points, end.Start, end.End]))

# ---- group: Only corners that are relevant for medial axis classification
cornersformedialaxisclassification = CSharpScript(UnprocessedCornerPointList=pt, BoundaryCurveList=crv)  # -> out, ProcessedCornerPointList; inputs UnprocessedCornerPointList: list of Point3d, BoundaryCurveList: list of Curve
# ---------- cornersformedialaxisclassification: C# ----------
    List<Point3d> processedCornerList = new List<Point3d>();
    foreach (Point3d corner in UnprocessedCornerPointList)
    {
      int adjacent = 0;
      foreach (Curve boundary in BoundaryCurveList)
      {
        double closestParam;
        boundary.ClosestPoint(corner, out closestParam);
        bool isClose = corner.DistanceTo(boundary.PointAt(closestParam)) < 0.1;
        if (isClose)
        {
          adjacent++;
        }
        if (adjacent > 2)
        {
          break;
        }
      }
      if (adjacent <= 2)
      {
        processedCornerList.Add(corner);
      }
    }
    ProcessedCornerPointList = processedCornerList;
# ---------- end cornersformedialaxisclassification ----------
scriptpar_3 = ScriptParasite(Enable=synchronization_enabled, Folder=script_directory)
duppt_2 = RemoveDuplicatePts(Points=cornersformedialaxisclassification.ProcessedCornerPointList, Tolerance=0.01)

# ---- group: Filtering some corners (need to investigate if this is really needed)
filterrealcorners = CSharpScript(CornerPointList=pt)  # -> out, RealCorners; inputs CornerPointList: list of Point3d, BoundaryCurveList: list of Curve
# ---------- filterrealcorners: C# ----------
    // Check for each corner point if it is adjacent to a line, but not to its endpoints.
    // That makes it not a real corner.
    // Check.
    List<Point3d> realCorners = new List<Point3d>();
    foreach (Point3d corner in CornerPointList)
    {
      bool isRealCorner = true;
      foreach (Curve boundary in BoundaryCurveList)
      {
        double param;
        boundary.ClosestPoint(corner, out param);
        Point3d onLine = boundary.PointAt(param);

        // The point does not even lie on the line.
        if (corner.DistanceTo(onLine) > RhinoMath.DefaultDistanceToleranceMillimeters)
        {
          continue;
        }

        // Now check if it is one of the endpoints.
        bool isStartPoint = corner.DistanceTo(boundary.PointAtStart) < RhinoMath.DefaultDistanceToleranceMillimeters;
        bool isEndPoint = corner.DistanceTo(boundary.PointAtEnd) < RhinoMath.DefaultDistanceToleranceMillimeters;
        if (!isStartPoint && !isEndPoint)
        {
          isRealCorner = false;
          break;
        }
      }
      if (isRealCorner)
      {
        realCorners.Add(corner);
      }
    }
    RealCorners = realCorners;
# ---------- end filterrealcorners ----------
scriptpar_4 = ScriptParasite(Enable=toggle, Folder=panel)
duppt_3 = RemoveDuplicatePts(Points=filterrealcorners.RealCorners, Tolerance=0.01)

# ----
number_slider_2 = Slider(16, range=0..19)
hex_names_color_palette = Text(["#f72585", "#b5179e", "#7209b7", "#560bad", "#480ca8", "#3a0ca3", "#3f37c9", "#4361ee", "#4895ef", "#4cc9f0"])

# ---- group: Canonical Node Types
panel_2 = Panel("Nurse Station")
panel_3 = Panel("Utility Room")
panel_4 = Panel("Elevator")
panel_5 = Panel("Elevator Lobby")
panel_6 = Panel("Pantry")
panel_7 = Panel("Medication Room")
panel_8 = Panel("Janitor Closet")
panel_9 = Panel("Patient Room")
panel_10 = Panel("Medical Clinic")

# ----
col = Colour(hex_names_color_palette)
merge = Merge(
    Data1=panel_9,
    Data2=panel_2,
    Data3=panel_3,
    Data4=panel_4,
    Data5=panel_5,
    Data6=panel_10,
    Data7=panel_6,
    Data8=panel_7,
    Data9=panel_8)

# ---- group: Default Colors
swatch = ColourSwatch(SwatchColor=RGB(65, 201, 220))
swatch_2 = ColourSwatch(SwatchColor=RGB(100, 41, 142))
swatch_3 = ColourSwatch(SwatchColor=RGB(1, 196, 114))
swatch_4 = ColourSwatch(SwatchColor=RGB(228, 26, 114))
swatch_5 = ColourSwatch(SwatchColor=RGB(12, 95, 49))
swatch_6 = ColourSwatch(SwatchColor=RGB(147, 198, 128))
swatch_7 = ColourSwatch(SwatchColor=RGB(188, 227, 51))
swatch_8 = ColourSwatch(SwatchColor=RGB(171, 200, 245))
swatch_9 = ColourSwatch(SwatchColor=RGB(28, 69, 133))

# ---- group: Radio Button Group (Selects one of the room types to assign)
pr = CreateRadioButton(RadioButtonName=panel_9, RadioButtonGroup="Room IDs", InitiallySelected=False)
ns = CreateRadioButton(RadioButtonName=panel_2, RadioButtonGroup="Room IDs", InitiallySelected=False)
ur = CreateRadioButton(RadioButtonName=panel_3, RadioButtonGroup="Room IDs", InitiallySelected=False)
E = CreateRadioButton(RadioButtonName=panel_4, RadioButtonGroup="Room IDs", InitiallySelected=False)
el = CreateRadioButton(RadioButtonName=panel_5, RadioButtonGroup="Room IDs", InitiallySelected=False)
mc = CreateRadioButton(RadioButtonName=panel_10, RadioButtonGroup="Room IDs", InitiallySelected=False)
P = CreateRadioButton(RadioButtonName=panel_6, RadioButtonGroup="Room IDs", InitiallySelected=False)
mr = CreateRadioButton(RadioButtonName=panel_7, RadioButtonGroup="Room IDs", InitiallySelected=False)
jc = CreateRadioButton(RadioButtonName=panel_8, RadioButtonGroup="Room IDs", InitiallySelected=False)

# ---- group: Color Pickers for each room type
pr_2 = CreateColorPicker(DefaultColor=swatch, AvailableColors=col)
ns_2 = CreateColorPicker(DefaultColor=swatch_4, AvailableColors=col)
ur_2 = CreateColorPicker(DefaultColor=swatch_2, AvailableColors=col)
E_2 = CreateColorPicker(DefaultColor=swatch_5, AvailableColors=col)
el_2 = CreateColorPicker(DefaultColor=swatch_6, AvailableColors=col)
mc_2 = CreateColorPicker(DefaultColor=swatch_3, AvailableColors=col)
P_2 = CreateColorPicker(DefaultColor=swatch_7, AvailableColors=col)
mr_2 = CreateColorPicker(DefaultColor=swatch_8, AvailableColors=col)
jc_2 = CreateColorPicker(DefaultColor=swatch_9, AvailableColors=col)

# ----
merge_2 = Merge(Data1=pr_2, Data2=ns_2, Data3=ur_2, Data4=E_2, Data5=el_2, Data6=mc_2, Data7=P_2, Data8=mr_2, Data9=jc_2)  # -> flatten(Result)
launchwin = LaunchWindow(Show=Toggle(True), Name="Graph Builder", Width=370, Height=400, ChildStatus=0, EnableHorizScroll=False)

# ---- group: Turns list of radio buttons into a gate which can be used to select points
merge_3 = Merge(Data1=pr, Data2=ns, Data3=ur, Data4=E, Data5=el, Data6=mc, Data7=P, Data8=mr, Data9=jc)
values = ValueListener(Elements=merge_3, SomeProperty=True)  # -> flatten(Values), Indices
bool = Boolean(values.Values)
true = Boolean(True)
mindex = MemberIndex(Set=bool, Member=true)  # -> Index, Count

# ----
values_2 = ValueListener(Elements=merge_2, SomeProperty=True)  # -> flatten(Values), Indices
swatch_10 = ColourSwatch(SwatchColor=RGB(214, 214, 214))
col_2 = Colour(values_2.Values)
swatch_11 = ColourSwatch(SwatchColor=RGB(145, 145, 145))
number_slider_3 = Slider(60, range=5..60)
int = Integer(1)
dom = ConstructDomain(DomainStart=Slider(0, range=0..1), DomainEnd=Slider(1, range=0..1))
probabilities_yti = ProbabilitiesYTI()  # -> p_patient_room_patient_room_2, p_nurse_station_patient_room_2, p_utility_room_patient_room_2, p_nurse_station_utility_room_2, p_nurse_station_elevator_2, p_nurse_station_medical_clinic_2, p_patient_room_pantry_2, p_patient_room_elevator_2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
mergedpathprobabilities = Merge(
    Data1=probabilities_yti.p_patient_room_patient_room_2,
    Data2=probabilities_yti.p_nurse_station_patient_room_2,
    Data3=probabilities_yti.p_utility_room_patient_room_2,
    Data4=probabilities_yti.p_nurse_station_utility_room_2,
    Data5=probabilities_yti.p_nurse_station_elevator_2,
    Data6=probabilities_yti.p_nurse_station_medical_clinic_2,
    Data7=probabilities_yti.p_patient_room_pantry_2,
    Data8=probabilities_yti.p_patient_room_elevator_2,
    Data9=probabilities_yti.p_medication_room_patient_room_2,
    Data10=probabilities_yti.p_utility_room_elevator_lobby_2,
    Data11=probabilities_yti.p_utility_room_medical_clinic_2,
    Data12=probabilities_yti.p_utility_room_pantry_2,
    Data13=probabilities_yti.p_utility_room_janitor_closet_2,
    Data14=probabilities_yti.p_nurse_station_pantry_2)
len = Length(Curve=reference_line)
downscalelength = Division(A=reallength, B=len)
explode_2 = Explode(Curve=layout_curves, Recursive=True)  # -> Segments, Vertices
number_slider_4 = Slider(14, range=0..200)
measureindex = Integer(0)

# ---- group: SCI Computation / SCI: Probabilities of choosing a path
p_patientroom_patientroom = Number(37)
p_patientroom_nursestation = Number(29)
p_patientroom_medicationroom = Number(17)
p_nursestation_medicalclinic = Number(5)

# ---- group: Create Raw Medial Axis Segments
cls = Closed(Curve=layout_curves)  # -> Closed, Periodic
voronoi = Voronoi(Points=flatten(duppt), BruteForceOverride=False)  # -> flatten(Cells)
cull = CullPattern(List=layout_curves, CullPattern=cls.Closed)
boundary = BoundarySurfaces(Edges=cull)
scriptpar_5 = ScriptParasite(Enable=synchronization_enabled, Folder=script_directory)

# ---- group: Floor Visualization
boundary_proximity_tolerance = Slider(8, range=0..100)
filter = StreamFilter(Gate=visualize_floor, Stream1=boundary)
preview = CustomPreview(Geometry=filter, Material=floor_color)

# ----
panel_11 = Panel(voronoi)

# ---- group: Create Raw Medial Axis Segments (continued)
createmedialaxis = CSharpScript(
    voronoiDiagramCurveList=voronoi,
    boundaryCurveList=layout_curves,
    walkableSurfaceBrep=boundary,
    boundaryProximityTolerance=boundary_proximity_tolerance)  # -> out, medialAxisCurveList; inputs voronoiDiagramCurveList: list of Curve, boundaryCurveList: list of Curve, walkableSurfaceBrep: Brep, boundaryProximityTolerance: Double
# ---------- createmedialaxis: C# usings ----------
using System.Linq;
# ---------- createmedialaxis: C# ----------
    // First "explode" all curves from the Voronoi-diagram into segments and eventually save them in array for parallel processing.
    Line[] allSegmentArray = CreateSegmentsSequential(voronoiDiagramCurveList); // For some reason, the sequential method is slightly faster here.

    // Create mask for valid segments.
    BoundingBox[] bbs = new BoundingBox[boundaryCurveList.Count];
    bool[] mask = SelectValidSegmentsParallel(allSegmentArray, boundaryCurveList, bbs, walkableSurfaceBrep, boundaryProximityTolerance); // Parallel clearly faster.

    // Only select valid medial axis segments.
    List<Line> result = new List<Line>();
    for (int i = 0; i < allSegmentArray.Length; i++)
    {
      if (mask[i])
      {
        result.Add(allSegmentArray[i]);
      }
    }
    medialAxisCurveList = result;
# ---------- createmedialaxis: C# additional code ----------
  private Line[] CreateSegmentsSequential(List<Curve> voronoiDiagramCurveList)
  {
    List<Line> allSegments = new List<Line>();
    foreach (Curve curve in voronoiDiagramCurveList)
    {
      if (curve == null)
      {
        continue;
      }
      if (!curve.IsPolyline())
      {
        // throw new Exception("Input curve was not polyline.");
        continue;
      }
      Polyline polyline = new Polyline();
      curve.TryGetPolyline(out polyline);
      Line[] segments = polyline.GetSegments();
      foreach (Line segment in segments)
      {
        allSegments.Add(segment);
      }
    }
    return allSegments.ToArray();
  }

  private Line[] CreateSegmentsParallel(List<Curve> voronoiDiagramCurveList)
  {
    Line[][] segments = new Line[voronoiDiagramCurveList.Count][];
    System.Threading.Tasks.Parallel.For(0, segments.Length, i =>
      {
      Curve curve = voronoiDiagramCurveList[i];
      if (curve == null)
      {
        throw new Exception("Input curve was null.");
      }
      if (!curve.IsPolyline())
      {
        throw new Exception("Input curve was not polyline.");
      }
      Polyline polyline = new Polyline();
      curve.TryGetPolyline(out polyline);
      segments[i] = polyline.GetSegments();
      });
    return segments.SelectMany(a => a).ToArray();
  }

  /// <summary>
  /// Parallel implementation: Selects all Voronoi-diagram segments that approximate the medial axis.
  /// </summary>
  /// <param name="segments">Segments of the Voronoi-diagram.</param>
  /// <param name="boundaryCurveList">Boundary curves of the shape for which the medial axis is computed.</param>
  /// <param name="walkableSurfaceBrep">Surface inside of the shape.</param>
  /// <param name="boundaryProximityTolerance">If a segment is closer than that to the shape-boundary, it is discarded.</param>
  /// <returns>A boolean array of the same length as <paramref name="segments"/>, acting as a mask for the valid segments.</returns>
  private bool[] SelectValidSegmentsParallel(Line[] segments, List<Curve> boundaryCurveList, BoundingBox[] bbs, Brep walkableSurfaceBrep, double boundaryProximityTolerance)
  {
    bool[] mask = new bool[segments.Length];

    for (int i = 0; i < boundaryCurveList.Count; i++)
    {
      if (boundaryCurveList[i] == null)
      {
        bbs[i] = BoundingBox.Empty;
        continue;
      }
      bbs[i] = boundaryCurveList[i].GetBoundingBox(accurate:false);
    }
    System.Threading.Tasks.Parallel.For(0, mask.Length, i =>
      {
      mask[i] = IsValidSegment(segments[i], boundaryCurveList, bbs, walkableSurfaceBrep, boundaryProximityTolerance);
      });
    return mask;
  }

  /// <summary>
  /// Sequential implementation: Selects all Voronoi-diagram segments that approximate the medial axis.
  /// </summary>
  /// <param name="segments">Segments of the Voronoi-diagram.</param>
  /// <param name="boundaryCurveList">Boundary curves of the shape for which the medial axis is computed.</param>
  /// <param name="walkableSurfaceBrep">Surface inside of the shape.</param>
  /// <param name="boundaryProximityTolerance">If a segment is closer than that to the shape-boundary, it is discarded.</param>
  /// <returns>A boolean array of the same length as <paramref name="segments"/>, acting as a mask for the valid segments.</returns>
  private bool[] SelectValidSegmentsSequential(Line[] segments, List<Curve> boundaryCurveList, BoundingBox[] bbs, Brep walkableSurfaceBrep, double boundaryProximityTolerance)
  {
    bool[] mask = new bool[segments.Length];
    for (int i = 0; i < segments.Length; i++)
    {
      mask[i] = IsValidSegment(segments[i], boundaryCurveList, bbs, walkableSurfaceBrep, boundaryProximityTolerance);
    }
    return mask;
  }

  /// <summary>
  /// Checks if a segment belongs to the subgraph of the Voronoi-diagram that approximates the medial axis.
  /// </summary>
  /// <param name="segment">The segment for which to check.</param>
  /// <param name="boundaryCurves">The curves describing the boundary for which to find the medial axis.</param>
  /// <returns>true if is medial axis segment, false otherwise.</returns>
  private bool IsValidSegment(Line segment, List<Curve> boundaryCurves, BoundingBox[] bbs, Brep walkableSurfaceBrep, double closenessTolerance)
  {
    bool isIntersecting = SegmentIntersectsBoundary(segment, boundaryCurves, bbs, RhinoMath.SqrtEpsilon);
    bool isWalkable = SegmentIsOnWalkableSurface(segment, walkableSurfaceBrep, RhinoMath.SqrtEpsilon);
    bool isTooCloseToBoundary = SegmentIsTooCloseToBoundary(segment, boundaryCurves, closenessTolerance);
    return !isIntersecting && isWalkable && !isTooCloseToBoundary;
  }

  /// <summary>
  /// Checks whether a segment crosses the boundary or is close enough (within a tolerance) to it.
  /// </summary>
  /// <param name="segment">The segment for which to check whether it crosses the boundary.</param>
  /// <param name="boundaryCurves">The curves that define the boundary.</param>
  /// <param name="tolerance">The distance to the boundary must be larger than this to be non-crossing.</param>
  /// <returns>true if the segment crosses the boundary or is too close to it. false otherwise.</returns>
  private bool SegmentIntersectsBoundary(Line segment, List<Curve> boundaryCurves, BoundingBox[] bbs, double tolerance)
  {
    bool intersects = false;
    BoundingBox currBB = segment.BoundingBox;
    for (int i = 0; i < boundaryCurves.Count; i++)
    {
      Curve boundaryCurve = boundaryCurves[i];
      if (currBB.IsValid && bbs[i].IsValid && !BoundingBoxesIntersect2D(currBB, bbs[i]))
      {
        continue;
      }
      if (Rhino.Geometry.Intersect.Intersection.CurveCurve(boundaryCurve, segment.ToNurbsCurve(), tolerance, 0.0).Count != 0)
      {
        intersects = true;
        break;
      }
    }
    return intersects;
  }

  /// <summary>
  /// Checks whether a segment lies on the walkable surface.
  /// </summary>
  /// <param name="segment">The segment for which the property should be checked.</param>
  /// <param name="tolerance">Distance from curve to walkable surface must be smaller than this to count as "on walkable surface".</param>
  /// <param name="walkableSurfaceBrep">The walkable surface.</param>
  /// <returns>true if segment is on walkable surface (within tolerance), false otherwise.</returns>
  private bool SegmentIsOnWalkableSurface(Line segment, Brep walkableSurfaceBrep, double tolerance)
  {
    Curve segmentCurve = segment.ToNurbsCurve();
    Curve[] overlapCurves;
    Point3d[] intersectionPoints;
    Rhino.Geometry.Intersect.Intersection.CurveBrep(segmentCurve, walkableSurfaceBrep, tolerance, out overlapCurves, out intersectionPoints);
    return overlapCurves.Length > 0 || intersectionPoints.Length > 0;
  }

  /// <summary>
  /// Checks for a segment if it is too close to the boundary. It does that by comparing the distance of the endpoints of the segment to all boundary curves.
  /// </summary>
  /// <param name="segment">The segment to check for.</param>
  /// <param name="boundaryCurves">The curves that define the boundary.</param>
  /// <param name="tolerance">If the distance is smaller than this, the segment is considered to be too close.</param>
  /// <returns>true if is too close, false otherwise.</returns>
  private bool SegmentIsTooCloseToBoundary(Line segment, List<Curve> boundaryCurves, double tolerance)
  {
    Curve segmentCurve = segment.ToNurbsCurve();
    Point3d startPoint = segmentCurve.PointAtStart;
    Point3d endPoint = segmentCurve.PointAtEnd;
    for (int i = 0; i < boundaryCurves.Count; i++)
    {
      Curve currCurve = boundaryCurves[i];
      double startParam = 0.1f;
      currCurve.ClosestPoint(startPoint, out startParam);
      if (startPoint.DistanceTo(currCurve.PointAt(startParam)) < tolerance)
      {
        return true;
      }
      double endParam = 0.1f;
      currCurve.ClosestPoint(endPoint, out endParam);
      if (endPoint.DistanceTo(currCurve.PointAt(endParam)) < tolerance)
      {
        return true;
      }
    }
    return false;
  }

  private bool BoundingBoxesIntersect2D(BoundingBox b0, BoundingBox b1)
  {
    return (b0.Min.X < b1.Max.X) && (b0.Max.X > b1.Min.X) && (b0.Min.Y < b1.Max.Y) && (b0.Max.Y > b1.Min.Y);
  }
# ---------- end createmedialaxis ----------

# ---- group: Order Medial Axis Segments
dupln_2 = RemoveDuplicateLines(Lines=flatten(createmedialaxis.medialAxisCurveList), Tolerance=Slider(0.01, range=0..1))
join = JoinCurves(Curves=dupln_2, Preserve=False)
explode_3 = Explode(Curve=join, Recursive=True)  # -> flatten(Segments), Vertices

# ---- group: Medial Axis Visualization
filter_2 = StreamFilter(Gate=visualize_medial_axis, Stream1=createmedialaxis.medialAxisCurveList)
previewlw_2 = CustomPreviewLineweights(Geometry=filter_2, Shader=medial_axis_color, Thickness=medial_axis_weight, Absolute=False)

# ----
branchpointclassificitaion = CSharpScript(
    SegmentCurveList=explode_3.Segments,
    LowerTolerance=Slider(12.5, range=0..1000),
    UpperTolerance=Slider(179, range=0..500))  # -> out, BranchPointList, BranchPointDelimitedCurveList, NewBranchPoints; inputs SegmentCurveList: list of Curve, LowerTolerance: Double, UpperTolerance: Double
# ---------- branchpointclassificitaion: C# usings ----------
using System.Diagnostics;
using Rhino.Geometry.Intersect;
# ---------- branchpointclassificitaion: C# ----------
    List<List<Curve>> contiguousSegmentList = PartitionSegmentsByAdjacencyParallel(SegmentCurveList); // Empirically, parallel method was substantially faster.

    // If a branchpoint is exactly at the start/end of a contiguous segment, we can only detect it by comparing to other starts or end of segments.
    List<Point3d> branchPoints = new List<Point3d>();
    List<Point3d> newBranchPoints = new List<Point3d>();
    for (int i = 0; i < contiguousSegmentList.Count; i++)
    {
      List<Curve> contiguous0 = contiguousSegmentList[i];
      Curve start0 = contiguous0[0];
      Curve end0 = contiguous0[contiguous0.Count - 1];
      for (int j = i + 1; j < contiguousSegmentList.Count; j++)
      {
        List<Curve> contiguous1 = contiguousSegmentList[j];
        Curve start1 = contiguous1[0];
        Curve end1 = contiguous1[contiguous1.Count - 1];
        CurveIntersections intersects0 = Intersection.CurveCurve(start0, start1, 0.1, 0.1);
        CurveIntersections intersects1 = Intersection.CurveCurve(start0, end1, 0.1, 0.1);
        CurveIntersections intersects2 = Intersection.CurveCurve(end0, start1, 0.1, 0.1);
        CurveIntersections intersects3 = Intersection.CurveCurve(end0, end1, 0.1, 0.1);
        if (intersects0.Count != 0)
        {
          double[] angles = CalculateAngles(new List<Curve>() { start0, start1 });
          double diff = Math.Abs(angles[0]);
          if (LowerTolerance <= diff && diff <= UpperTolerance)
          {
            branchPoints.Add(intersects0[0].PointA);
            newBranchPoints.Add(intersects0[0].PointA);
          }
        }
        else if (intersects1.Count != 0)
        {
          double[] angles = CalculateAngles(new List<Curve>() { start0, end1 });
          double diff = Math.Abs(angles[0]);
          if (LowerTolerance <= diff && diff <= UpperTolerance)
          {
            branchPoints.Add(intersects1[0].PointA);
            newBranchPoints.Add(intersects1[0].PointA);
          }
        }
        else if (intersects2.Count != 0)
        {
          double[] angles = CalculateAngles(new List<Curve>() { end0, start1 });
          double diff = Math.Abs(angles[0]);
          if (LowerTolerance <= diff && diff <= UpperTolerance)
          {
            branchPoints.Add(intersects2[0].PointA);
            newBranchPoints.Add(intersects2[0].PointA);
          }
        }
        else if (intersects3.Count != 0)
        {
          double[] angles = CalculateAngles(new List<Curve>() { end0, end1 });
          double diff = Math.Abs(angles[0]);
          if (LowerTolerance <= diff && diff <= UpperTolerance)
          {
            branchPoints.Add(intersects3[0].PointA);
            newBranchPoints.Add(intersects3[0].PointA);
          }
        }
      }
    }
    NewBranchPoints = newBranchPoints;

    foreach (List<Curve> contiguousSegments in contiguousSegmentList)
    {
      double[] angles = CalculateAngles(contiguousSegments);
      for (int i = 0; i < angles.Length; i++)
      {
        double currAngle = angles[i];
        bool branchPointDetected = ContainsPointParallel(contiguousSegments[i].PointAtEnd, branchPoints, RhinoMath.SqrtEpsilon);
        if (LowerTolerance <= currAngle && currAngle <= UpperTolerance || branchPointDetected)
        {
          if (!branchPointDetected)
          {
            branchPoints.Add(contiguousSegments[i].PointAtEnd);
          }
        }
      }
    }

    // Find branchpoints for each list of contiguous segments.
    List<Curve> branchPointDelimitedSegments = new List<Curve>();
    foreach (List<Curve> contiguousSegments in contiguousSegmentList)
    {
      List<Curve> currSegs = new List<Curve>();
      for (int i = 0; i < contiguousSegments.Count; i++)
      {
        currSegs.Add(contiguousSegments[i]);
        bool branchPointDetected = ContainsPointParallel(contiguousSegments[i].PointAtEnd, branchPoints, RhinoMath.SqrtEpsilon);
        if (branchPointDetected)
        {
          Curve[] joinedCurves = Curve.JoinCurves(currSegs, RhinoMath.SqrtEpsilon);
          if (joinedCurves.Length == 0)
          {
            throw new Exception("Joining curves was not successful.");
          }
          branchPointDelimitedSegments.AddRange(joinedCurves);
          currSegs = new List<Curve>();
        }
      }

      // Join the remaining unjoined segments.
      Curve[] lastJoinedCurves = Curve.JoinCurves(currSegs);
      if (lastJoinedCurves.Length == 0)
      {
        // throw new Exception("Joining curves at end was not successful.");
      }

      branchPointDelimitedSegments.AddRange(lastJoinedCurves);
    }
    BranchPointDelimitedCurveList = branchPointDelimitedSegments;
    BranchPointList = branchPoints;
# ---------- branchpointclassificitaion: C# additional code ----------
  private List<List<Curve>> PartitionSegmentsByAdjacencySequential(List<Curve> segmentCurveList)
  {
    // The medial axis comes in form of many line segments, which are not necessarily all consecutive. First, partition consecutive segments into sublists.
    List<List<Curve>> contiguousSegments = new List<List<Curve>>();
    List<Curve> contiguousSegment = new List<Curve>();
    for (int i = 0; i < segmentCurveList.Count - 1; i++)
    {
      // Always add the current segment.
      Curve currSeg = segmentCurveList[i];
      contiguousSegment.Add(currSeg);

      // Check for an intersect (then the segments are contiguous).
      Curve nextSeg = segmentCurveList[i + 1];
      CurveIntersections intersects = Intersection.CurveCurve(currSeg, nextSeg, RhinoMath.SqrtEpsilon, RhinoMath.SqrtEpsilon);
      if (intersects == null)
      {
        continue;
      }

      // No intersection, therefore the segments are not contiguous.
      if (intersects.Count == 0)
      {
        contiguousSegments.Add(contiguousSegment);
        contiguousSegment = new List<Curve>();
      }
    }
    contiguousSegment.Add(segmentCurveList[segmentCurveList.Count - 1]);
    contiguousSegments.Add(contiguousSegment);
    return contiguousSegments;
  }

  private List<List<Curve>> PartitionSegmentsByAdjacencyParallel(List<Curve> segmentCurveList)
  {
    // Duplicate lists to avoid read/write conflicts.
    List<Curve> duplicateSegmentCurveList = new List<Curve>(segmentCurveList); // The copying might be more costly than the sequential check.
    bool[] notAdjacent = new bool[segmentCurveList.Count - 1]; // Entry is true whenever the consecutive segment is not adjacent.
    System.Threading.Tasks.Parallel.For(0, notAdjacent.Length, i =>
      {
      CurveIntersections intersects = Intersection.CurveCurve(segmentCurveList[i], duplicateSegmentCurveList[i + 1], RhinoMath.SqrtEpsilon, RhinoMath.SqrtEpsilon);
      if (intersects != null)
      {
        if (intersects.Count == 0)
        {
          notAdjacent[i] = true;
        }
      }
      });

    List<List<Curve>> contiguousSegmentLists = new List<List<Curve>>();
    contiguousSegmentLists = new List<List<Curve>>();
    List<Curve> contiguousSegments = new List<Curve>();
    for (int i = 0; i < notAdjacent.Length; i++)
    {
      contiguousSegments.Add(segmentCurveList[i]);
      if (notAdjacent[i])
      {
        contiguousSegmentLists.Add(contiguousSegments);
        contiguousSegments = new List<Curve>();
      }
    }
    contiguousSegments.Add(segmentCurveList[segmentCurveList.Count - 1]);
    contiguousSegmentLists.Add(contiguousSegments);
    return contiguousSegmentLists;
  }

  private double[] CalculateAngles(List<Curve> segments)
  {
    Vector3d[] vectors = new Vector3d[segments.Count];
    for (int i = 0; i < segments.Count; i++)
    {
      Curve currSeg = segments[i];
      vectors[i] = new Vector3d(currSeg.PointAtEnd - currSeg.PointAtStart);
    }
    double[] angles = new double[segments.Count - 1];
    for (int i = 0; i < segments.Count - 1; i++)
    {
      angles[i] = RhinoMath.ToDegrees(Vector3d.VectorAngle(vectors[i], vectors[i + 1]));
    }
    return angles;
  }

  private double[] FiniteDifferences(double[] values)
  {
    double[] diffs = new double[values.Length - 1];
    for (int i = 0; i < diffs.Length; i++)
    {
      diffs[i] = values[i + 1] - values[i];
    }
    return diffs;
  }

  private bool ContainsPointParallel(Point3d queryPoint, List<Point3d> pointList, double tol)
  {
    bool[] isClose = new bool[pointList.Count];
    System.Threading.Tasks.Parallel.For(0, pointList.Count, i =>
    {
      isClose[i] = queryPoint.DistanceTo(pointList[i]) < tol;
    });
    for (int i = 0; i < isClose.Length; i++)
    {
      if (isClose[i])
      {
        return true;
      }
    }
    return false;
  }
# ---------- end branchpointclassificitaion ----------
scriptpar_6 = ScriptParasite(Enable=synchronization_enabled, Folder=script_directory)
duppt_4 = RemoveDuplicatePts(Points=branchpointclassificitaion.BranchPointList, Tolerance=0.01)

# ---- group: Filter segments that are completely covered by other segments
filtercoveredsegments = CSharpScript(SegmentCurveList=branchpointclassificitaion.BranchPointDelimitedCurveList)  # -> out, UncoveredSegmentCurves; inputs SegmentCurveList: list of Curve
# ---------- filtercoveredsegments: C# ----------
    // Sort segments by length.
    double[] lengths = new double[SegmentCurveList.Count];
    System.Threading.Tasks.Parallel.For(0, SegmentCurveList.Count, i =>
    {
      lengths[i] = SegmentCurveList[i].GetLength();
    });
    Curve[] segmentCurveArray = SegmentCurveList.ToArray();
    Array.Sort(lengths, segmentCurveArray);
    Array.Reverse(segmentCurveArray);

    // Create mask indicating if segment is covered.
    bool[] covered = new bool[segmentCurveArray.Length];

    // Test for each pair if the segment of greater or equal length completely covers the smaller segment.
    for (int i = 0; i < segmentCurveArray.Length; i++)
    {
      if (covered[i])
      {
        continue;
      }
      Curve largeSeg = segmentCurveArray[i];
      for (int j = i + 1; j < segmentCurveArray.Length; j++)
      {
        if (covered[j])
        {
          continue;
        }

        Curve smallSeg = segmentCurveArray[j];
        // Check if the smaller curve is covered completely by the larger curve, i.e.:
        // 1. There is an intersection.
        // 2. This intersection is an overlap.
        // 3. Up to some tolerance, the overlap domain is equivalent to the domain of the smaller curve.
        CurveIntersections intersects = Intersection.CurveCurve(largeSeg, smallSeg, 1.0, 1.0);
        if (intersects == null)
        {
          // No intersections.
          continue;
        }
        foreach (IntersectionEvent intersect in intersects)
        {
          if (!intersect.IsOverlap)
          {
            continue;
          }
          Interval smallDomain = smallSeg.Domain;
          if (intersect.OverlapB.Min <= smallDomain.Min + RhinoMath.SqrtEpsilon && smallDomain.Max - RhinoMath.SqrtEpsilon <= intersect.OverlapB.Max)
          {
            covered[j] = true;
          }
        }
      }
    }

    // Filter curves that are covered.
    List<Curve> notCovered = new List<Curve>();
    for (int i = 0; i < segmentCurveArray.Length; i++)
    {
      if (!covered[i])
      {
        notCovered.Add(segmentCurveArray[i]);
      }
    }
    UncoveredSegmentCurves = notCovered;
# ---------- end filtercoveredsegments ----------
scriptpar_7 = ScriptParasite(Enable=synchronization_enabled, Folder=script_directory)

# ---- group: Filter segments that are too small and are not adjacent to branchpoints. Too many small segment would complicate joining process
filterinvalidsegments = CSharpScript(
    SegmentCurveList=filtercoveredsegments.UncoveredSegmentCurves,
    MinLength=Slider(0.1, range=0..20),
    BranchPointList=duppt_4)  # -> out, FilteredSegmentCurveList; inputs SegmentCurveList: list of Curve, MinLength: Double, BranchPointList: list of Point3d
# ---------- filterinvalidsegments: C# ----------
    List<Curve> filteredSegments = new List<Curve>();
    foreach (Curve segment in SegmentCurveList)
    {
      if (segment.GetLength() >= MinLength || ContainsPointParallel(segment.PointAtStart, BranchPointList, 0.1) || ContainsPointParallel(segment.PointAtEnd, BranchPointList, RhinoMath.SqrtEpsilon))
      {
        filteredSegments.Add(segment);
      }
    }
    FilteredSegmentCurveList = filteredSegments;
# ---------- filterinvalidsegments: C# additional code ----------
  private bool ContainsPointParallel(Point3d queryPoint, List<Point3d> pointList, double tol)
  {
    bool[] isClose = new bool[pointList.Count];
    System.Threading.Tasks.Parallel.For(0, pointList.Count, i =>
    {
      isClose[i] = queryPoint.DistanceTo(pointList[i]) < tol;
    });
    for (int i = 0; i < isClose.Length; i++)
    {
      if (isClose[i])
      {
        return true;
      }
    }
    return false;
  }
# ---------- end filterinvalidsegments ----------
scriptpar_8 = ScriptParasite(Enable=synchronization_enabled, Folder=script_directory)

# ----
topologizer = CSharpScript(
    SegmentCurveList=filterinvalidsegments.FilteredSegmentCurveList,
    BranchPointList=duppt_4,
    CornerPointList=duppt_3,
    CornerTol=boundary_proximity_tolerance)  # -> out, BranchPointDelimitedCurvesList, SplitSegments, crv1, crv2, specialIntersects, A, B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; inputs SegmentCurveList: list of Curve, BranchPointList: list of Point3d, CornerPointList: list of Point3d, CornerTol: Double
# ---------- topologizer: C# ----------
    const double INTERSECTION_TOL = 0.1;
    const double JOIN_TOL = 0.1;

    // It often happens that the curves are self-overlapping, especially when they are branching out towards a corner.
    // To get rid of these overlaps, the curves are first broken in extremal points close to corner locations.
    List<Curve> splitSegments = SplitAtCorners(SegmentCurveList, CornerPointList, BranchPointList, CornerTol);
    step1Segs = new List<Curve>(splitSegments);
    List<List<Curve>> intersectionPairs = new List<List<Curve>>();

    // Split curves in pairwise fashion.
    for (int i = 0; i < splitSegments.Count; i++)
    {
      Curve seg0 = splitSegments[i];
      for (int j = i + 1; j < splitSegments.Count; j++)
      {
        Curve seg1 = splitSegments[j];

        // Intersection test.
        CurveIntersections intersects = Intersection.CurveCurve(seg0, seg1, INTERSECTION_TOL, INTERSECTION_TOL);

        // No intersections.
        if (intersects == null)
        {
          continue;
        }

        // Check for overlaps.
        foreach (IntersectionEvent intersect in intersects)
        {
          if (intersect.IsPoint)
          {
            intersectionPairs.Add(new List<Curve> { seg0, seg1 });
            if (!IsCurveEndPoint(seg0, intersect.ParameterA, INTERSECTION_TOL))
            {
              Curve[] split0 = seg0.Split(intersect.ParameterA);
              if (split0 == null)
              {
                throw new Exception("Splitting at point intersection with first segment failed.");
              }
              Curve longerSeg0 = split0[0].GetLength() > split0[1].GetLength() ? split0[0] : split0[1];
              splitSegments.Add(longerSeg0);
              seg0 = longerSeg0;
            }
            if (!IsCurveEndPoint(seg1, intersect.ParameterB, INTERSECTION_TOL))
            {
              Curve[] split1 = seg1.Split(intersect.ParameterB);
              Curve longerSeg1 = split1[0].GetLength() > split1[1].GetLength() ? split1[0] : split1[1];
              splitSegments[j] = longerSeg1;
              seg1 = longerSeg1;
            }
            continue;
          }
          else // Intersection is overlap.
          {
            // Check if the first segment is completely covered by the second one.
            if (intersect.OverlapA.Min <= seg0.Domain.Min + RhinoMath.SqrtEpsilon && seg0.Domain.Max - RhinoMath.SqrtEpsilon <= intersect.OverlapA.Max)
            {
              splitSegments[i] = null;
            }
            else
            {

              // Otherwise just remove the part from the first segment that is overlapping.
              bool minInDomain = IsInCurveDomain(seg0, intersect.OverlapA.Min, INTERSECTION_TOL);
              bool maxInDomain = IsInCurveDomain(seg0, intersect.OverlapA.Max, INTERSECTION_TOL);

              // Ensure that always exactly one side of the interval is in the domain, otherwise this would not be a valid overlap.
              if (!minInDomain ^ maxInDomain)
              {
                if (intersect.OverlapA.Max - intersect.OverlapA.Min < INTERSECTION_TOL || intersect.OverlapB.Max - intersect.OverlapB.Min < INTERSECTION_TOL)
                {
                  // This should actually be a point-intersection, but for some reason, Rhino fucked up.
                  if (!IsCurveEndPoint(seg0, intersect.ParameterA, RhinoMath.SqrtEpsilon))
                  {
                    // Curves intersect at endpoints, so we can ignore that case.
                    Curve[] split0 = seg0.Split(intersect.ParameterA);
                    Curve longerSeg0 = split0[0].GetLength() > split0[1].GetLength() ? split0[0] : split0[1];
                    splitSegments[i] = longerSeg0;
                  }
                  if (!IsCurveEndPoint(seg1, intersect.ParameterB, RhinoMath.SqrtEpsilon))
                  {
                    Curve[] split1 = seg1.Split(intersect.ParameterB);
                    Curve longerSeg1 = split1[0].GetLength() > split1[1].GetLength() ? split1[0] : split1[1];
                    splitSegments[j] = longerSeg1;
                  }
                  continue;
                }
                continue;
              }
              Curve segmentToSurvive;
              if (minInDomain)
              {
                segmentToSurvive = seg0.Split(intersect.OverlapA.Min)[0];
              }
              else
              {
                segmentToSurvive = seg0.Split(intersect.OverlapA.Max)[1];
              }
              splitSegments[i] = segmentToSurvive;
              seg0 = segmentToSurvive;
            }
          }
        }
      }
    }
    SplitSegments = splitSegments;

    // Building segment graph where segments are nodes and there is and edge between segments iff they intersect at a point which is not a branchpoint.
    Dictionary<Curve, List<Curve>> segmentGraph = new Dictionary<Curve, List<Curve>>();
    for (int i = 0; i < splitSegments.Count; i++)
    {
      Curve seg0 = splitSegments[i];
      if (seg0 == null)
      {
        continue;
      }
      segmentGraph[seg0] = new List<Curve> { seg0 };
      for (int j = 0; j < splitSegments.Count; j++)
      {
        if (i == j)
        {
          continue;
        }
        Curve seg1 = splitSegments[j];
        if (seg1 == null)
        {
          continue;
        }
        CurveIntersections intersects = Intersection.CurveCurve(seg0, seg1, INTERSECTION_TOL, INTERSECTION_TOL);

        // No intersections between curves.
        if (intersects == null)
        {
          continue;
        }

        // Go through each intersect and check whether curves intersect at point which is not branchpoint. In that case, we create an edge.
        foreach (IntersectionEvent intersect in intersects)
        {
          Point3d intersectionPoint = intersect.PointA;
          if (!ContainsPointParallel(intersectionPoint, BranchPointList, INTERSECTION_TOL))
          {
            segmentGraph[seg0].Add(seg1);
          }
        }
      }
    }

    // Run BFS for each start node to find connected component.
    List<Curve> joinedSegments = new List<Curve>();
    Dictionary<Curve, bool> visited = new Dictionary<Curve, bool>(); // Tracks whether a curve was already assigned to a connected component.
    foreach (KeyValuePair<Curve, List<Curve>> keyVal in segmentGraph)
    {
      visited[keyVal.Key] = false;
    }
    foreach (KeyValuePair<Curve, List<Curve>> keyValue in segmentGraph)
    {
      Curve initSeg = keyValue.Key;
      List<Curve> neighbors = keyValue.Value;
      if (visited[initSeg])
      {
        continue;
      }
      if (neighbors.Count == 1)
      {
        joinedSegments.Add(initSeg); // If there is only one neighbor, then it is the curve itself and we can join it without any additional joining.
        visited[initSeg] = true;
        continue;
      }

      // The segment has more than one neighbor, so we run BFS to find connected component.
      List<Curve> connectedComponent = new List<Curve>();
      Queue<Curve> queue = new Queue<Curve>();
      queue.Enqueue(initSeg);
      while (queue.Count != 0)
      {
        Curve currSeg = queue.Dequeue();
        if (visited[currSeg])
        {
          continue;
        }
        connectedComponent.Add(currSeg);
        visited[currSeg] = true;
        foreach (Curve neighbor in segmentGraph[currSeg])
        {
          queue.Enqueue(neighbor);
        }
      }
      Print(connectedComponent.Count.ToString());
      Curve[] joinedConnectedComponent = Curve.JoinCurves(connectedComponent, JOIN_TOL);
      joinedSegments.AddRange(joinedConnectedComponent);
    }
    BranchPointDelimitedCurvesList = joinedSegments;
# ---------- topologizer: C# additional code ----------
  private bool IsCurveEndPoint(Curve curve, double param, double tol)
  {
    Interval curveDomain = curve.Domain;
    return param <= curve.Domain.Min + tol || curveDomain.Max - tol <= param;
  }

  private bool IsInCurveDomain(Curve curve, double param, double tol)
  {
    Interval curveDomain = curve.Domain;
    return curveDomain.Min + tol <= param && param <= curveDomain.Max - tol;
  }
  private bool ContainsPointParallel(Point3d queryPoint, List<Point3d> pointList, double tol)
  {
    bool[] isClose = new bool[pointList.Count];
    System.Threading.Tasks.Parallel.For(0, pointList.Count, i =>
    {
      isClose[i] = queryPoint.DistanceTo(pointList[i]) < tol;
    });
    for (int i = 0; i < isClose.Length; i++)
    {
      if (isClose[i])
      {
        return true;
      }
    }
    return false;
  }

  private List<Curve> SplitAtCorners(List<Curve> segments, List<Point3d> corners, List<Point3d> branchpoints, double cornerTol)
  {
    List<Curve> splitSegments = new List<Curve>();
    foreach (Curve seg in segments)
    {
      bool wasSplit = false;
      foreach (Point3d corner in corners)
      {
        double closestCornerParam;
        seg.ClosestPoint(corner, out closestCornerParam);
        Interval domain = seg.Domain;
        if (corner.DistanceTo(seg.PointAt(closestCornerParam)) > 1.5 * cornerTol)
        {
          continue;
        }
        // At this point we assume that only a segment that reaches into a corner can come closes enough to fulfill this condition.
        // There are two cases:
        // 1. Either the closest point to a corner lies somewhere within the segment, in which case we simply split it and choose the longer split segment and discard the other.
        // 2. The closest point is a start or end point of the segment. In this case we need to find the closest branchpoint and split the segment there, again discarding the shorter one.
        if (IsCurveEndPoint(seg, closestCornerParam, RhinoMath.SqrtEpsilon))
        {
          foreach (Point3d branchpoint in branchpoints)
          {
            double closestBranchpointParam;
            seg.ClosestPoint(branchpoint, out closestBranchpointParam);
            if (seg.PointAt(closestBranchpointParam).DistanceTo(branchpoint) < RhinoMath.SqrtEpsilon)
            {
              if (IsCurveEndPoint(seg, closestBranchpointParam, RhinoMath.SqrtEpsilon))
              {
                // In this case the segment is already well-formed, as the brachpoint lies on the other end of the segment.
                break;
              }

              Curve[] splitAtBranchPoint = seg.Split(closestBranchpointParam);

              // Null check.
              if (splitAtBranchPoint == null)
              {
                throw new Exception("Attempted to split corner-segment at branchpoint: " + closestCornerParam.ToString() + ", " + closestBranchpointParam.ToString());
              }

              // Identify longer segment.
              Curve longerSplit = splitAtBranchPoint[0].GetLength() > splitAtBranchPoint[1].GetLength() ? splitAtBranchPoint[0] : splitAtBranchPoint[1];
              splitSegments.Add(longerSplit);
              wasSplit = true;
              break;
            }
          }
        }
        else
        {
          Curve[] splitAtCorner = seg.Split(closestCornerParam);
          if (splitAtCorner == null)
          {
            throw new Exception("Attempted to split corner-segment at corner.");
          }
          Curve longerSplit = splitAtCorner[0].GetLength() > splitAtCorner[1].GetLength() ? splitAtCorner[0] : splitAtCorner[1];
          splitSegments.Add(longerSplit);
          wasSplit = true;
        }
        break;
      }
      if (!wasSplit)
      {
        splitSegments.Add(seg);
      }
    }
    return splitSegments;
  }
# ---------- end topologizer ----------
scriptpar_9 = ScriptParasite(Enable=synchronization_enabled, Folder=script_directory)

# ---- group: Debugging Medial Axis Topology
python = GhPythonScript(inputs=topologizer.BranchPointDelimitedCurvesList)  # -> out, a; inputs inputs: list
# ---------- python: Python ----------
__author__ = "rapha"
__version__ = "2022.02.11"

import rhinoscriptsyntax as rs

if len(inputs) <= 1:
    a = [0.5]
else:
    a = [1.0 / (len(inputs) - 1) * i for i in range(len(inputs))]
# ---------- end python ----------
gradient = Gradient(
    LowerLimit=0,
    UpperLimit=1,
    Parameter=python.a,
    stops=[0: RGB(243, 57, 0), 0.1: RGB(236, 27, 60), 0.2: RGB(210, 0, 118), 0.284: RGB(103, 0, 120), 0.4: RGB(39, 72, 161), 0.5: RGB(1, 192, 229), 0.6: RGB(18, 178, 90), 0.7: RGB(79, 186, 8), 0.8: RGB(220, 237, 32), 0.9: RGB(247, 159, 20), 1: RGB(243, 57, 0)])
number_slider_5 = Slider(1, range=0..1)
jitter = Jitter(List=gradient, Jitter=1, Seed=Slider(517, range=0..1000))  # -> Values, Indices
previewlw_3 = CustomPreviewLineweights(
    Geometry=topologizer.BranchPointDelimitedCurvesList,
    Shader=jitter.Values,
    Thickness=Slider(50, range=0..50),
    Absolute=False)
number_slider_6 = Slider(39, range=0..100)
crv_2 = Curve(topologizer.BranchPointDelimitedCurvesList)
item = ListItem(List=crv_2, Index=Slider(56, range=0..81), Wrap=True)

# ----
crv_3 = Curve(reparameterize(topologizer.BranchPointDelimitedCurvesList))
classifymedialaxissegments = CSharpScript(
    MedialAxisCurveList=crv_3,
    InitialStepSize=Slider(2, range=0..10),
    BoundaryCurveList=dupln,
    CornerPointList=duppt_2,
    BranchPointList=duppt_4)  # -> out, ClassifiedPointList, TypeList, SwitchPointMedialAxisCurveIdx, SwitchPointParameters, SwitchPointPreviousTypes, SwitchPointNextTypes; inputs MedialAxisCurveList: list of Curve, InitialStepSize: Double, BoundaryCurveList: list of Curve, CornerPointList: list of Point3d, BranchPointList: list of Point3d
# ---------- classifymedialaxissegments: C# usings ----------
using Rhino.Geometry.Intersect;
using System.Linq;
# ---------- classifymedialaxissegments: C# ----------
    // Parameters corresponding to the locations of the points to be classified.
    List<double> queryParams = new List<double>();

    // Locations of the points to be classified.
    List<Point3d> queryPoints = new List<Point3d>();

    // Maps medial axis segments to sublist (indexes by start and length) containing the classified medial axis points.
    Dictionary<Curve, Tuple<int, int>> medialAxisCurve2Index = new Dictionary<Curve, Tuple<int, int>>();
    foreach (Curve medialAxisCurve in MedialAxisCurveList)
    {
      List<double> parameters = new List<double>();
      if (medialAxisCurve.GetLength() < InitialStepSize)
      {
        parameters.Add(medialAxisCurve.Domain.Mid);
      }
      else
      {
        parameters.AddRange(medialAxisCurve.DivideByLength(InitialStepSize, includeEnds: false));
      }
      Tuple<int, int> tup = new Tuple<int, int>(queryPoints.Count, parameters.Count);
      medialAxisCurve2Index.Add(medialAxisCurve, tup);
      foreach (double param in parameters)
      {
        queryPoints.Add(medialAxisCurve.PointAt(param));
      }
      queryParams.AddRange(parameters);
    }
    int[] types = new int[queryPoints.Count];
    System.Threading.Tasks.Parallel.For(0, queryPoints.Count, i =>
      {
      types[i] = ClassifyMedialAxisPoint(queryPoints[i], CornerPointList, BoundaryCurveList);
      });

    List<int> typeList = types.ToList();

    // Now we identify all switchpoints. A switchpoint is given as a three-tuple:
    // 1. Parameter of the switchpoint on the curve.
    // 2. Type of the previous segment.
    // 3. Type of the following segment
    Dictionary<Curve, List<SwitchPoint>> medialAxisCurve2SwitchPointList = new Dictionary<Curve, List<SwitchPoint>>();
    foreach (Curve medialAxisCurve in MedialAxisCurveList)
    {

      // Initialize.
      medialAxisCurve2SwitchPointList[medialAxisCurve] = new List<SwitchPoint>();

      // Get sublist of classified points parameters and types.
      Tuple<int, int> range = medialAxisCurve2Index[medialAxisCurve];
      List<double> currParams = queryParams.GetRange(range.Item1, range.Item2);
      List<int> currTypes = typeList.GetRange(range.Item1, range.Item2);

      // Find first point that is not classified as full-ligature. Everything before that point will be assumend to be a full-ligature.
      int startIdx = 0;
      while (startIdx < currTypes.Count && currTypes[startIdx] == 2)
      {
        startIdx++;
      }

      if (startIdx == currTypes.Count)
      {
        // This segment only consists of full ligatures, so we can set the startIdx back to 0.
        startIdx = 0;
      }

      double lastFullLigParam = startIdx > 1 ? currParams[startIdx - 1] : 0.0;

      // Find first switch-point. Work from inside to outside.
      double startSwitchParam = 0.0;
      if (startIdx == 0)
      {
        Chord initChord = GetChordParallel(medialAxisCurve.PointAt(currParams[startIdx]), BoundaryCurveList);
        startSwitchParam = FindStartSwitchPoint(medialAxisCurve, CornerPointList, BoundaryCurveList, lastFullLigParam, currParams[startIdx], currTypes[startIdx], initChord);
      }
      else
      {
        startSwitchParam = FindSwitchPoint(medialAxisCurve, CornerPointList, BoundaryCurveList, lastFullLigParam, currParams[startIdx], 2);
      }
      medialAxisCurve2SwitchPointList[medialAxisCurve].Add(new SwitchPoint(startSwitchParam, 2, currTypes[startIdx]));

      // Now we will construct all switch points:
      int currType = currTypes[startIdx];
      double lastParam = currParams[startIdx];
      int endIdx = currTypes.Count - 1;
      while (endIdx >= 0 && currTypes[endIdx] == 2)
      {
        endIdx--;
      }

      if (endIdx == -1)
      {
        // We went all the way to the beginning. We can set the index to the last element.
        endIdx = currTypes.Count - 1;
      }
      for (int i = startIdx + 1; i < endIdx + 1; i++)
      {
        // If the types differ, there must lie a switchpoint between these two classified points.
        if (currTypes[i] != currType)
        {
          double switchParam = FindSwitchPoint(medialAxisCurve, CornerPointList, BoundaryCurveList, lastParam, currParams[i], currType);
          medialAxisCurve2SwitchPointList[medialAxisCurve].Add(new SwitchPoint(switchParam, currType, currTypes[i]));
          currType = currTypes[i];
          lastParam = currParams[i];
        }
      }

      double firstFullLigParam = endIdx < currTypes.Count - 1 ? currParams[endIdx + 1] : 1.0;

      // Find last switch-point. Work from inside to outside.
      double endSwitchParam = 0.0;
      if (endIdx == currTypes.Count - 1)
      {
        Chord lastChord = GetChordParallel(medialAxisCurve.PointAt(currParams[endIdx]), BoundaryCurveList);
        endSwitchParam = FindEndSwitchPoint(medialAxisCurve, CornerPointList, BoundaryCurveList, currParams[endIdx], firstFullLigParam, currTypes[endIdx], lastChord);
      }
      else
      {
        // In this case we are far enough inside the curve (for reasonable initial sampling resolutions) s.t. we do not need to use the special treatment of the last case.
        endSwitchParam = FindSwitchPoint(medialAxisCurve, CornerPointList, BoundaryCurveList, currParams[endIdx], firstFullLigParam, currTypes[endIdx]);
      }
      medialAxisCurve2SwitchPointList[medialAxisCurve].Add(new SwitchPoint(endSwitchParam, currTypes[endIdx], 2));
    }

    ClassifiedPointList = queryPoints;
    TypeList = types;

    List<Point3d> switchPoints = new List<Point3d>();
    List<Line> chords = new List<Line>();
    foreach (KeyValuePair<Curve, List<SwitchPoint>> keyVal in medialAxisCurve2SwitchPointList)
    {
      foreach (SwitchPoint switchPoint in keyVal.Value)
      {
        switchPoints.Add(keyVal.Key.PointAt(switchPoint.param));
        Chord chord = GetChordParallel(keyVal.Key.PointAt(switchPoint.param), BoundaryCurveList);
        chords.Add(new Line(chord.points.Item1, chord.points.Item2));
      }
    }

    // Deconstruct mapping from curves to switchpoints such that it can be used in later components.
    List<int> switchPointMedialAxisIdx = new List<int>();
    List<double> switchPointParameters = new List<double>();
    List<int> switchPointPreviousTypes = new List<int>();
    List<int> switchPointNextTypes = new List<int>();
    foreach (KeyValuePair<Curve, List<SwitchPoint>> keyVal in medialAxisCurve2SwitchPointList)
    {
      Curve currMedax = keyVal.Key;
      int currMedaxIdx = MedialAxisCurveList.IndexOf(currMedax);
      List<SwitchPoint> currSwitchPoints = keyVal.Value;
      foreach (SwitchPoint switchPoint in currSwitchPoints)
      {
        switchPointMedialAxisIdx.Add(currMedaxIdx);
        switchPointParameters.Add(switchPoint.param);
        switchPointPreviousTypes.Add(switchPoint.prevType);
        switchPointNextTypes.Add(switchPoint.nextType);
      }
    }
    SwitchPointMedialAxisCurveIdx = switchPointMedialAxisIdx;
    SwitchPointParameters = switchPointParameters;
    SwitchPointPreviousTypes = switchPointPreviousTypes;
    SwitchPointNextTypes = switchPointNextTypes;
# ---------- classifymedialaxissegments: C# additional code ----------
  public struct SwitchPoint
  {
    public SwitchPoint(double param, int prevType, int nextType)
    {
      this.param = param;
      this.prevType = prevType;
      this.nextType = nextType;
    }
    public double param;
    public int prevType;
    public int nextType;
  }

  public struct Chord
  {
    public Chord(Tuple<double, double> chordParams, Tuple<Curve, Curve> boundaryCurves, Tuple<Point3d, Point3d> chordPoints)
    {
      parameters = chordParams;
      curves = boundaryCurves;
      points = chordPoints;
      line = new LineCurve(chordPoints.Item1, chordPoints.Item2);
    }
    public Tuple<double, double> parameters;
    public Tuple<Curve, Curve> curves;
    public Tuple<Point3d, Point3d> points;
    public LineCurve line;
  }

  public struct PointOnCurve
  {
    public PointOnCurve(Curve curve, double param, Point3d point)
    {
      this.curve = curve;
      this.param = param;
      this.point = point;
    }
    public Curve curve;
    public double param;
    public Point3d point;
  }

  private int ClassifyMedialAxisPoint(Point3d medialAxisPoint, List<Point3d> CornerPointList, List<Curve> BoundaryCurveList)
  {
    // Find the two closest points on the boundary. The connecting line is called "chord", thus chordEnds.
    Chord chord = GetChordParallel(medialAxisPoint, BoundaryCurveList);

    // There are three types of medial-axis points:
    // 1. Chord-ends are both on a normal boundary segment, so not on a corner.
    // 2. Just one chord-end is a corner of the boundary, the other one is a normal segment.
    // 3. Both chord-ends are corners.
    bool isCorner0 = ContainsPointParallel(chord.points.Item1, CornerPointList, RhinoMath.SqrtEpsilon);
    bool isCorner1 = ContainsPointParallel(chord.points.Item2, CornerPointList, RhinoMath.SqrtEpsilon);
    if (!isCorner0 && !isCorner1)
    {
      return 0;
    }
    else if (isCorner0 && !isCorner1 || !isCorner0 && isCorner1)
    {
      return 1;
    }
    else
    {
      return 2;
    }
  }

  private double FindSwitchPoint(Curve medialAxisCurve, List<Point3d> cornerPointList, List<Curve> boundaryCurveList, double prevParam, double nextParam, int prevType)
  {
    // We test in the middle of the interval delimited by lowerParam and higherParam.
    double queryParam = 0.5 * (prevParam + nextParam);

    // We have reached reasonable accuracy.
    if (Math.Abs(queryParam - prevParam) <= RhinoMath.SqrtEpsilon)
    {
      return prevParam;
    }
    else
    {
      // Classify the query-point.
      int queryType = ClassifyMedialAxisPoint(medialAxisCurve.PointAt(queryParam), cornerPointList, boundaryCurveList);

      // If the queryType is different than the type associated with the lower interval parameter, then we have overshot the type-switchpoint and we
      // must sample in the interval [lowerParam, queryParam].
      if (queryType != prevType)
      {
        return FindSwitchPoint(medialAxisCurve, cornerPointList, boundaryCurveList, prevParam, queryParam, prevType);
      }

        // If the queryType is equal to the lowerType, we sample in the upper interval.
      else
      {
        return FindSwitchPoint(medialAxisCurve, cornerPointList, boundaryCurveList, queryParam, nextParam, prevType);
      }
    }
  }

  private double FindStartSwitchPoint(
    Curve medialAxisCurve,
    List<Point3d> cornerPointList,
    List<Curve> boundaryCurveList,
    double prevParam,
    double nextParam,
    int nextType,
    Chord oldChord)
  {
    // We test in the middle of the interval delimited by lowerParam and higherParam.
    double queryParam = 0.5 * (prevParam + nextParam);

    // We have reached reasonable accuracy.
    if (Math.Abs(nextParam - queryParam) <= RhinoMath.SqrtEpsilon)
    {
      return nextParam;
    }
    else
    {
      Point3d queryPoint = medialAxisCurve.PointAt(queryParam);
      Chord chord = GetChordParallel(queryPoint, boundaryCurveList);
      LineCurve chordLine = chord.line;

      // Condition 1: Medial axis crosses the segment in question.
      bool isIntersecting = Intersection.CurveCurve(medialAxisCurve, chordLine, RhinoMath.SqrtEpsilon, RhinoMath.SqrtEpsilon).Count > 0;

      // Condition 2: Types are the same.
      int currType = ClassifyMedialAxisPoint(queryPoint, cornerPointList, boundaryCurveList);
      bool typesAreSame = currType == nextType;

      // Condition 3: The closest boundary segments are the same.
      Curve old1 = oldChord.curves.Item1;
      Curve old2 = oldChord.curves.Item2;
      Curve new1 = chord.curves.Item1;
      Curve new2 = chord.curves.Item2;
      bool sameBoundary = old1 == new1 && old2 == new2 || old1 == new2 && old2 == new1;

      // If any of the conditions is not fulfilled, we are too close to the branchpoints and need to sample in the halfinterval which is farther away from branchpoint.
      if (!isIntersecting || !typesAreSame || !sameBoundary)
      {
        // We are too early on the line and need to subsample in the upper halfinterval.
        return FindStartSwitchPoint(medialAxisCurve, cornerPointList, boundaryCurveList, queryParam, nextParam, nextType, oldChord);
      }
      else
      {
        // The chord is still crossing the medial axis, so we can sample the lower halfinterval.
        return FindStartSwitchPoint(medialAxisCurve, cornerPointList, boundaryCurveList, prevParam, queryParam, nextType, chord);
      }
    }
  }
  private double FindEndSwitchPoint(
    Curve medialAxisCurve,
    List<Point3d> cornerPointList,
    List<Curve> boundaryCurveList,
    double prevParam,
    double nextParam,
    int nextType,
    Chord oldChord)
  {
    // We test in the middle of the interval delimited by lowerParam and higherParam.
    double queryParam = 0.5 * (prevParam + nextParam);

    // We have reached reasonable accurary.
    if (Math.Abs(queryParam - prevParam) <= RhinoMath.SqrtEpsilon)
    {
      Point3d queryPoint = medialAxisCurve.PointAt(prevParam);
      Chord chord = GetChordParallel(queryPoint, boundaryCurveList);
      CheckConditions(medialAxisCurve, queryPoint, chord, boundaryCurveList, cornerPointList, oldChord, nextType);
      return prevParam;
    }
    else
    {
      Point3d queryPoint = medialAxisCurve.PointAt(queryParam);
      Chord chord = GetChordParallel(queryPoint, boundaryCurveList);
      if (!CheckConditions(medialAxisCurve, queryPoint, chord, boundaryCurveList, cornerPointList, oldChord, nextType))
      {
        return FindEndSwitchPoint(medialAxisCurve, cornerPointList, boundaryCurveList, prevParam, queryParam, nextType, oldChord);
      }
      else
      {
        return FindEndSwitchPoint(medialAxisCurve, cornerPointList, boundaryCurveList, queryParam, nextParam, nextType, chord);
      }
    }
  }

  private bool CheckConditions(Curve medialAxisCurve, Point3d queryPoint, Chord newChord, List<Curve> boundaryCurveList, List<Point3d> cornerPointList, Chord oldChord, int nextType)
  {
    LineCurve chordLine = newChord.line;

    // Condition 1: Medial axis crosses the segment in question.
    bool isIntersecting = Intersection.CurveCurve(medialAxisCurve, chordLine, RhinoMath.SqrtEpsilon, RhinoMath.SqrtEpsilon).Count > 0;

    // Condition 2: Types are the same.
    int currType = ClassifyMedialAxisPoint(queryPoint, cornerPointList, boundaryCurveList);
    bool typesAreSame = currType == nextType;

    // Condition 3: The closest boundary segments are the same.
    Curve old1 = oldChord.curves.Item1;
    Curve old2 = oldChord.curves.Item2;
    Curve new1 = newChord.curves.Item1;
    Curve new2 = newChord.curves.Item2;
    bool sameBoundary = old1 == new1 && old2 == new2 || old1 == new2 && old2 == new1;
    return isIntersecting && typesAreSame && sameBoundary;
  }

  private Chord GetChordParallel(Point3d queryPoint, List<Curve> boundaryCurveList)
  {
    PointOnCurve[] closestPoints = new PointOnCurve[boundaryCurveList.Count];  // Holds closest point on each boundary-segment to point on medial axis.
    double[] distances = new double[boundaryCurveList.Count];  // Holds the distances to the closest points.

    // Determine closest points on boundary segments and distances to them.
    System.Threading.Tasks.Parallel.For(0, boundaryCurveList.Count, i =>
      {
      double closestParam = 0.0;
      boundaryCurveList[i].ClosestPoint(queryPoint, out closestParam);
      Point3d closestPoint = boundaryCurveList[i].PointAt(closestParam);
      distances[i] = queryPoint.DistanceTo(closestPoint);
      closestPoints[i] = new PointOnCurve(boundaryCurveList[i], closestParam, closestPoint);
      });

    Array.Sort(distances, closestPoints);
    Point3d c0 = closestPoints[0].point;
    int idx = 1;
    while (idx < closestPoints.Length && c0.DistanceTo(closestPoints[idx].point) < 1.0)
    {
      idx++;
    }
    double param0 = closestPoints[0].param;
    double param1 = closestPoints[idx].param;
    Curve curve0 = closestPoints[0].curve;
    Curve curve1 = closestPoints[idx].curve;
    Point3d point0 = closestPoints[0].point;
    Point3d point1 = closestPoints[idx].point;
    return new Chord(new Tuple<double, double>(param0, param1), new Tuple<Curve, Curve>(curve0, curve1), new Tuple<Point3d, Point3d>(point0, point1));
  }

  private bool ContainsPointParallel(Point3d queryPoint, List<Point3d> pointList, double tol)
  {
    bool[] isClose = new bool[pointList.Count];
    System.Threading.Tasks.Parallel.For(0, pointList.Count, i =>
      {
      isClose[i] = queryPoint.DistanceTo(pointList[i]) < tol;
      });
    for (int i = 0; i < isClose.Length; i++)
    {
      if (isClose[i])
      {
        return true;
      }
    }
    return false;
  }
# ---------- end classifymedialaxissegments ----------
scriptpar_10 = ScriptParasite(Enable=toggle, Folder=panel)

createelementarysurfaces = CSharpScript(
    SwitchPointMedialAxisCurveIdx=classifymedialaxissegments.SwitchPointMedialAxisCurveIdx,
    SwitchPointParameters=classifymedialaxissegments.SwitchPointParameters,
    SwitchPointPreviousTypes=classifymedialaxissegments.SwitchPointPreviousTypes,
    SwitchPointNextTypes=classifymedialaxissegments.SwitchPointNextTypes,
    BoundaryCurveList=dupln,
    BranchPointList=duppt_4,
    MedialAxisCurveList=crv_3)  # -> out, ElementarySurfacesList, ElementarySurfaceTypeList, NodeLocations, Edges, OutBreps, OutTypes, OutLocations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; inputs SwitchPointMedialAxisCurveIdx: list of Int32, SwitchPointParameters: list of Double, SwitchPointPreviousTypes: list of Int32, SwitchPointNextTypes: list of Int32, BoundaryCurveList: list of Curve, BranchPointList: list of Point3d, MedialAxisCurveList: list of Curve
# ---------- createelementarysurfaces: C# usings ----------
using System.Linq;
using Rhino.Geometry.Intersect;
# ---------- createelementarysurfaces: C# ----------
    // Reassemble input into mapping from medial axis curves to switchpoints.
    Dictionary<Curve, List<SwitchPoint>> medax2SwitchPoint = ReassembleInput(MedialAxisCurveList, SwitchPointMedialAxisCurveIdx, SwitchPointParameters, SwitchPointPreviousTypes, SwitchPointNextTypes);

    // Reassemble medial axis curves.
    MedialAxisCurveList = new List<Curve>();
    foreach (KeyValuePair<Curve, List<SwitchPoint>> keyVal in medax2SwitchPoint)
    {
      MedialAxisCurveList.Add(keyVal.Key);
    }

    // Create surfaces and graph.
    List<Brep> elementaryBreps = new List<Brep>();
    List<int> elementaryBrepTypes = new List<int>();
    Dictionary<Node, List<Node>> graph = new Dictionary<Node, List<Node>>(); // Each key is a vertex, each value is a list of neighbors.
    Dictionary<Curve, List<Node>> medax2Node = new Dictionary<Curve, List<Node>>(); // Maps medial axis curves to nodes for more efficient retrieval when creating branchpoint nodes.
    foreach (Curve medax in MedialAxisCurveList)
    {
      medax2Node[medax] = new List<Node>();
    }
    foreach (KeyValuePair<Curve, List<SwitchPoint>> keyVal in medax2SwitchPoint)
    {
      Curve medax = keyVal.Key;
      List<SwitchPoint> switchPoints = keyVal.Value;
      if (switchPoints[0].prevType != 2)
      {
        throw new Exception("First ligature type was not 2: " + switchPoints[0].prevType);
      }
      if (switchPoints[switchPoints.Count - 1].nextType != 2)
      {
        throw new Exception("Last ligature type was not 2: " + switchPoints[switchPoints.Count - 1].nextType);
      }
      if (switchPoints.Count == 2)
      {
        if (switchPoints[0].nextType == 2 && switchPoints[1].prevType == 2)
        {
          continue;
        }
      }

      // Generating all nodes corresponding to this medial axis segment on the fly. Ensuring adjacency between consecutive nodes afterwards.
      List<Node> nodes = new List<Node>();
      List<SwitchPoint> switchPointsToRemove = new List<SwitchPoint>();
      for (int i = 0; i < switchPoints.Count - 1; i++)
      {
        SwitchPoint currSwitchPoint = switchPoints[i];
        SwitchPoint nextSwitchPoint = switchPoints[i + 1];
        Point3d currSwitchLoc = medax.PointAt(currSwitchPoint.param);
        Point3d nextSwitchLoc = medax.PointAt(nextSwitchPoint.param);
        Chord c0 = GetChordParallel(currSwitchLoc, BoundaryCurveList);
        Chord c1 = GetChordParallel(nextSwitchLoc, BoundaryCurveList);
        Curve currTrim = medax.Trim(switchPoints[i].param, nextSwitchPoint.param);

        // There tend to be instabilities in proximity of branchpoints. Often this results in spurious, small segments being classified as semi,
        // however these segments are delimited by faulty corners. When these surfaces of these segments are generated, they cover the surface
        // that would normally be covered by a full-ligature.
        if (currTrim != null)
        {
          if (currTrim.GetLength() < 1.0 && currSwitchPoint.nextType == 1 && ContainsPointParallel(currTrim.PointAtStart, BranchPointList, 1.5))
          {
            switchPointsToRemove.Add(nextSwitchPoint);
            continue;
          }
        }
        if (currSwitchPoint.nextType != nextSwitchPoint.prevType)
        {
          throw new Exception("The type of consecutive switchpoints did not match.");
        }
        Brep currBrep = CreateBrepFromChords(c0, c1);
        int currType = currSwitchPoint.nextType;
        elementaryBreps.Add(currBrep);
        elementaryBrepTypes.Add(currType);

        // Adding the node.
        nodes.Add(new Node(currBrep, currType, ComputePolyCenter(currBrep), new List<Point3d>() { currSwitchLoc, nextSwitchLoc } ));
      }

      // Remove invalid switchpoints.
      foreach (SwitchPoint switchPointToRemove in switchPointsToRemove)
      {
        int idx = switchPointsToRemove.IndexOf(switchPointToRemove);
        Print("Removing: " + idx);
        // Change previous and next-types of adjacent switchpoints.
        // Note that an invalid switchpoint can neither be the last or first switchpoint, as the first and last one are always type 2 nodes.
        Print(switchPoints[idx].prevType + ", " + switchPoints[idx + 1].prevType);
        SwitchPoint switch0 = new SwitchPoint(switchPoints[idx + 1].param, switchPoints[idx].prevType, switchPoints[idx + 1].nextType);
        switchPoints[idx + 1] = switch0;
        switchPoints.Remove(switchPointToRemove);
      }

      // Adding newly created nodes to graph and establishing adjacency between consecutive nodes.
      for (int i = 0; i < nodes.Count; i++)
      {
        Node node = nodes[i];
        graph[node] = new List<Node>();

        // A node is adjacent to the node corresponding to the last segment and the next segment.
        if (i > 0)
        {
          graph[node].Add(nodes[i - 1]);
        }
        if (i < nodes.Count - 1)
        {
          graph[node].Add(nodes[i + 1]);
        }
      }
      // Only the first or last node can be adjacent to a branchpoint.
      medax2Node[medax] = new List<Node>() { nodes[0], nodes[nodes.Count - 1] };
    }

    // Add the surfaces that correspond to branchpoints.
    foreach (Point3d branchPoint in BranchPointList)
    {
      List<Curve> adjMedaxs = new List<Curve>();
      List<double> adjParams = new List<double>();
      foreach (KeyValuePair<Curve, List<Node>> keyVal in medax2Node)
      {
        double closestParam;
        Curve medax = keyVal.Key;
        medax.ClosestPoint(branchPoint, out closestParam);
        if (branchPoint.DistanceTo(medax.PointAt(closestParam)) < 0.05)
        {
          adjMedaxs.Add(medax);
          adjParams.Add(closestParam);
        }
      }

      // Generate the chord (on the correct side of the medial axis segment) for each medial axis segment that ends in this branchpoint.
      List<Chord> adjChords = new List<Chord>();
      List<Node> adjNodes = new List<Node>();
      for (int i = 0; i < adjMedaxs.Count; i++)
      {
        if (Math.Abs(adjMedaxs[i].Domain.Min - adjParams[i]) < Math.Abs(adjMedaxs[i].Domain.Max - adjParams[i]))
        {
          adjChords.Add(GetChordParallel(adjMedaxs[i].PointAt(medax2SwitchPoint[adjMedaxs[i]].First().param), BoundaryCurveList));
          if (medax2Node[adjMedaxs[i]].Count > 0)
          {
            adjNodes.Add(medax2Node[adjMedaxs[i]][0]);
          }
        }
        else
        {
          adjChords.Add(GetChordParallel(adjMedaxs[i].PointAt(medax2SwitchPoint[adjMedaxs[i]].Last().param), BoundaryCurveList));
          if (medax2Node[adjMedaxs[i]].Count > 0)
          {
            adjNodes.Add(medax2Node[adjMedaxs[i]][1]);
          }
        }
      }

      // Get the endpoints of all chords, as they delimit the newly created face.
      List<Point3d> chordEnds = new List<Point3d>();
      foreach (Chord chord in adjChords)
      {
        chordEnds.Add(chord.line.PointAtStart);
        chordEnds.Add(chord.line.PointAtEnd);
      }

      // Make the corners unique, such that we do not have double corners.
      List<Point3d> uniqueChordEnds = new List<Point3d>();
      foreach (Point3d chordEnd in chordEnds)
      {
        bool tooClose = false;
        foreach (Point3d added in uniqueChordEnds)
        {
          if (added.DistanceTo(chordEnd) < 0.1)
          {
            tooClose = true;
            break;
          }
        }
        if (!tooClose)
        {
          uniqueChordEnds.Add(chordEnd);
        }
      }

      // Determine convex hull in order to get points in correct order to generate boundary.
      List<Point3d> hull = ConvexHull(uniqueChordEnds);
      PointComparer pCompare = new PointComparer
      {
        center = hull[0]
      };
      hull.Sort(pCompare);

      // Generate the boundary edges.
      List<LineCurve> edges = new List<LineCurve>();
      for (int i = 0; i < hull.Count; i++)
      {
        edges.Add(new LineCurve(hull[i], hull[(i + 1) % hull.Count]));
      }
      if (edges.Count == 2)
      {
        Print("Only two edges.");
        continue;
      }

      Brep[] currBreps = Brep.CreatePlanarBreps(edges, 0.1);
      if (currBreps == null)
      {
        Print("was null");
        continue;
      }
      if (currBreps.Length != 1)
      {
        After = currBreps;
        Print("Too little or too many surfaces generated " + currBreps.Length);
        // throw new Exception("Too little or too many surfaces generated " + currBreps.Length);
      }
      Brep currBrep = currBreps[0];
      elementaryBreps.Add(currBrep);
      elementaryBrepTypes.Add(2);
      Node newNode = new Node(currBrep, 2, ComputePolyCenter(currBrep), new List<Point3d>() { branchPoint, branchPoint });
      graph[newNode] = adjNodes;
      foreach (Node adjNode in adjNodes)
      {
        graph[adjNode].Add(newNode);
      }
    }

    // Connect type 2 breps which share a medial axis segment.
    List<Curve> afterJoin = new List<Curve>();
    foreach (Curve medax in MedialAxisCurveList)
    {
      List<SwitchPoint> switchPoints = medax2SwitchPoint[medax];
      if (switchPoints.Count != 2)
      {
        continue;
      }
      if (!(switchPoints[0].nextType == 2 && switchPoints[1].prevType == 2))
      {
        // We are only interested in purely type 2 segments.
        continue;
      }

      // Getting the branchpoints.
      Point3d startBp = medax.PointAtStart;
      Point3d endBp = medax.PointAtEnd;

      // Search the nodes corresponding to these two branchpoints.
      // TODO: Restrict search to graph only consisting on type 2 nodes (search on subgraph).
      List<Node> toConnect = new List<Node>();
      foreach (KeyValuePair<Node, List<Node>> keyVal in graph)
      {
        Node currNode = keyVal.Key;
        List<Node> neighbors = keyVal.Value;
        if (currNode.type != 2)
        {
          continue;
        }
        if (currNode.delimitingPoints[0].DistanceTo(startBp) < 0.1 || currNode.delimitingPoints[0].DistanceTo(endBp) < 0.1)
        {
          toConnect.Add(currNode);
        }
      }
      
      // Connect all nodes that are adjacent to this medial axis segment.
      for (int i = 0; i < toConnect.Count; i++)
      {
        Node node0 = toConnect[i];
        for (int j = 0; j < toConnect.Count; j++)
        {
          if (i == j)
          {
            continue;
          }
          Node node1 = toConnect[j];
          graph[node0].Add(node1);
        }
      }
    }
    ElementarySurfacesList = elementaryBreps;
    ElementarySurfaceTypeList = elementaryBrepTypes;
    List<Point3d> nodeLocs = new List<Point3d>();
    List<LineCurve> graphEdges = new List<LineCurve>();
    foreach (KeyValuePair<Node, List<Node>> keyVal in graph)
    {
      nodeLocs.Add(keyVal.Key.location);
      foreach (Node neighbor in keyVal.Value)
      {
        graphEdges.Add(new LineCurve(keyVal.Key.location, neighbor.location));
      }
    }
    NodeLocations = nodeLocs;
    Edges = graphEdges;

    // Check how many duplicate breps we have.
    List<bool> duplicate = new List<bool>();
    List<Brep> duplicateBreps = new List<Brep>();
    foreach (Brep elemBrep in elementaryBreps)
    {
      duplicate.Add(false);
    }
    int n_dups = 0;
    for (int i = 0; i < elementaryBreps.Count; i++)
    {
      if (duplicate[i])
      {
        continue;
      }
      for (int j = i + 1; j < elementaryBreps.Count; j++)
      {
        if (duplicate[j])
        {
          continue;
        }
        Point3d c0 = ComputePolyCenter(elementaryBreps[i]);
        Point3d c1 = ComputePolyCenter(elementaryBreps[j]);
        if (c0.DistanceTo(c1) < 0.1)
        {
          duplicate[j] = true;
          duplicateBreps.Add(elementaryBreps[j]);
          n_dups++;
        }
      }
    }
    Print("Duplicate breps: "  + duplicateBreps.Count.ToString());

    // Remove duplicates. Since we have only identified duplicate breps, we also need to search which nodes these duplicate breps correspond to.
    List<Node> toDelete = new List<Node>();  // We can not remove while iterating over the graph, that is why I save the nodes here and delete them later.
    for (int i = 0; i < duplicate.Count; i++)
    {
      if (!duplicate[i])
      {
        continue;
      }
      foreach (KeyValuePair<Node, List<Node>> keyVal in graph)
      {
        if (ComputePolyCenter(keyVal.Key.brep).DistanceTo(ComputePolyCenter(elementaryBreps[i])) < 0.1)
        {
          if (toDelete.Contains(keyVal.Key))
          {
            Print("here");
            continue;
          }
          toDelete.Add(keyVal.Key);
          break;
        }
      }
    }

    Print(toDelete.Count.ToString());
    foreach (Node remove in toDelete)
    {
      if (graph.ContainsKey(remove))
      {

      }
      DeleteNode(graph, remove);
    }

    // Deconstruct graph.
    List<Brep> outBreps = new List<Brep>();
    List<int> outTypes = new List<int>();
    List<Point3d> outLocations = new List<Point3d>();
    DataTree<Point3d> outDelimitingPoints = new DataTree<Point3d>();
    Matrix adjacencyMatrix = new Matrix(graph.Count, graph.Count);
    DeconstructGraph(graph, ref outBreps, ref outTypes, ref outLocations, ref outDelimitingPoints, ref adjacencyMatrix);
    OutBreps = outBreps;
    OutTypes = outTypes;
    OutLocations = outLocations;
    OutDelimitingPoints = outDelimitingPoints;
    OutAdjacencyMatrix = adjacencyMatrix;
# ---------- createelementarysurfaces: C# additional code ----------
  private Dictionary<Curve, List<SwitchPoint>> ReassembleInput(List<Curve> medialAxisCurves, List<int> medialAxisCurveIdxs, List<double> parameters, List<int> previousTypes, List<int> nextTypes)
  {
    Dictionary<Curve, List<SwitchPoint>> res = new Dictionary<Curve, List<SwitchPoint>>();
    for (int i = 0; i < medialAxisCurveIdxs.Count; i++)
    {
      Curve medax = medialAxisCurves[medialAxisCurveIdxs[i]];
      if (!res.ContainsKey(medax))
      {
        res[medax] = new List<SwitchPoint>();
      }
      double param = parameters[i];
      int prevType = previousTypes[i];
      int nextType = nextTypes[i];
      res[medax].Add(new SwitchPoint(param, prevType, nextType));
    }
    return res;
  }

  public struct SwitchPoint
  {
    public SwitchPoint(double param, int prevType, int nextType)
    {
      this.param = param;
      this.prevType = prevType;
      this.nextType = nextType;
    }
    public double param;
    public int prevType;
    public int nextType;
  }

  public struct Chord
  {
    public Chord(Tuple<double, double> chordParams, Tuple<Curve, Curve> boundaryCurves, Tuple<Point3d, Point3d> chordPoints)
    {
      parameters = chordParams;
      curves = boundaryCurves;
      points = chordPoints;
      line = new LineCurve(chordPoints.Item1, chordPoints.Item2);
    }
    public Tuple<double, double> parameters;
    public Tuple<Curve, Curve> curves;
    public Tuple<Point3d, Point3d> points;
    public LineCurve line;
  }
  public struct PointOnCurve
  {
    public PointOnCurve(Curve curve, double param, Point3d point)
    {
      this.curve = curve;
      this.param = param;
      this.point = point;
    }
    public Curve curve;
    public double param;
    public Point3d point;
  }

  public struct Node
  {
    public Brep brep;
    public int type;
    public Point3d location;
    public List<Point3d> delimitingPoints; // Only used for type 2 nodes.
    public Node(Brep brep, int type, Point3d location, List<Point3d> delimitingPoints)
    {
      this.brep = brep;
      this.type = type;
      this.location = location;
      this.delimitingPoints = delimitingPoints;
    }
  }

  private bool ContainsPointParallel(Point3d queryPoint, List<Point3d> pointList, double tol)
  {
    bool[] isClose = new bool[pointList.Count];
    System.Threading.Tasks.Parallel.For(0, pointList.Count, i =>
    {
      isClose[i] = queryPoint.DistanceTo(pointList[i]) < tol;
    });
    for (int i = 0; i < isClose.Length; i++)
    {
      if (isClose[i])
      {
        return true;
      }
    }
    return false;
  }

  private Chord GetChordParallel(Point3d queryPoint, List<Curve> boundaryCurveList)
  {
    PointOnCurve[] closestPoints = new PointOnCurve[boundaryCurveList.Count];  // Holds closest point on each boundary-segment to point on medial axis.
    double[] distances = new double[boundaryCurveList.Count];  // Holds the distances to the closest points.

    // Determine closest points on boundary segments and distances to them.
    System.Threading.Tasks.Parallel.For(0, boundaryCurveList.Count, i =>
    {
      double closestParam = 0.0;
      boundaryCurveList[i].ClosestPoint(queryPoint, out closestParam);
      Point3d closestPoint = boundaryCurveList[i].PointAt(closestParam);
      distances[i] = queryPoint.DistanceTo(closestPoint);
      closestPoints[i] = new PointOnCurve(boundaryCurveList[i], closestParam, closestPoint);
    });

    Array.Sort(distances, closestPoints);
    Point3d c0 = closestPoints[0].point;
    int idx = 1;
    while (idx < closestPoints.Length && c0.DistanceTo(closestPoints[idx].point) < 1.0)
    {
      idx++;
    }
    double param0 = closestPoints[0].param;
    double param1 = closestPoints[idx].param;
    Curve curve0 = closestPoints[0].curve;
    Curve curve1 = closestPoints[idx].curve;
    Point3d point0 = closestPoints[0].point;
    Point3d point1 = closestPoints[idx].point;
    return new Chord(new Tuple<double, double>(param0, param1), new Tuple<Curve, Curve>(curve0, curve1), new Tuple<Point3d, Point3d>(point0, point1));
  }

  private Brep CreateBrepFromChords(Chord c0, Chord c1)
  {
    List<Curve> edges = new List<Curve> { c0.line, c1.line }; // Contains the edges of the surface to be generated.

    // Case: the resulting face is triangular, i.e. two of the endpoints of each chord are identical.
    if (c0.points.Item1.DistanceTo(c1.points.Item1) < RhinoMath.SqrtEpsilon)
    {
      edges.Add(new LineCurve(c0.points.Item2, c1.points.Item2));
    }
    else if (c0.points.Item1.DistanceTo(c1.points.Item2) < RhinoMath.SqrtEpsilon)
    {
      edges.Add(new LineCurve(c0.points.Item2, c1.points.Item1));
    }
    else if (c0.points.Item2.DistanceTo(c1.points.Item1) < RhinoMath.SqrtEpsilon)
    {
      edges.Add(new LineCurve(c0.points.Item1, c1.points.Item2));
    }
    else if (c0.points.Item2.DistanceTo(c1.points.Item2) < RhinoMath.SqrtEpsilon)
    {
      edges.Add(new LineCurve(c0.points.Item1, c1.points.Item1));
    }
    else
    {
      // None of the chord-endpoints are identical, so we are dealing with a rectangular surface.

      // Here we need to check that we connect the endpoints such that the connecting lines do not cross.
      Curve sameA = new LineCurve(c0.points.Item1, c1.points.Item1);
      Curve sameB = new LineCurve(c0.points.Item2, c1.points.Item2);

      // Check intersection.
      if (Intersection.CurveCurve(sameA, sameB, RhinoMath.SqrtEpsilon, RhinoMath.SqrtEpsilon).Count == 0)
      {
        edges.Add(sameA);
        edges.Add(sameB);
      }
      else
      {
        // Then we need to connect the other way around.
        Curve diffA = new LineCurve(c0.points.Item1, c1.points.Item2);
        Curve diffB = new LineCurve(c0.points.Item2, c1.points.Item1);

        // Should not happen, but just to be sure.
        if (Intersection.CurveCurve(diffA, diffB, RhinoMath.SqrtEpsilon, RhinoMath.SqrtEpsilon).Count > 0)
        {
          throw new Exception("Connecting lines between chords cross both ways");
        }

        edges.Add(diffA);
        edges.Add(diffB);
      }
    }
    return Brep.CreateEdgeSurface(edges);
  }

  private Point3d ComputePolyCenter(Brep brep)
  {
    List<Point3d> corners = new List<Point3d>();
    if (brep == null)
    {
      return Point3d.Origin;
    }
    foreach (BrepVertex brepVertex in brep.Vertices)
    {
      Point3d location = brepVertex.Location;

      // Need to check if point is already close to corners.
      bool tooClose = false;
      foreach (Point3d corner in corners)
      {
        if (location.DistanceTo(corner) < 2.0)
        {
          tooClose = true;
          break;
        }
      }
      if (!tooClose)
      {
        corners.Add(location);
      }
    }
    Point3d center = Point3d.Origin;
    foreach (Point3d corner in corners)
    {
      center += corner;
    }
    return center / corners.Count;
  }

  private void DeconstructGraph(
    Dictionary<Node, List<Node>> graph,
    ref List<Brep> breps,
    ref List<int> types,
    ref List<Point3d> locations,
    ref DataTree<Point3d> delimitingPoints,
    ref Matrix adjacencyMatrix)
  {
    List<Node> allNodes = new List<Node>();
    foreach (KeyValuePair<Node, List<Node>> keyValue in graph)
    {
      allNodes.Add(keyValue.Key);
    }
    int branchIdx = 0;
    foreach (KeyValuePair<Node, List<Node>> keyValue in graph)
    {
      Node currNode = keyValue.Key;
      List<Node> neighbors = keyValue.Value;

      // Transform into lists.
      breps.Add(currNode.brep);
      types.Add(currNode.type);
      locations.Add(currNode.location);
      delimitingPoints.AddRange(currNode.delimitingPoints, new GH_Path(new int[] { 0, branchIdx }));
      branchIdx++;

      int currIdx = allNodes.IndexOf(currNode);
      foreach (Node neighbor in neighbors)
      {
        int neighIdx = allNodes.IndexOf(neighbor);
        adjacencyMatrix[currIdx, neighIdx] = 1;
      }
    }
  }

  private List<Point3d> GetUniqueCorners(List<Brep> breps)
  {
    List<Point3d> corners = new List<Point3d>();
    foreach (Brep brep in breps)
    {
      foreach (BrepVertex bVert in brep.Vertices)
      {
        bool tooClose = false;
        foreach (Point3d added in corners)
        {
          if (added.DistanceTo(bVert.Location) < 0.1)
          {
            tooClose = true;
            break;
          }
        }
        if (!tooClose)
        {
          corners.Add(bVert.Location);
        }
      }
    }
    return corners;
  }

  class PointComparer : Comparer<Point3d>
  {
    public Point3d center;

    private int Orientation(Point3d p1, Point3d p2, Point3d p3)
    {
      double area = (p2.Y - p1.Y) * (p3.X - p2.X) - (p2.X - p1.X) * (p3.Y - p2.Y);

      if (area > 0.0)
      {
        return 1; // collinear
      }
      if (area < 0.0)
      {
        return -1;
      }
      return 0;
    }

    public override int Compare(Point3d x, Point3d y)
    {
      int orientation = Orientation(center, x, y);
      if (orientation == 0)
      {
        // Points are collinear.
        if (center.DistanceTo(y) >= center.DistanceTo(x))
        {
          return -1;  // Second element is greater than first one.
        }
        return 1;  // First element is greater than second one.
      }
      return orientation;
    }
  }

  // Diese Methode gibt das zweitoberste Element im Stack der Punkte zuruck
  private Point3d GetNextToTopElement(Stack<Point3d> points)
  {
    Point3d topElement = points.Peek();
    points.Pop();
    Point3d nextToTopElement = points.Peek();
    points.Push(topElement);
    return nextToTopElement;
  }

  List<Point3d> ConvexHull(List<Point3d> points)
  {
    List<Point3d> convexHull = new List<Point3d>();
    double minY = points[0].Y;
    int minIndex = 0;
    int nPoints = points.Count;

    // Determines the most left, and for ties most bottom, point in the input list.
    for (int i = 1; i < nPoints; i++)
    {
      double y = points[i].Y;
      if (y < minY || y == minY && points[i].X < points[minIndex].X)
      {
        minY = points[i].Y;
        minIndex = i;
      }
    }

    // Put minimum element at first position.
    Point3d temp = points[0];
    points[0] = points[minIndex];
    points[minIndex] = temp;

    // Initialise comparer.
    PointComparer pComparer = new PointComparer
    {
      center = points[0]  // Set to minimum element.
    };

    // Sort points.
    points.Sort(pComparer);

    // If there are at least two points with equal angle to minimum element, remove all except the one that is furthest away.
    int nPointsRed = 1;  // Number of points that are not collinear with the first point.
    for (int i = 1; i < nPoints; i++)
    {
      // Remove points as long as they are collinear.
      while (i < nPoints - 1 && Orientation(pComparer.center, points[i], points[i + 1]) == 0)
      {
        i++;
      }
      points[nPointsRed] = points[i];
      nPointsRed++;
    }

    // If there are less than three points, the hull is trivially convex.
    if (nPointsRed < 3)
    {
      return points;
    }

    // Create stack and add first three points.
    Stack<Point3d> pointStack = new Stack<Point3d>();
    pointStack.Push(points[0]);
    pointStack.Push(points[1]);
    pointStack.Push(points[2]);

    // Go through the remaining points.
    for (int i = 3; i < nPointsRed; i++)
    {
      while (pointStack.Count > 1 && Orientation(GetNextToTopElement(pointStack), pointStack.Peek(), points[i]) != -1)
      {
        pointStack.Pop();
      }
      pointStack.Push(points[i]);
    }

    // Add points from stack to convex hull.
    while (pointStack.Count != 0)
    {
      convexHull.Add(pointStack.Peek());
      pointStack.Pop();
    }

    return convexHull;
  }

  private int Orientation(Point3d p1, Point3d p2, Point3d p3)
  {
    double area = (p2.Y - p1.Y) * (p3.X - p2.X) - (p2.X - p1.X) * (p3.Y - p2.Y);

    if (area > 0.0)
    {
      return 1; // collinear
    }
    if (area < 0.0)
    {
      return -1;
    }
    return 0;
  }

  // Returns old neighborhood if successful.
  private void DeleteNode(Dictionary<Node, List<Node>> graph, Node toDelete)
  {
    List<Node> neighbors;
    if (!graph.TryGetValue(toDelete, out neighbors))
    {
      throw new Exception("The node to be deleted was not present in the graph.");
    }

    // Delete the node.
    graph.Remove(toDelete);

    // Remove node from neighbor's adjacency list.
    foreach (Node neighbor in neighbors)
    {
      graph[neighbor].Remove(toDelete);
    }
  }
# ---------- end createelementarysurfaces ----------
scriptpar_11 = ScriptParasite(Enable=synchronization_enabled, Folder=script_directory)

brep = Brep(createelementarysurfaces.After)
pt_2 = Point(createelementarysurfaces.Before)
panel_12 = Panel(createelementarysurfaces.out)

mergeredyellow = CSharpScript(
    InBreps=createelementarysurfaces.OutBreps,
    InTypes=createelementarysurfaces.OutTypes,
    InLocations=createelementarysurfaces.OutLocations,
    InDelimitingPoints=createelementarysurfaces.OutDelimitingPoints,
    InAdjacencyMatrix=createelementarysurfaces.OutAdjacencyMatrix,
    BranchPointList=duppt_4)  # -> out, NodeLocations, Edges, OutBreps, OutTypes, OutLocations, OutDelimitingPoints, OutAdjacencyMatrix; inputs InBreps: list of Brep, InTypes: list of Int32, InLocations: list of Point3d, InDelimitingPoints: tree of Point3d, BranchPointList: list of Point3d
# ---------- mergeredyellow: C# ----------
    Dictionary<Node, List<Node>> graph = ReassembleGraph(InBreps, InTypes, InLocations, InDelimitingPoints, (Matrix)InAdjacencyMatrix);

    // Join all bipartite subgraphs which only consist of type 0 and type 2 nodes and the type 2 nodes are not concurrent, i.e. have at most 2 type 2 neighbors (ignoring type 1 neighbors).
    Dictionary<Node, bool> visited = new Dictionary<Node, bool>(); // Indicated whether a node was already visited.
    Dictionary<Node, List<Node>> graphCopy = new Dictionary<Node, List<Node>>(graph);
    foreach (KeyValuePair<Node, List<Node>> keyVal in graph)
    {
      Node currNode = keyVal.Key;
      if (currNode.type != 2)
      {
        continue;
      }
      if (!ContainsPointParallel(currNode.delimitingPoints[0], BranchPointList, 1.0))
      {
        continue;
      }
      List<Node> neighbors = keyVal.Value;
      List<Node> toContract = new List<Node>() { currNode };
      if (currNode.brep == null)
      {
        continue;
      }
      foreach (Node neighbor in neighbors)
      {
        if (neighbor.type != 1)
        {
          continue;
        }
        if (neighbor.delimitingPoints[0].DistanceTo(currNode.delimitingPoints[0]) > 2.0 && neighbor.delimitingPoints[1].DistanceTo(currNode.delimitingPoints[0]) > 2.0)
        {
          continue;
        }
        toContract.Add(neighbor);
      }
      if (toContract.Count <= 1)
      {
        continue;
      }
      ContractNodes(graphCopy, toContract, 2);
    }
    Tuple<List<Point3d>, List<LineCurve>> locsAndEdges = GetPointsAndEdges(graphCopy);
    NodeLocations = locsAndEdges.Item1;
    Edges = locsAndEdges.Item2;

    List<Brep> outBreps = new List<Brep>();
    List<int> outTypes = new List<int>();
    List<Point3d> outLocations = new List<Point3d>();
    DataTree<Point3d> outDelimitingPoints = new DataTree<Point3d>();
    Print(graphCopy.Count.ToString());
    Matrix adjacencyMatrix = new Matrix(graphCopy.Count, graphCopy.Count);
    DeconstructGraph(graphCopy, ref outBreps, ref outTypes, ref outLocations, ref outDelimitingPoints, ref adjacencyMatrix);
    OutBreps = outBreps;
    OutTypes = outTypes;
    OutLocations = outLocations;
    OutDelimitingPoints = outDelimitingPoints;
    OutAdjacencyMatrix = adjacencyMatrix;
# ---------- mergeredyellow: C# additional code ----------
  public struct Node
  {
    public Brep brep;
    public int type;
    public Point3d location;
    public List<Point3d> delimitingPoints; // Only used for type 2 nodes.
    public Node(Brep brep, int type, Point3d location, List<Point3d> delimitingPoints)
    {
      this.brep = brep;
      this.type = type;
      this.location = location;
      this.delimitingPoints = delimitingPoints;
    }
  }

  private Dictionary<Node, List<Node>> ReassembleGraph(
    List<Brep> breps, 
    List<int> types, 
    List<Point3d> locations, 
    DataTree<Point3d> delimitingPoints, 
    Matrix adjacencyMatrix)
  {

    // Create all nodes.
    List<Node> nodes = new List<Node>();
    Dictionary<Node, List<Node>> graph = new Dictionary<Node, List<Node>>();
    for (int i = 0; i < breps.Count; i++)
    {
      Node currNode = new Node(breps[i], types[i], locations[i], delimitingPoints.Branch(i));
      graph[currNode] = new List<Node>();
      nodes.Add(currNode);
    }

    // Add neighbors.
    for (int i = 0; i < breps.Count; i++)
    {
      for (int j = 0; j < breps.Count; j++)
      {
        if (adjacencyMatrix[i, j] == 1)
        {
          graph[nodes[i]].Add(nodes[j]);
        }
      }
    }
    return graph;
  }

  private bool ContainsPointParallel(Point3d queryPoint, List<Point3d> pointList, double tol)
  {
    bool[] isClose = new bool[pointList.Count];
    System.Threading.Tasks.Parallel.For(0, pointList.Count, i =>
    {
      isClose[i] = queryPoint.DistanceTo(pointList[i]) < tol;
    });
    for (int i = 0; i < isClose.Length; i++)
    {
      if (isClose[i])
      {
        return true;
      }
    }
    return false;
  }

  private Point3d ComputePolyCenter(List<Brep> breps)
  {
    List<Point3d> corners = new List<Point3d>();
    foreach (Brep brep in breps)
    {
      if (brep == null)
      {
        return Point3d.Origin;
      }
      foreach (BrepVertex brepVertex in brep.Vertices)
      {
        Point3d location = brepVertex.Location;

        // Need to check if point is already close to corners.
        bool tooClose = false;
        foreach (Point3d corner in corners)
        {
          if (location.DistanceTo(corner) < 2.0)
          {
            tooClose = true;
            break;
          }
        }
        if (!tooClose)
        {
          corners.Add(location);
        }
      }
    }
    Point3d center = Point3d.Origin;
    foreach (Point3d corner in corners)
    {
      center += corner;
    }
    return center / corners.Count;
  }

  private Point3d[] SortPointsWithAngle(Point3d center, List<Point3d> points)
  {
    // Compute connecting vectors.
    List<Vector3d> connectors = new List<Vector3d>();
    foreach (Point3d point in points)
    {
      connectors.Add(point - center);
    }

    // Compute angles.
    List<double> angles = new List<double>();
    foreach (Vector3d connector in connectors)
    {
      angles.Add(AngleToXY(connector));
    }

    // Sort points according to angle.
    Point3d[] res = points.ToArray();
    Array.Sort(angles.ToArray(), res);
    return res;
  }

  private double AngleToXY(Vector3d vec)
  {
    Vector3d xAxis = Vector3d.XAxis;
    if (vec.Y >= 0)
    {
      return RhinoMath.ToDegrees(Vector3d.VectorAngle(vec, xAxis));
    }
    else
    {
      return 360.0 - RhinoMath.ToDegrees(Vector3d.VectorAngle(vec, xAxis));
    }
  }

  private void ContractNodes(Dictionary<Node, List<Node>> graph, List<Node> toContract, int newType)
  {
    // Find neighborhood of nodes to be contracted (without the nodes themselves).
    // TODO: Make more efficient by tracking the neighbors that were already added (instead of invoking Contains every time.)
    List<Node> neighbors = new List<Node>();
    foreach (Node contract in toContract)
    {
      foreach (Node neighbor in graph[contract])
      {
        if (!toContract.Contains(neighbor) && !neighbors.Contains(neighbor))
        {
          neighbors.Add(neighbor);
        }
      }
    }

    // Delete each node which was to be contracted.
    foreach (Node contract in toContract)
    {
      DeleteNode(graph, contract);
    }

    // Construct new node from nodes that were contracted.
    Brep newBrep = MergeBreps(toContract); // New brep.

    // Breaking the convention that there can only be two delimiting points now.
    List<Point3d> newDelimPoints = new List<Point3d>();
    foreach (Node contract in toContract)
    {
      foreach (Point3d delimPoint in contract.delimitingPoints)
      {
        bool tooClose = false;
        foreach (Point3d added in newDelimPoints)
        {
          if (added.DistanceTo(delimPoint) <= 1.0)
          {
            tooClose = true;
            break;
          }
        }
        if (!tooClose)
        {
          newDelimPoints.Add(delimPoint);
        }
      }
    }
    Node newNode = new Node(newBrep, newType, ComputePolyCenter(new List<Brep> { newBrep }), newDelimPoints);

    // Add node to the graph.
    graph[newNode] = neighbors;

    // Add node to all neighbors.
    foreach (Node neighbor in neighbors)
    {
      graph[neighbor].Add(newNode);
    }
  }

  // Returns old neighborhood if successful.
  private void DeleteNode(Dictionary<Node, List<Node>> graph, Node toDelete)
  {
    List<Node> neighbors;
    if (!graph.TryGetValue(toDelete, out neighbors))
    {
      throw new Exception("The node to be deleted was not present in the graph.");
    }

    // Delete the node.
    graph.Remove(toDelete);

    // Remove node from neighbor's adjacency list.
    foreach (Node neighbor in neighbors)
    {
      graph[neighbor].Remove(toDelete);
    }
  }

  private Brep MergeBreps(List<Node> nodes)
  {
    List<Brep> brepsToBeMerged = new List<Brep>();
    foreach (Node contract in nodes)
    {
      brepsToBeMerged.Add(contract.brep);
    }
    Point3d center = ComputePolyCenter(brepsToBeMerged);
    List<Point3d> corners = new List<Point3d>();
    foreach (Brep brep in brepsToBeMerged)
    {
      foreach (BrepVertex bVert in brep.Vertices)
      {
        bool tooClose = false;
        foreach (Point3d added in corners)
        {
          if (added.DistanceTo(bVert.Location) < 0.1)
          {
            tooClose = true;
            break;
          }
        }
        if (!tooClose)
        {
          corners.Add(bVert.Location);
        }
      }
    }
    Point3d[] sortedCorners = SortPointsWithAngle(center, corners);

    // Check if any of the corners lies on the straight line segment connecting the previous and next corner.
    // If so, this corner is redundant.
    bool[] redundant = new bool[sortedCorners.Length];

    // Starting from 1 to avoid needing to deal with negative remainders.
    for (int i = 1; i < sortedCorners.Length + 1; i++)
    {
      LineCurve connector = new LineCurve(sortedCorners[i - 1], sortedCorners[(i + 1) % sortedCorners.Length]);

      // Find closest point.
      double closestParam;
      connector.ClosestPoint(sortedCorners[i % sortedCorners.Length], out closestParam);
      Point3d closestPoint = connector.PointAt(closestParam);
      if (closestPoint.DistanceTo(sortedCorners[i % sortedCorners.Length]) < 0.1)
      {
        redundant[i % sortedCorners.Length] = true;
      }
    }

    List<Point3d> nonRedundantCorners = new List<Point3d>();
    for (int i = 0; i < sortedCorners.Length; i++)
    {
      if (!redundant[i])
      {
        nonRedundantCorners.Add(sortedCorners[i]);
      }
    }
    List<LineCurve> newBrepEdges = new List<LineCurve>();
    for (int i = 0; i < nonRedundantCorners.Count; i++)
    {
      newBrepEdges.Add(new LineCurve(nonRedundantCorners[i], nonRedundantCorners[(i + 1) % nonRedundantCorners.Count]));
    }
    Brep[] res = Brep.CreatePlanarBreps(newBrepEdges, RhinoMath.SqrtEpsilon);
    if (res == null)
    {
      string msg = "";
      for (int i = 0; i < redundant.Length; i++)
      {
        msg += redundant[i].ToString() + ", ";
      }
      throw new Exception(msg);
    }
    if (res.Length != 1)
    {
      throw new Exception("Too few or too many breps resulted from merging: " + res.Length);
    }
    return res[0];
  }

  private Tuple<List<Point3d>, List<LineCurve>> GetPointsAndEdges(Dictionary<Node, List<Node>> graph)
  {
    List<Point3d> nodeLocs = new List<Point3d>();
    List<LineCurve> edges = new List<LineCurve>();
    foreach (KeyValuePair<Node, List<Node>> keyVal in graph)
    {
      Node node = keyVal.Key;
      List<Node> neighbors = keyVal.Value;
      nodeLocs.Add(node.location);
      foreach (Node neighbor in neighbors)
      {
        edges.Add(new LineCurve(node.location, neighbor.location));
      }
    }
    return new Tuple<List<Point3d>, List<LineCurve>>(nodeLocs, edges);
  }

  private void DeconstructGraph(
    Dictionary<Node, List<Node>> graph,
    ref List<Brep> breps,
    ref List<int> types,
    ref List<Point3d> locations,
    ref DataTree<Point3d> delimitingPoints,
    ref Matrix adjacencyMatrix)
  {
    List<Node> allNodes = new List<Node>();
    foreach (KeyValuePair<Node, List<Node>> keyValue in graph)
    {
      allNodes.Add(keyValue.Key);
    }
    int branchIdx = 0;
    foreach (KeyValuePair<Node, List<Node>> keyValue in graph)
    {
      Node currNode = keyValue.Key;
      List<Node> neighbors = keyValue.Value;

      // Transform into lists.
      breps.Add(currNode.brep);
      types.Add(currNode.type);
      locations.Add(currNode.location);
      delimitingPoints.AddRange(currNode.delimitingPoints, new GH_Path(new int[] { 0, branchIdx }));
      branchIdx++;

      int currIdx = allNodes.IndexOf(currNode);
      foreach (Node neighbor in neighbors)
      {
        int neighIdx = allNodes.IndexOf(neighbor);
        adjacencyMatrix[currIdx, neighIdx] = 1;
      }
    }
  }
# ---------- end mergeredyellow ----------
scriptpar_12 = ScriptParasite(Enable=synchronization_enabled, Folder=script_directory)

mergecorners = CSharpScript(
    InBreps=mergeredyellow.OutBreps,
    InTypes=mergeredyellow.OutTypes,
    InLocations=mergeredyellow.OutLocations,
    InDelimitingPoints=mergeredyellow.OutDelimitingPoints,
    InAdjacencyMatrix=mergeredyellow.OutAdjacencyMatrix,
    BranchPointList=duppt_4)  # -> out, NodeLocations, Edges, OutBreps, OutTypes, OutLocations, OutDelimitingPoints, OutAdjacencyMatrix; inputs InBreps: list of Brep, InTypes: list of Int32, InLocations: list of Point3d, InDelimitingPoints: tree of Point3d, BranchPointList: list of Point3d
# ---------- mergecorners: C# ----------
    // Reassemble input into graph.
    Dictionary<Node, List<Node>> graph = ReassembleGraph(InBreps, InTypes, InLocations, InDelimitingPoints, (Matrix)InAdjacencyMatrix);
    Dictionary<Node, List<Node>> graphCopy = new Dictionary<Node, List<Node>>(graph);

    // Find type 2 nodes with type 0 neighbors which have only 1 neighbor (the type 2 node). Contract them.
    foreach (KeyValuePair<Node, List<Node>> keyVal in graph)
    {
      Node currNode = keyVal.Key;
      if (currNode.type != 2)
      {
        continue;
      }
      if (currNode.brep == null)
      {
        continue;
      }
      List<Node> neighbors = keyVal.Value;
      List<Node> toContract = new List<Node>() { currNode };
      foreach (Node neighbor in neighbors)
      {
        if (neighbor.type == 0)
        {
          for (int i = 0; i < graph[neighbor].Count; i++)
          {
            for (int j = i + 1; j < graph[neighbor].Count; j++)
            {
              if (ComputePolyCenter(new List<Brep>() { graph[neighbor][i].brep }).DistanceTo(ComputePolyCenter(new List<Brep>() { graph[neighbor][j].brep })) < 0.1)
              {
                throw new Exception("Great, we have node aliasing");
              }
            }
          }
        }
        if (neighbor.type == 0 && graph[neighbor].Count == 1)
        {
          toContract.Add(neighbor);
        }
      }
      if (toContract.Count <= 1)
      {
        continue;
      }

      ContractNodes(graphCopy, toContract, 2);
    }

    // Deconstruct graph.
    List<Brep> outBreps = new List<Brep>();
    List<int> outTypes = new List<int>();
    List<Point3d> outLocations = new List<Point3d>();
    DataTree<Point3d> outDelimitingPoints = new DataTree<Point3d>();
    Matrix adjacencyMatrix = new Matrix(graphCopy.Count, graphCopy.Count);
    DeconstructGraph(graphCopy, ref outBreps, ref outTypes, ref outLocations, ref outDelimitingPoints, ref adjacencyMatrix);
    OutBreps = outBreps;
    OutTypes = outTypes;
    OutLocations = outLocations;
    OutDelimitingPoints = outDelimitingPoints;
    OutAdjacencyMatrix = adjacencyMatrix;
    Tuple<List<Point3d>, List<LineCurve>> nodeLocsAndEdges = GetPointsAndEdges(graphCopy);
    NodeLocations = nodeLocsAndEdges.Item1;
    Edges = nodeLocsAndEdges.Item2;
# ---------- mergecorners: C# additional code ----------
  public struct Node
  {
    public Brep brep;
    public int type;
    public Point3d location;
    public List<Point3d> delimitingPoints; // Only used for type 2 nodes.
    public Node(Brep brep, int type, Point3d location, List<Point3d> delimitingPoints)
    {
      this.brep = brep;
      this.type = type;
      this.location = location;
      this.delimitingPoints = delimitingPoints;
    }
  }

  private Dictionary<Node, List<Node>> ReassembleGraph(
    List<Brep> breps, 
    List<int> types, 
    List<Point3d> locations, 
    DataTree<Point3d> delimitingPoints, 
    Matrix adjacencyMatrix)
  {

    // Create all nodes.
    List<Node> nodes = new List<Node>();
    Dictionary<Node, List<Node>> graph = new Dictionary<Node, List<Node>>();
    for (int i = 0; i < breps.Count; i++)
    {
      Node currNode = new Node(breps[i], types[i], locations[i], delimitingPoints.Branch(i));
      graph[currNode] = new List<Node>();
      nodes.Add(currNode);
    }

    // Add neighbors.
    for (int i = 0; i < breps.Count; i++)
    {
      for (int j = 0; j < breps.Count; j++)
      {
        if (adjacencyMatrix[i, j] == 1)
        {
          graph[nodes[i]].Add(nodes[j]);
        }
      }
    }
    return graph;
  }

  private bool ContainsPointParallel(Point3d queryPoint, List<Point3d> pointList, double tol)
  {
    bool[] isClose = new bool[pointList.Count];
    System.Threading.Tasks.Parallel.For(0, pointList.Count, i =>
    {
      isClose[i] = queryPoint.DistanceTo(pointList[i]) < tol;
    });
    for (int i = 0; i < isClose.Length; i++)
    {
      if (isClose[i])
      {
        return true;
      }
    }
    return false;
  }

  private Point3d ComputePolyCenter(List<Brep> breps)
  {
    List<Point3d> corners = new List<Point3d>();
    foreach (Brep brep in breps)
    {
      if (brep == null)
      {
        return Point3d.Origin;
      }
      foreach (BrepVertex brepVertex in brep.Vertices)
      {
        Point3d location = brepVertex.Location;

        // Need to check if point is already close to corners.
        bool tooClose = false;
        foreach (Point3d corner in corners)
        {
          if (location.DistanceTo(corner) < 2.0)
          {
            tooClose = true;
            break;
          }
        }
        if (!tooClose)
        {
          corners.Add(location);
        }
      }
    }
    Point3d center = Point3d.Origin;
    foreach (Point3d corner in corners)
    {
      center += corner;
    }
    return center / corners.Count;
  }

  private Point3d[] SortPointsWithAngle(Point3d center, List<Point3d> points)
  {
    // Compute connecting vectors.
    List<Vector3d> connectors = new List<Vector3d>();
    foreach (Point3d point in points)
    {
      connectors.Add(point - center);
    }

    // Compute angles.
    List<double> angles = new List<double>();
    foreach (Vector3d connector in connectors)
    {
      angles.Add(AngleToXY(connector));
    }

    // Sort points according to angle.
    Point3d[] res = points.ToArray();
    Array.Sort(angles.ToArray(), res);
    return res;
  }

  private double AngleToXY(Vector3d vec)
  {
    Vector3d xAxis = Vector3d.XAxis;
    if (vec.Y >= 0)
    {
      return RhinoMath.ToDegrees(Vector3d.VectorAngle(vec, xAxis));
    }
    else
    {
      return 360.0 - RhinoMath.ToDegrees(Vector3d.VectorAngle(vec, xAxis));
    }
  }

  private void ContractNodes(Dictionary<Node, List<Node>> graph, List<Node> toContract, int newType)
  {
    // Find neighborhood of nodes to be contracted (without the nodes themselves).
    // TODO: Make more efficient by tracking the neighbors that were already added (instead of invoking Contains every time.)
    List<Node> neighbors = new List<Node>();
    foreach (Node contract in toContract)
    {
      foreach (Node neighbor in graph[contract])
      {
        if (!toContract.Contains(neighbor) && !neighbors.Contains(neighbor))
        {
          neighbors.Add(neighbor);
        }
      }
    }

    // Delete each node which was to be contracted.
    foreach (Node contract in toContract)
    {
      DeleteNode(graph, contract);
    }

    // Construct new node from nodes that were contracted.
    Brep newBrep = MergeBreps(toContract); // New brep.

    // Breaking the convention that there can only be two delimiting points now.
    List<Point3d> newDelimPoints = new List<Point3d>();
    foreach (Node contract in toContract)
    {
      foreach (Point3d delimPoint in contract.delimitingPoints)
      {
        bool tooClose = false;
        foreach (Point3d added in newDelimPoints)
        {
          if (added.DistanceTo(delimPoint) <= 1.0)
          {
            tooClose = true;
            break;
          }
        }
        if (!tooClose)
        {
          newDelimPoints.Add(delimPoint);
        }
      }
    }
    Node newNode = new Node(newBrep, newType, ComputePolyCenter(new List<Brep> { newBrep }), newDelimPoints);

    // Add node to the graph.
    graph[newNode] = neighbors;

    // Add node to all neighbors.
    foreach (Node neighbor in neighbors)
    {
      graph[neighbor].Add(newNode);
    }
  }

  // Returns old neighborhood if successful.
  private void DeleteNode(Dictionary<Node, List<Node>> graph, Node toDelete)
  {
    List<Node> neighbors;
    if (!graph.TryGetValue(toDelete, out neighbors))
    {
      throw new Exception("The node to be deleted was not present in the graph.");
    }

    // Delete the node.
    graph.Remove(toDelete);

    // Remove node from neighbor's adjacency list.
    foreach (Node neighbor in neighbors)
    {
      graph[neighbor].Remove(toDelete);
    }
  }

  private Brep MergeBreps(List<Node> nodes)
  {
    List<Brep> brepsToBeMerged = new List<Brep>();
    foreach (Node contract in nodes)
    {
      brepsToBeMerged.Add(contract.brep);
    }
    Point3d center = ComputePolyCenter(brepsToBeMerged);
    List<Point3d> corners = new List<Point3d>();
    foreach (Brep brep in brepsToBeMerged)
    {
      foreach (BrepVertex bVert in brep.Vertices)
      {
        bool tooClose = false;
        foreach (Point3d added in corners)
        {
          if (added.DistanceTo(bVert.Location) < 0.1)
          {
            tooClose = true;
            break;
          }
        }
        if (!tooClose)
        {
          corners.Add(bVert.Location);
        }
      }
    }
    Point3d[] sortedCorners = SortPointsWithAngle(center, corners);

    // Check if any of the corners lies on the straight line segment connecting the previous and next corner.
    // If so, this corner is redundant.
    bool[] redundant = new bool[sortedCorners.Length];

    // Starting from 1 to avoid needing to deal with negative remainders.
    for (int i = 1; i < sortedCorners.Length + 1; i++)
    {
      LineCurve connector = new LineCurve(sortedCorners[i - 1], sortedCorners[(i + 1) % sortedCorners.Length]);

      // Find closest point.
      double closestParam;
      connector.ClosestPoint(sortedCorners[i % sortedCorners.Length], out closestParam);
      Point3d closestPoint = connector.PointAt(closestParam);
      if (closestPoint.DistanceTo(sortedCorners[i % sortedCorners.Length]) < 0.1)
      {
        redundant[i % sortedCorners.Length] = true;
      }
    }

    List<Point3d> nonRedundantCorners = new List<Point3d>();
    for (int i = 0; i < sortedCorners.Length; i++)
    {
      if (!redundant[i])
      {
        nonRedundantCorners.Add(sortedCorners[i]);
      }
    }
    List<LineCurve> newBrepEdges = new List<LineCurve>();
    for (int i = 0; i < nonRedundantCorners.Count; i++)
    {
      newBrepEdges.Add(new LineCurve(nonRedundantCorners[i], nonRedundantCorners[(i + 1) % nonRedundantCorners.Count]));
    }
    Brep[] res = Brep.CreatePlanarBreps(newBrepEdges, RhinoMath.SqrtEpsilon);
    if (res == null)
    {
      string msg = "";
      for (int i = 0; i < redundant.Length; i++)
      {
        msg += redundant[i].ToString() + ", ";
      }
      throw new Exception("Merged surface was null");
    }
    /*
    if (res.Length != 1)
    {
      throw new Exception("Too few or too many breps resulted from merging: " + res.Length);
    }
    */
    return res[0];
  }

  private Tuple<List<Point3d>, List<LineCurve>> GetPointsAndEdges(Dictionary<Node, List<Node>> graph)
  {
    List<Point3d> nodeLocs = new List<Point3d>();
    List<LineCurve> edges = new List<LineCurve>();
    foreach (KeyValuePair<Node, List<Node>> keyVal in graph)
    {
      Node node = keyVal.Key;
      List<Node> neighbors = keyVal.Value;
      nodeLocs.Add(node.location);
      foreach (Node neighbor in neighbors)
      {
        edges.Add(new LineCurve(node.location, neighbor.location));
      }
    }
    return new Tuple<List<Point3d>, List<LineCurve>>(nodeLocs, edges);
  }

  private void DeconstructGraph(
    Dictionary<Node, List<Node>> graph,
    ref List<Brep> breps,
    ref List<int> types,
    ref List<Point3d> locations,
    ref DataTree<Point3d> delimitingPoints,
    ref Matrix adjacencyMatrix)
  {
    List<Node> allNodes = new List<Node>();
    foreach (KeyValuePair<Node, List<Node>> keyValue in graph)
    {
      allNodes.Add(keyValue.Key);
    }
    int branchIdx = 0;
    foreach (KeyValuePair<Node, List<Node>> keyValue in graph)
    {
      Node currNode = keyValue.Key;
      List<Node> neighbors = keyValue.Value;

      // Transform into lists.
      breps.Add(currNode.brep);
      types.Add(currNode.type);
      locations.Add(currNode.location);
      delimitingPoints.AddRange(currNode.delimitingPoints, new GH_Path(new int[] { 0, branchIdx }));
      branchIdx++;

      int currIdx = allNodes.IndexOf(currNode);
      foreach (Node neighbor in neighbors)
      {
        int neighIdx = allNodes.IndexOf(neighbor);
        adjacencyMatrix[currIdx, neighIdx] = 1;
      }
    }
  }
# ---------- end mergecorners ----------
scriptpar_13 = ScriptParasite(Enable=synchronization_enabled, Folder=script_directory)

mergeredblue = CSharpScript(
    InBreps=mergecorners.OutBreps,
    InTypes=mergecorners.OutTypes,
    InLocations=mergecorners.OutLocations,
    InDelimitingPoints=mergecorners.OutDelimitingPoints,
    InAdjacencyMatrix=mergecorners.OutAdjacencyMatrix,
    BranchPointList=duppt_4)  # -> out, NodeLocations, Edges, OutBreps, OutTypes, OutLocations, OutDelimitingPoints, OutAdjacencyMatrix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; inputs InBreps: list of Brep, InTypes: list of Int32, InLocations: list of Point3d, InDelimitingPoints: tree of Point3d, BranchPointList: list of Point3d
# ---------- mergeredblue: C# ----------
    // Reassemble input into graph.
    Dictionary<Node, List<Node>> graph = ReassembleGraph(InBreps, InTypes, InLocations, InDelimitingPoints, (Matrix)InAdjacencyMatrix);
    Dictionary<Node, List<Node>> graphCopy = new Dictionary<Node, List<Node>>(graph);
    Dictionary<Node, bool> globalVisited = new Dictionary<Node, bool>();
    
    foreach (KeyValuePair<Node, List<Node>> keyVal in graph)
    {
      globalVisited[keyVal.Key] = false;
    }
    List<Brep> toJoin = new List<Brep>();
    foreach (KeyValuePair<Node, List<Node>> keyVal in graph)
    {
      Node initNode = keyVal.Key;
      if (globalVisited[initNode])
      {
        continue;
      }

      // Start only from blue partitions.
      if (initNode.type != 0)
      {
        continue;
      }

      // Start BFS and find bipartite red-blue graph.
      Queue<Node> queue = new Queue<Node>();
      queue.Enqueue(initNode);
      List<Node> connectedComponent = new List<Node>();
      int cnt = 0;
      while (queue.Count != 0)
      {
        cnt++;
        if (cnt == 1000)
        {
          throw new Exception("probably stuck in a while loop");
        }
        Node currNode = queue.Dequeue();
        connectedComponent.Add(currNode);
        globalVisited[currNode] = true;
        int nextType = currNode.type == 0 ? 1 : 0;  // Bipartite condition.
        foreach (Node neighbor in graph[currNode])
        {
          if (!globalVisited[neighbor] && neighbor.type == nextType)
          {
            queue.Enqueue(neighbor);
          }
        }
      }
      if (connectedComponent.Count == 1)
      {
        // Only one node, nothing to join.
        continue;
      }

      // Check convexity.
      List<Brep> joinableBreps = new List<Brep>();
      foreach (Node connected in connectedComponent)
      {
        joinableBreps.Add(connected.brep);
      }
      if (!IsConvex(GetUniqueCorners(joinableBreps)))
      {
        continue;
      }

      // We can contract.
      ContractNodes(graphCopy, connectedComponent, 0);

    }
    ToJoin = toJoin;
    // Deconstruct graph.
    List<Brep> outBreps = new List<Brep>();
    List<int> outTypes = new List<int>();
    List<Point3d> outLocations = new List<Point3d>();
    DataTree<Point3d> outDelimitingPoints = new DataTree<Point3d>();
    Matrix adjacencyMatrix = new Matrix(graphCopy.Count, graphCopy.Count);
    DeconstructGraph(graphCopy, ref outBreps, ref outTypes, ref outLocations, ref outDelimitingPoints, ref adjacencyMatrix);
    OutBreps = outBreps;
    OutTypes = outTypes;
    OutLocations = outLocations;
    OutDelimitingPoints = outDelimitingPoints;
    OutAdjacencyMatrix = adjacencyMatrix;
    Tuple<List<Point3d>, List<LineCurve>> nodeLocsAndEdges = GetPointsAndEdges(graphCopy);
    NodeLocations = nodeLocsAndEdges.Item1;
    Edges = nodeLocsAndEdges.Item2;
# ---------- mergeredblue: C# additional code ----------
  public struct Node
  {
    public Brep brep;
    public int type;
    public Point3d location;
    public List<Point3d> delimitingPoints; // Only used for type 2 nodes.
    public Node(Brep brep, int type, Point3d location, List<Point3d> delimitingPoints)
    {
      this.brep = brep;
      this.type = type;
      this.location = location;
      this.delimitingPoints = delimitingPoints;
    }
  }

  private Dictionary<Node, List<Node>> ReassembleGraph(
    List<Brep> breps, 
    List<int> types, 
    List<Point3d> locations, 
    DataTree<Point3d> delimitingPoints, 
    Matrix adjacencyMatrix)
  {

    // Create all nodes.
    List<Node> nodes = new List<Node>();
    Dictionary<Node, List<Node>> graph = new Dictionary<Node, List<Node>>();
    for (int i = 0; i < breps.Count; i++)
    {
      Node currNode = new Node(breps[i], types[i], locations[i], delimitingPoints.Branch(i));
      graph[currNode] = new List<Node>();
      nodes.Add(currNode);
    }

    // Add neighbors.
    for (int i = 0; i < breps.Count; i++)
    {
      for (int j = 0; j < breps.Count; j++)
      {
        if (adjacencyMatrix[i, j] == 1)
        {
          graph[nodes[i]].Add(nodes[j]);
        }
      }
    }
    return graph;
  }

  private bool ContainsPointParallel(Point3d queryPoint, List<Point3d> pointList, double tol)
  {
    bool[] isClose = new bool[pointList.Count];
    System.Threading.Tasks.Parallel.For(0, pointList.Count, i =>
    {
      isClose[i] = queryPoint.DistanceTo(pointList[i]) < tol;
    });
    for (int i = 0; i < isClose.Length; i++)
    {
      if (isClose[i])
      {
        return true;
      }
    }
    return false;
  }

  private Point3d ComputePolyCenter(List<Brep> breps)
  {
    List<Point3d> corners = new List<Point3d>();
    foreach (Brep brep in breps)
    {
      if (brep == null)
      {
        return Point3d.Origin;
      }
      foreach (BrepVertex brepVertex in brep.Vertices)
      {
        Point3d location = brepVertex.Location;

        // Need to check if point is already close to corners.
        bool tooClose = false;
        foreach (Point3d corner in corners)
        {
          if (location.DistanceTo(corner) < 2.0)
          {
            tooClose = true;
            break;
          }
        }
        if (!tooClose)
        {
          corners.Add(location);
        }
      }
    }
    Point3d center = Point3d.Origin;
    foreach (Point3d corner in corners)
    {
      center += corner;
    }
    return center / corners.Count;
  }

  private Point3d[] SortPointsWithAngle(Point3d center, List<Point3d> points)
  {
    // Compute connecting vectors.
    List<Vector3d> connectors = new List<Vector3d>();
    foreach (Point3d point in points)
    {
      connectors.Add(point - center);
    }

    // Compute angles.
    List<double> angles = new List<double>();
    foreach (Vector3d connector in connectors)
    {
      angles.Add(AngleToXY(connector));
    }

    // Sort points according to angle.
    Point3d[] res = points.ToArray();
    Array.Sort(angles.ToArray(), res);
    return res;
  }

  private double AngleToXY(Vector3d vec)
  {
    Vector3d xAxis = Vector3d.XAxis;
    if (vec.Y >= 0)
    {
      return RhinoMath.ToDegrees(Vector3d.VectorAngle(vec, xAxis));
    }
    else
    {
      return 360.0 - RhinoMath.ToDegrees(Vector3d.VectorAngle(vec, xAxis));
    }
  }

  private void ContractNodes(Dictionary<Node, List<Node>> graph, List<Node> toContract, int newType)
  {
    // Find neighborhood of nodes to be contracted (without the nodes themselves).
    // TODO: Make more efficient by tracking the neighbors that were already added (instead of invoking Contains every time.)
    List<Node> neighbors = new List<Node>();

    foreach (Node contract in toContract)
    {
      foreach (Node neighbor in graph[contract])
      {
        if (!toContract.Contains(neighbor) && !neighbors.Contains(neighbor))
        {
          neighbors.Add(neighbor);
        }
      }
    }

    // Delete each node which was to be contracted.
    foreach (Node contract in toContract)
    {
      DeleteNode(graph, contract);
    }

    // Construct new node from nodes that were contracted.
    Brep newBrep = MergeBreps(toContract); // New brep.

    // Breaking the convention that there can only be two delimiting points now.
    List<Point3d> newDelimPoints = new List<Point3d>();
    foreach (Node contract in toContract)
    {
      foreach (Point3d delimPoint in contract.delimitingPoints)
      {
        bool tooClose = false;
        foreach (Point3d added in newDelimPoints)
        {
          if (added.DistanceTo(delimPoint) <= 1.0)
          {
            tooClose = true;
            break;
          }
        }
        if (!tooClose)
        {
          newDelimPoints.Add(delimPoint);
        }
      }
    }
    Node newNode = new Node(newBrep, newType, ComputePolyCenter(new List<Brep> { newBrep }), newDelimPoints);

    // Add node to the graph.
    graph[newNode] = neighbors;

    // Add node to all neighbors.
    foreach (Node neighbor in neighbors)
    {
      graph[neighbor].Add(newNode);
    }
  }

  // Returns old neighborhood if successful.
  private void DeleteNode(Dictionary<Node, List<Node>> graph, Node toDelete)
  {
    List<Node> neighbors;
    if (!graph.TryGetValue(toDelete, out neighbors))
    {
      throw new Exception("The node to be deleted was not present in the graph.");
    }

    // Delete the node.
    graph.Remove(toDelete);

    // Remove node from neighbor's adjacency list.
    foreach (Node neighbor in neighbors)
    {
      graph[neighbor].Remove(toDelete);
    }
  }

  private Brep MergeBreps(List<Node> nodes)
  {
    List<Brep> brepsToBeMerged = new List<Brep>();
    foreach (Node contract in nodes)
    {
      brepsToBeMerged.Add(contract.brep);
    }
    Point3d center = ComputePolyCenter(brepsToBeMerged);
    List<Point3d> corners = new List<Point3d>();
    foreach (Brep brep in brepsToBeMerged)
    {
      foreach (BrepVertex bVert in brep.Vertices)
      {
        bool tooClose = false;
        foreach (Point3d added in corners)
        {
          if (added.DistanceTo(bVert.Location) < 0.1)
          {
            tooClose = true;
            break;
          }
        }
        if (!tooClose)
        {
          corners.Add(bVert.Location);
        }
      }
    }
    Point3d[] sortedCorners = SortPointsWithAngle(center, corners);

    // Check if any of the corners lies on the straight line segment connecting the previous and next corner.
    // If so, this corner is redundant.
    bool[] redundant = new bool[sortedCorners.Length];

    // Starting from 1 to avoid needing to deal with negative remainders.
    for (int i = 1; i < sortedCorners.Length + 1; i++)
    {
      LineCurve connector = new LineCurve(sortedCorners[i - 1], sortedCorners[(i + 1) % sortedCorners.Length]);

      // Find closest point.
      double closestParam;
      connector.ClosestPoint(sortedCorners[i % sortedCorners.Length], out closestParam);
      Point3d closestPoint = connector.PointAt(closestParam);
      if (closestPoint.DistanceTo(sortedCorners[i % sortedCorners.Length]) < 0.1)
      {
        redundant[i % sortedCorners.Length] = true;
      }
    }

    List<Point3d> nonRedundantCorners = new List<Point3d>();
    for (int i = 0; i < sortedCorners.Length; i++)
    {
      if (!redundant[i])
      {
        nonRedundantCorners.Add(sortedCorners[i]);
      }
    }
    List<LineCurve> newBrepEdges = new List<LineCurve>();
    for (int i = 0; i < nonRedundantCorners.Count; i++)
    {
      newBrepEdges.Add(new LineCurve(nonRedundantCorners[i], nonRedundantCorners[(i + 1) % nonRedundantCorners.Count]));
    }
    Brep[] res = Brep.CreatePlanarBreps(newBrepEdges, RhinoMath.SqrtEpsilon);
    if (res == null)
    {
      string msg = "";
      for (int i = 0; i < redundant.Length; i++)
      {
        msg += redundant[i].ToString() + ", ";
      }
      throw new Exception("Merged surface was null: " + msg + ", " + nodes.Count);
    }
    if (res.Length != 1)
    {
      throw new Exception("Too few or too many breps resulted from merging: " + res.Length);
    }
    return res[0];
  }

  private Tuple<List<Point3d>, List<LineCurve>> GetPointsAndEdges(Dictionary<Node, List<Node>> graph)
  {
    List<Point3d> nodeLocs = new List<Point3d>();
    List<LineCurve> edges = new List<LineCurve>();
    foreach (KeyValuePair<Node, List<Node>> keyVal in graph)
    {
      Node node = keyVal.Key;
      if (node.brep == null)
      {
        continue;
      }
      List<Node> neighbors = keyVal.Value;
      nodeLocs.Add(node.location);
      foreach (Node neighbor in neighbors)
      {
        if (neighbor.brep == null)
        {
          continue;
        }
        edges.Add(new LineCurve(node.location, neighbor.location));
      }
    }
    return new Tuple<List<Point3d>, List<LineCurve>>(nodeLocs, edges);
  }

  private void DeconstructGraph(
    Dictionary<Node, List<Node>> graph,
    ref List<Brep> breps,
    ref List<int> types,
    ref List<Point3d> locations,
    ref DataTree<Point3d> delimitingPoints,
    ref Matrix adjacencyMatrix)
  {
    List<Node> allNodes = new List<Node>();
    foreach (KeyValuePair<Node, List<Node>> keyValue in graph)
    {
      allNodes.Add(keyValue.Key);
    }
    int branchIdx = 0;
    foreach (KeyValuePair<Node, List<Node>> keyValue in graph)
    {
      Node currNode = keyValue.Key;
      List<Node> neighbors = keyValue.Value;

      // Transform into lists.
      breps.Add(currNode.brep);
      types.Add(currNode.type);
      locations.Add(currNode.location);
      delimitingPoints.AddRange(currNode.delimitingPoints, new GH_Path(new int[] { 0, branchIdx }));
      branchIdx++;

      int currIdx = allNodes.IndexOf(currNode);
      foreach (Node neighbor in neighbors)
      {
        int neighIdx = allNodes.IndexOf(neighbor);
        adjacencyMatrix[currIdx, neighIdx] = 1;
      }
    }
  }

  private List<Point3d> GetUniqueCorners(List<Brep> breps)
  {
    List<Point3d> corners = new List<Point3d>();
    foreach (Brep brep in breps)
    {
      foreach (BrepVertex bVert in brep.Vertices)
      {
        bool tooClose = false;
        foreach (Point3d added in corners)
        {
          if (added.DistanceTo(bVert.Location) < 0.1)
          {
            tooClose = true;
            break;
          }
        }
        if (!tooClose)
        {
          corners.Add(bVert.Location);
        }
      }
    }
    return corners;
  }

  class PointComparer : Comparer<Point3d>
  {
    public Point3d center;

    private int Orientation(Point3d p1, Point3d p2, Point3d p3)
    {
      double area = (p2.Y - p1.Y) * (p3.X - p2.X) - (p2.X - p1.X) * (p3.Y - p2.Y);

      if (area > 0.0)
      {
        return 1; // collinear
      }
      if (area < 0.0)
      {
        return -1;
      }
      return 0;
    }

    public override int Compare(Point3d x, Point3d y)
    {
      int orientation = Orientation(center, x, y);
      if (orientation == 0)
      {
        // Points are collinear.
        if (center.DistanceTo(y) >= center.DistanceTo(x))
        {
          return -1;  // Second element is greater than first one.
        }
        return 1;  // First element is greater than second one.
      }
      return orientation;
    }
  }

  // Diese Methode gibt das zweitoberste Element im Stack der Punkte zuruck
  private Point3d GetNextToTopElement(Stack<Point3d> points)
  {
    Point3d topElement = points.Peek();
    points.Pop();
    Point3d nextToTopElement = points.Peek();
    points.Push(topElement);
    return nextToTopElement;
  }

  List<Point3d> ConvexHull(List<Point3d> points)
  {
    List<Point3d> convexHull = new List<Point3d>();
    double minY = points[0].Y;
    int minIndex = 0;
    int nPoints = points.Count;

    // Determines the most left, and for ties most bottom, point in the input list.
    for (int i = 1; i < nPoints; i++)
    {
      double y = points[i].Y;
      if (y < minY || y == minY && points[i].X < points[minIndex].X)
      {
        minY = points[i].Y;
        minIndex = i;
      }
    }

    // Put minimum element at first position.
    Point3d temp = points[0];
    points[0] = points[minIndex];
    points[minIndex] = temp;

    // Initialise comparer.
    PointComparer pComparer = new PointComparer
    {
      center = points[0]  // Set to minimum element.
    };

    // Sort points.
    points.Sort(pComparer);

    // If there are at least two points with equal angle to minimum element, remove all except the one that is furthest away.
    int nPointsRed = 1;  // Number of points that are not collinear with the first point.
    for (int i = 1; i < nPoints; i++)
    {
      // Remove points as long as they are collinear.
      while (i < nPoints - 1 && Orientation(pComparer.center, points[i], points[i + 1]) == 0)
      {
        i++;
      }
      points[nPointsRed] = points[i];
      nPointsRed++;
    }

    // If there are less than three points, the hull is trivially convex.
    if (nPointsRed < 3)
    {
      return points;
    }

    // Create stack and add first three points.
    Stack<Point3d> pointStack = new Stack<Point3d>();
    pointStack.Push(points[0]);
    pointStack.Push(points[1]);
    pointStack.Push(points[2]);

    // Go through the remaining points.
    for (int i = 3; i < nPointsRed; i++)
    {
      while (pointStack.Count > 1 && Orientation(GetNextToTopElement(pointStack), pointStack.Peek(), points[i]) != -1)
      {
        pointStack.Pop();
      }
      pointStack.Push(points[i]);
    }

    // Add points from stack to convex hull.
    while (pointStack.Count != 0)
    {
      convexHull.Add(pointStack.Peek());
      pointStack.Pop();
    }

    return convexHull;
  }

  private bool IsConvex(List<Point3d> points)
  {
    List<Point3d> hull = ConvexHull(points);
    Point3d center = Point3d.Origin;
    foreach (Point3d point in hull)
    {
      center += point;
    }
    center /= hull.Count;
    Point3d[] sortedHull = SortPointsWithAngle(center, hull);
    List<LineCurve> edges = new List<LineCurve>();
    for (int i = 0; i < sortedHull.Length; i++)
    {
      edges.Add(new LineCurve(sortedHull[i], sortedHull[(i + 1) % sortedHull.Length]));
    }
    foreach (Point3d point in points)
    {
      double closestParam;
      double minDist = double.MaxValue;
      LineCurve closestCurve = edges[0];
      foreach (LineCurve edge in edges)
      {
        double currParam;
        edge.ClosestPoint(point, out currParam);
        if (edge.PointAt(currParam).DistanceTo(point) < minDist)
        {
          minDist = edge.PointAt(currParam).DistanceTo(point);
          closestParam = currParam;
          closestCurve = edge;
        }
      }
      Print(minDist.ToString());
      if (minDist > 1.0)
      {
        return false;
      }
    }
    return true;
  }

  private int Orientation(Point3d p1, Point3d p2, Point3d p3)
  {
    double area = (p2.Y - p1.Y) * (p3.X - p2.X) - (p2.X - p1.X) * (p3.Y - p2.Y);

    if (area > 0.0)
    {
      return 1; // collinear
    }
    if (area < 0.0)
    {
      return -1;
    }
    return 0;
  }
# ---------- end mergeredblue ----------
scriptpar_14 = ScriptParasite(Enable=synchronization_enabled, Folder=script_directory)

mergenonconcurrent = CSharpScript(
    InBreps=mergeredblue.OutBreps,
    InTypes=mergeredblue.OutTypes,
    InLocations=mergeredblue.OutLocations,
    InDelimitingPoints=mergeredblue.OutDelimitingPoints,
    InAdjacencyMatrix=mergeredblue.OutAdjacencyMatrix,
    BranchPointList=duppt_4)  # -> out, NodeLocations, Edges, OutBreps, OutTypes, OutLocations, OutDelimitingPoints, OutAdjacencyMatrix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; inputs InBreps: list of Brep, InTypes: list of Int32, InLocations: list of Point3d, InDelimitingPoints: tree of Point3d, BranchPointList: list of Point3d
# ---------- mergenonconcurrent: C# ----------
    // Reassemble input into graph.
    Dictionary<Node, List<Node>> graph = ReassembleGraph(InBreps, InTypes, InLocations, InDelimitingPoints, (Matrix)InAdjacencyMatrix);
    Dictionary<Node, List<Node>> graphCopy = new Dictionary<Node, List<Node>>(graph);
    Dictionary<Node, bool> globalVisited = new Dictionary<Node, bool>();
    
    foreach (KeyValuePair<Node, List<Node>> keyVal in graph)
    {
      globalVisited[keyVal.Key] = false;
    }
    List<Brep> toJoin = new List<Brep>();
    List<int> toJoinNeighCount = new List<int>();
    foreach (KeyValuePair<Node, List<Node>> keyVal in graph)
    {
      Node initNode = keyVal.Key;
      if (initNode.type != 2 || graph[initNode].Count > 1)
      {
        continue;
      }
      if (globalVisited[initNode])
      {
        continue;
      }
      List<Node> joinable = new List<Node>();
      Queue<Node> queue = new Queue<Node>();
      queue.Enqueue(initNode);
      bool wasNotConvex = false;
      bool wasTooLarge = false;
      while (queue.Count != 0)
      {
        Node currNode = queue.Dequeue();
        if (globalVisited[currNode])
        {
          continue;
        }
        joinable.Add(currNode);
        globalVisited[currNode] = true;
        foreach (Node neighbor in graph[currNode])
        {
          List<Brep> potentialBreps = new List<Brep>();
          foreach (Node join in joinable)
          {
            potentialBreps.Add(join.brep);
          }
          potentialBreps.Add(neighbor.brep);
          //---------------- BUGGY --------------------//
          bool isConvex = false;
          try
          {
            isConvex = IsConvex(GetUniqueCorners(potentialBreps));
          }
          catch
          {
            isConvex = true;
            Weird = GetUniqueCorners(potentialBreps);
          }
          bool isSmall = false;
          try
          {
            isSmall = graph[neighbor].Count <= 2;
          }
          catch
          {
            toJoin.Add(currNode.brep);
            Print("hili");
          }
          if (isConvex && isSmall)
          {
            queue.Enqueue(neighbor);
          }
          wasNotConvex = !isConvex;
          wasTooLarge = !isSmall;

          //---------------- BUGGY --------------------//
        }
      }
      if (true)
      {
        foreach (Node join in joinable)
        {
          toJoin.Add(join.brep);
          toJoinNeighCount.Add(graph[join].Count);
        }
      }
      if (joinable.Count <= 1)
      {
        continue;
      }
      ContractNodes(graphCopy, joinable, 2);
    }
    ToJoinNeighCount = toJoinNeighCount;
    // Deconstruct graph.
    List<Brep> outBreps = new List<Brep>();
    List<int> outTypes = new List<int>();
    List<Point3d> outLocations = new List<Point3d>();
    DataTree<Point3d> outDelimitingPoints = new DataTree<Point3d>();
    Matrix adjacencyMatrix = new Matrix(graphCopy.Count, graphCopy.Count);
    DeconstructGraph(graphCopy, ref outBreps, ref outTypes, ref outLocations, ref outDelimitingPoints, ref adjacencyMatrix);
    OutBreps = outBreps;
    OutTypes = outTypes;
    OutLocations = outLocations;
    OutDelimitingPoints = outDelimitingPoints;
    OutAdjacencyMatrix = adjacencyMatrix;
    Tuple<List<Point3d>, List<LineCurve>> nodeLocsAndEdges = GetPointsAndEdges(graphCopy);
    NodeLocations = nodeLocsAndEdges.Item1;
    Edges = nodeLocsAndEdges.Item2;
# ---------- mergenonconcurrent: C# additional code ----------
  public struct Node
  {
    public Brep brep;
    public int type;
    public Point3d location;
    public List<Point3d> delimitingPoints; // Only used for type 2 nodes.
    public Node(Brep brep, int type, Point3d location, List<Point3d> delimitingPoints)
    {
      this.brep = brep;
      this.type = type;
      this.location = location;
      this.delimitingPoints = delimitingPoints;
    }
  }

  private Dictionary<Node, List<Node>> ReassembleGraph(
    List<Brep> breps, 
    List<int> types, 
    List<Point3d> locations, 
    DataTree<Point3d> delimitingPoints, 
    Matrix adjacencyMatrix)
  {

    // Create all nodes.
    List<Node> nodes = new List<Node>();
    Dictionary<Node, List<Node>> graph = new Dictionary<Node, List<Node>>();
    for (int i = 0; i < breps.Count; i++)
    {
      Node currNode = new Node(breps[i], types[i], locations[i], delimitingPoints.Branch(i));
      graph[currNode] = new List<Node>();
      nodes.Add(currNode);
    }

    // Add neighbors.
    for (int i = 0; i < breps.Count; i++)
    {
      for (int j = 0; j < breps.Count; j++)
      {
        if (adjacencyMatrix[i, j] == 1)
        {
          graph[nodes[i]].Add(nodes[j]);
        }
      }
    }
    return graph;
  }

  private bool ContainsPointParallel(Point3d queryPoint, List<Point3d> pointList, double tol)
  {
    bool[] isClose = new bool[pointList.Count];
    System.Threading.Tasks.Parallel.For(0, pointList.Count, i =>
    {
      isClose[i] = queryPoint.DistanceTo(pointList[i]) < tol;
    });
    for (int i = 0; i < isClose.Length; i++)
    {
      if (isClose[i])
      {
        return true;
      }
    }
    return false;
  }

  private Point3d ComputePolyCenter(List<Brep> breps)
  {
    List<Point3d> corners = new List<Point3d>();
    foreach (Brep brep in breps)
    {
      if (brep == null)
      {
        return Point3d.Origin;
      }
      foreach (BrepVertex brepVertex in brep.Vertices)
      {
        Point3d location = brepVertex.Location;

        // Need to check if point is already close to corners.
        bool tooClose = false;
        foreach (Point3d corner in corners)
        {
          if (location.DistanceTo(corner) < 2.0)
          {
            tooClose = true;
            break;
          }
        }
        if (!tooClose)
        {
          corners.Add(location);
        }
      }
    }
    Point3d center = Point3d.Origin;
    foreach (Point3d corner in corners)
    {
      center += corner;
    }
    return center / corners.Count;
  }

  private Point3d[] SortPointsWithAngle(Point3d center, List<Point3d> points)
  {
    // Compute connecting vectors.
    List<Vector3d> connectors = new List<Vector3d>();
    foreach (Point3d point in points)
    {
      connectors.Add(point - center);
    }

    // Compute angles.
    List<double> angles = new List<double>();
    foreach (Vector3d connector in connectors)
    {
      angles.Add(AngleToXY(connector));
    }

    // Sort points according to angle.
    Point3d[] res = points.ToArray();
    Array.Sort(angles.ToArray(), res);
    return res;
  }

  private double AngleToXY(Vector3d vec)
  {
    Vector3d xAxis = Vector3d.XAxis;
    if (vec.Y >= 0)
    {
      return RhinoMath.ToDegrees(Vector3d.VectorAngle(vec, xAxis));
    }
    else
    {
      return 360.0 - RhinoMath.ToDegrees(Vector3d.VectorAngle(vec, xAxis));
    }
  }

  private void ContractNodes(Dictionary<Node, List<Node>> graph, List<Node> toContract, int newType)
  {
    // Find neighborhood of nodes to be contracted (without the nodes themselves).
    // TODO: Make more efficient by tracking the neighbors that were already added (instead of invoking Contains every time.)
    List<Node> neighbors = new List<Node>();

    foreach (Node contract in toContract)
    {
      foreach (Node neighbor in graph[contract])
      {
        if (!toContract.Contains(neighbor) && !neighbors.Contains(neighbor))
        {
          neighbors.Add(neighbor);
        }
      }
    }

    // Delete each node which was to be contracted.
    foreach (Node contract in toContract)
    {
      DeleteNode(graph, contract);
    }

    // Construct new node from nodes that were contracted.
    Brep newBrep = MergeBreps(toContract); // New brep.

    // Breaking the convention that there can only be two delimiting points now.
    List<Point3d> newDelimPoints = new List<Point3d>();
    foreach (Node contract in toContract)
    {
      foreach (Point3d delimPoint in contract.delimitingPoints)
      {
        bool tooClose = false;
        foreach (Point3d added in newDelimPoints)
        {
          if (added.DistanceTo(delimPoint) <= 1.0)
          {
            tooClose = true;
            break;
          }
        }
        if (!tooClose)
        {
          newDelimPoints.Add(delimPoint);
        }
      }
    }
    Node newNode = new Node(newBrep, newType, ComputePolyCenter(new List<Brep> { newBrep }), newDelimPoints);

    // Add node to the graph.
    graph[newNode] = neighbors;

    // Add node to all neighbors.
    foreach (Node neighbor in neighbors)
    {
      graph[neighbor].Add(newNode);
    }
  }

  // Returns old neighborhood if successful.
  private void DeleteNode(Dictionary<Node, List<Node>> graph, Node toDelete)
  {
    List<Node> neighbors;
    if (!graph.TryGetValue(toDelete, out neighbors))
    {
      throw new Exception("The node to be deleted was not present in the graph.");
    }

    // Delete the node.
    graph.Remove(toDelete);

    // Remove node from neighbor's adjacency list.
    foreach (Node neighbor in neighbors)
    {
      graph[neighbor].Remove(toDelete);
    }
  }

  private Brep MergeBreps(List<Node> nodes)
  {
    List<Brep> brepsToBeMerged = new List<Brep>();
    foreach (Node contract in nodes)
    {
      brepsToBeMerged.Add(contract.brep);
    }
    Point3d center = ComputePolyCenter(brepsToBeMerged);
    List<Point3d> corners = new List<Point3d>();
    foreach (Brep brep in brepsToBeMerged)
    {
      foreach (BrepVertex bVert in brep.Vertices)
      {
        bool tooClose = false;
        foreach (Point3d added in corners)
        {
          if (added.DistanceTo(bVert.Location) < 0.1)
          {
            tooClose = true;
            break;
          }
        }
        if (!tooClose)
        {
          corners.Add(bVert.Location);
        }
      }
    }
    Point3d[] sortedCorners = SortPointsWithAngle(center, corners);

    // Check if any of the corners lies on the straight line segment connecting the previous and next corner.
    // If so, this corner is redundant.
    bool[] redundant = new bool[sortedCorners.Length];

    // Starting from 1 to avoid needing to deal with negative remainders.
    for (int i = 1; i < sortedCorners.Length + 1; i++)
    {
      LineCurve connector = new LineCurve(sortedCorners[i - 1], sortedCorners[(i + 1) % sortedCorners.Length]);

      // Find closest point.
      double closestParam;
      connector.ClosestPoint(sortedCorners[i % sortedCorners.Length], out closestParam);
      Point3d closestPoint = connector.PointAt(closestParam);
      if (closestPoint.DistanceTo(sortedCorners[i % sortedCorners.Length]) < 0.1)
      {
        redundant[i % sortedCorners.Length] = true;
      }
    }

    List<Point3d> nonRedundantCorners = new List<Point3d>();
    for (int i = 0; i < sortedCorners.Length; i++)
    {
      if (!redundant[i])
      {
        nonRedundantCorners.Add(sortedCorners[i]);
      }
    }
    List<LineCurve> newBrepEdges = new List<LineCurve>();
    for (int i = 0; i < nonRedundantCorners.Count; i++)
    {
      newBrepEdges.Add(new LineCurve(nonRedundantCorners[i], nonRedundantCorners[(i + 1) % nonRedundantCorners.Count]));
    }
    Brep[] res = Brep.CreatePlanarBreps(newBrepEdges, RhinoMath.SqrtEpsilon);
    if (res == null)
    {
      string msg = "";
      for (int i = 0; i < redundant.Length; i++)
      {
        msg += redundant[i].ToString() + ", ";
      }
      throw new Exception("Merged surface was null: " + msg + ", " + nodes.Count);
    }
    if (res.Length != 1)
    {
      throw new Exception("Too few or too many breps resulted from merging: " + res.Length);
    }
    return res[0];
  }

  private Tuple<List<Point3d>, List<LineCurve>> GetPointsAndEdges(Dictionary<Node, List<Node>> graph)
  {
    List<Point3d> nodeLocs = new List<Point3d>();
    List<LineCurve> edges = new List<LineCurve>();
    foreach (KeyValuePair<Node, List<Node>> keyVal in graph)
    {
      Node node = keyVal.Key;
      if (node.brep == null)
      {
        continue;
      }
      List<Node> neighbors = keyVal.Value;
      nodeLocs.Add(node.location);
      foreach (Node neighbor in neighbors)
      {
        if (neighbor.brep == null)
        {
          continue;
        }
        edges.Add(new LineCurve(node.location, neighbor.location));
      }
    }
    return new Tuple<List<Point3d>, List<LineCurve>>(nodeLocs, edges);
  }

  private void DeconstructGraph(
    Dictionary<Node, List<Node>> graph,
    ref List<Brep> breps,
    ref List<int> types,
    ref List<Point3d> locations,
    ref DataTree<Point3d> delimitingPoints,
    ref Matrix adjacencyMatrix)
  {
    List<Node> allNodes = new List<Node>();
    foreach (KeyValuePair<Node, List<Node>> keyValue in graph)
    {
      allNodes.Add(keyValue.Key);
    }
    int branchIdx = 0;
    foreach (KeyValuePair<Node, List<Node>> keyValue in graph)
    {
      Node currNode = keyValue.Key;
      List<Node> neighbors = keyValue.Value;

      // Transform into lists.
      breps.Add(currNode.brep);
      types.Add(currNode.type);
      locations.Add(currNode.location);
      delimitingPoints.AddRange(currNode.delimitingPoints, new GH_Path(new int[] { 0, branchIdx }));
      branchIdx++;

      int currIdx = allNodes.IndexOf(currNode);
      foreach (Node neighbor in neighbors)
      {
        int neighIdx = allNodes.IndexOf(neighbor);
        adjacencyMatrix[currIdx, neighIdx] = 1;
      }
    }
  }

  private List<Point3d> GetUniqueCorners(List<Brep> breps)
  {
    List<Point3d> corners = new List<Point3d>();
    foreach (Brep brep in breps)
    {
      foreach (BrepVertex bVert in brep.Vertices)
      {
        bool tooClose = false;
        foreach (Point3d added in corners)
        {
          if (added.DistanceTo(bVert.Location) < 0.1)
          {
            tooClose = true;
            break;
          }
        }
        if (!tooClose)
        {
          corners.Add(bVert.Location);
        }
      }
    }
    return corners;
  }

  class PointComparer : Comparer<Point3d>
  {
    public Point3d center;

    private int Orientation(Point3d p1, Point3d p2, Point3d p3)
    {
      double area = (p2.Y - p1.Y) * (p3.X - p2.X) - (p2.X - p1.X) * (p3.Y - p2.Y);

      if (area > 0.0)
      {
        return 1; // collinear
      }
      if (area < 0.0)
      {
        return -1;
      }
      return 0;
    }

    public override int Compare(Point3d x, Point3d y)
    {
      int orientation = Orientation(center, x, y);
      if (orientation == 0)
      {
        // Points are collinear.
        if (center.DistanceTo(y) >= center.DistanceTo(x))
        {
          return -1;  // Second element is greater than first one.
        }
        return 1;  // First element is greater than second one.
      }
      return orientation;
    }
  }

  // Diese Methode gibt das zweitoberste Element im Stack der Punkte zur�ck
  private Point3d GetNextToTopElement(Stack<Point3d> points)
  {
    Point3d topElement = points.Peek();
    points.Pop();
    Point3d nextToTopElement = points.Peek();
    points.Push(topElement);
    return nextToTopElement;
  }

  List<Point3d> ConvexHull(List<Point3d> points)
  {
    List<Point3d> convexHull = new List<Point3d>();
    double minY = points[0].Y;
    int minIndex = 0;
    int nPoints = points.Count;

    // Determines the most left, and for ties most bottom, point in the input list.
    for (int i = 1; i < nPoints; i++)
    {
      double y = points[i].Y;
      if (y < minY || y == minY && points[i].X < points[minIndex].X)
      {
        minY = points[i].Y;
        minIndex = i;
      }
    }

    // Put minimum element at first position.
    Point3d temp = points[0];
    points[0] = points[minIndex];
    points[minIndex] = temp;

    // Initialise comparer.
    PointComparer pComparer = new PointComparer
    {
      center = points[0]  // Set to minimum element.
    };

    // Sort points.
    points.Sort(pComparer);

    // If there are at least two points with equal angle to minimum element, remove all except the one that is furthest away.
    int nPointsRed = 1;  // Number of points that are not collinear with the first point.
    for (int i = 1; i < nPoints; i++)
    {
      // Remove points as long as they are collinear.
      while (i < nPoints - 1 && Orientation(pComparer.center, points[i], points[i + 1]) == 0)
      {
        i++;
      }
      points[nPointsRed] = points[i];
      nPointsRed++;
    }

    // If there are less than three points, the hull is trivially convex.
    if (nPointsRed < 3)
    {
      return points;
    }

    // Create stack and add first three points.
    Stack<Point3d> pointStack = new Stack<Point3d>();
    pointStack.Push(points[0]);
    pointStack.Push(points[1]);
    pointStack.Push(points[2]);

    // Go through the remaining points.
    for (int i = 3; i < nPointsRed; i++)
    {
      while (pointStack.Count > 1 && Orientation(GetNextToTopElement(pointStack), pointStack.Peek(), points[i]) != -1)
      {
        pointStack.Pop();
      }
      pointStack.Push(points[i]);
    }

    // Add points from stack to convex hull.
    while (pointStack.Count != 0)
    {
      convexHull.Add(pointStack.Peek());
      pointStack.Pop();
    }

    return convexHull;
  }

  private bool IsConvex(List<Point3d> points)
  {
    List<Point3d> hull = ConvexHull(points);
    Point3d center = Point3d.Origin;
    foreach (Point3d point in hull)
    {
      center += point;
    }
    center /= hull.Count;
    Point3d[] sortedHull = SortPointsWithAngle(center, hull);
    List<LineCurve> edges = new List<LineCurve>();
    for (int i = 0; i < sortedHull.Length; i++)
    {
      edges.Add(new LineCurve(sortedHull[i], sortedHull[(i + 1) % sortedHull.Length]));
    }
    foreach (Point3d point in points)
    {
      double closestParam;
      double minDist = double.MaxValue;
      LineCurve closestCurve = edges[0];
      foreach (LineCurve edge in edges)
      {
        double currParam;
        edge.ClosestPoint(point, out currParam);
        if (edge.PointAt(currParam).DistanceTo(point) < minDist)
        {
          minDist = edge.PointAt(currParam).DistanceTo(point);
          closestParam = currParam;
          closestCurve = edge;
        }
      }
      if (minDist > 1.0)
      {
        return false;
      }
    }
    return true;
  }

  private int Orientation(Point3d p1, Point3d p2, Point3d p3)
  {
    double area = (p2.Y - p1.Y) * (p3.X - p2.X) - (p2.X - p1.X) * (p3.Y - p2.Y);

    if (area > 0.0)
    {
      return 1; // collinear
    }
    if (area < 0.0)
    {
      return -1;
    }
    return 0;
  }
# ---------- end mergenonconcurrent ----------
scriptpar_15 = ScriptParasite(Enable=synchronization_enabled, Folder=script_directory)

pt_3 = Point(mergenonconcurrent.Weird)

# ---- group: Debugging Partitioning
typetocolor = GhPythonScript(
    Type=createelementarysurfaces.OutTypes,
    NormalColor=ColourSwatch(SwatchColor=RGB(0, 34, 255)),
    SemiColor=ColourSwatch(SwatchColor=RGB(255, 0, 0)),
    FullColor=ColourSwatch(SwatchColor=RGB(255, 229, 0)))  # -> out, Color; inputs Type: Int32, NormalColor: Color, SemiColor: Color, FullColor: Color
# ---------- typetocolor: Python ----------
__author__ = "rapha"
__version__ = "2021.10.10"

import rhinoscriptsyntax as rs

if Type == 0:
    Color = NormalColor
elif Type == 1:
    Color = SemiColor
else:
    Color = FullColor
# ---------- end typetocolor ----------
material_2 = CreateMaterial(
    Diffuse=typetocolor.Color,
    Specular=RGB(255, 255, 255),
    Emission=RGB(0, 0, 0),
    Transparency=Slider(0.43, range=0..1),
    Shine=0)
preview_2 = CustomPreview(Geometry=createelementarysurfaces.OutBreps, Material=material_2)

# ---- group: Debugging Graph
dot = DotDisplay(Point=mergenonconcurrent.NodeLocations)
previewlw_4 = CustomPreviewLineweights(
    Geometry=mergenonconcurrent.Edges,
    Shader=ColourSwatch(SwatchColor=RGB(0, 0, 0)),
    Thickness=Slider(10, range=0..10),
    Absolute=False)

# ----
item_2 = ListItem(List=pt_3, Index=Slider(1, range=0..11), Wrap=True)
mergecorners_2 = CSharpScript(
    InBreps=mergenonconcurrent.OutBreps,
    InTypes=mergenonconcurrent.OutTypes,
    InLocations=mergenonconcurrent.OutLocations,
    InDelimitingPoints=mergenonconcurrent.OutDelimitingPoints,
    InAdjacencyMatrix=mergenonconcurrent.OutAdjacencyMatrix,
    BranchPointList=duppt_4)  # -> out, NodeLocations, Edges, OutBreps, OutTypes, OutLocations, OutDelimitingPoints, OutAdjacencyMatrix; inputs InBreps: list of Brep, InTypes: list of Int32, InLocations: list of Point3d, InDelimitingPoints: tree of Point3d, BranchPointList: list of Point3d
# ---------- mergecorners_2: C# ----------
    // Reassemble input into graph.
    Dictionary<Node, List<Node>> graph = ReassembleGraph(InBreps, InTypes, InLocations, InDelimitingPoints, (Matrix)InAdjacencyMatrix);
    Dictionary<Node, List<Node>> graphCopy = new Dictionary<Node, List<Node>>(graph);

    // Find type 2 nodes with type 0 neighbors which have only 1 neighbor (the type 2 node). Contract them.
    foreach (KeyValuePair<Node, List<Node>> keyVal in graph)
    {
      Node currNode = keyVal.Key;
      if (currNode.type != 2)
      {
        continue;
      }
      if (currNode.brep == null)
      {
        continue;
      }
      List<Node> neighbors = keyVal.Value;
      List<Node> toContract = new List<Node>() { currNode };
      foreach (Node neighbor in neighbors)
      {

        if (neighbor.type == 0 && graph[neighbor].Count == 1)
        {
          toContract.Add(neighbor);
        }
      }
      if (toContract.Count <= 1)
      {
        continue;
      }

      ContractNodes(graphCopy, toContract, 2);
    }

    // Deconstruct graph.
    List<Brep> outBreps = new List<Brep>();
    List<int> outTypes = new List<int>();
    List<Point3d> outLocations = new List<Point3d>();
    DataTree<Point3d> outDelimitingPoints = new DataTree<Point3d>();
    Matrix adjacencyMatrix = new Matrix(graphCopy.Count, graphCopy.Count);
    DeconstructGraph(graphCopy, ref outBreps, ref outTypes, ref outLocations, ref outDelimitingPoints, ref adjacencyMatrix);
    OutBreps = outBreps;
    OutTypes = outTypes;
    OutLocations = outLocations;
    OutDelimitingPoints = outDelimitingPoints;
    OutAdjacencyMatrix = adjacencyMatrix;
    Tuple<List<Point3d>, List<LineCurve>> nodeLocsAndEdges = GetPointsAndEdges(graphCopy);
    NodeLocations = nodeLocsAndEdges.Item1;
    Edges = nodeLocsAndEdges.Item2;
# ---------- mergecorners_2: C# additional code ----------
  public struct Node
  {
    public Brep brep;
    public int type;
    public Point3d location;
    public List<Point3d> delimitingPoints; // Only used for type 2 nodes.
    public Node(Brep brep, int type, Point3d location, List<Point3d> delimitingPoints)
    {
      this.brep = brep;
      this.type = type;
      this.location = location;
      this.delimitingPoints = delimitingPoints;
    }
  }

  private Dictionary<Node, List<Node>> ReassembleGraph(
    List<Brep> breps, 
    List<int> types, 
    List<Point3d> locations, 
    DataTree<Point3d> delimitingPoints, 
    Matrix adjacencyMatrix)
  {

    // Create all nodes.
    List<Node> nodes = new List<Node>();
    Dictionary<Node, List<Node>> graph = new Dictionary<Node, List<Node>>();
    for (int i = 0; i < breps.Count; i++)
    {
      Node currNode = new Node(breps[i], types[i], locations[i], delimitingPoints.Branch(i));
      graph[currNode] = new List<Node>();
      nodes.Add(currNode);
    }

    // Add neighbors.
    for (int i = 0; i < breps.Count; i++)
    {
      for (int j = 0; j < breps.Count; j++)
      {
        if (adjacencyMatrix[i, j] == 1)
        {
          graph[nodes[i]].Add(nodes[j]);
        }
      }
    }
    return graph;
  }

  private bool ContainsPointParallel(Point3d queryPoint, List<Point3d> pointList, double tol)
  {
    bool[] isClose = new bool[pointList.Count];
    System.Threading.Tasks.Parallel.For(0, pointList.Count, i =>
    {
      isClose[i] = queryPoint.DistanceTo(pointList[i]) < tol;
    });
    for (int i = 0; i < isClose.Length; i++)
    {
      if (isClose[i])
      {
        return true;
      }
    }
    return false;
  }

  private Point3d ComputePolyCenter(List<Brep> breps)
  {
    List<Point3d> corners = new List<Point3d>();
    foreach (Brep brep in breps)
    {
      if (brep == null)
      {
        return Point3d.Origin;
      }
      foreach (BrepVertex brepVertex in brep.Vertices)
      {
        Point3d location = brepVertex.Location;

        // Need to check if point is already close to corners.
        bool tooClose = false;
        foreach (Point3d corner in corners)
        {
          if (location.DistanceTo(corner) < 2.0)
          {
            tooClose = true;
            break;
          }
        }
        if (!tooClose)
        {
          corners.Add(location);
        }
      }
    }
    Point3d center = Point3d.Origin;
    foreach (Point3d corner in corners)
    {
      center += corner;
    }
    return center / corners.Count;
  }

  private Point3d[] SortPointsWithAngle(Point3d center, List<Point3d> points)
  {
    // Compute connecting vectors.
    List<Vector3d> connectors = new List<Vector3d>();
    foreach (Point3d point in points)
    {
      connectors.Add(point - center);
    }

    // Compute angles.
    List<double> angles = new List<double>();
    foreach (Vector3d connector in connectors)
    {
      angles.Add(AngleToXY(connector));
    }

    // Sort points according to angle.
    Point3d[] res = points.ToArray();
    Array.Sort(angles.ToArray(), res);
    return res;
  }

  private double AngleToXY(Vector3d vec)
  {
    Vector3d xAxis = Vector3d.XAxis;
    if (vec.Y >= 0)
    {
      return RhinoMath.ToDegrees(Vector3d.VectorAngle(vec, xAxis));
    }
    else
    {
      return 360.0 - RhinoMath.ToDegrees(Vector3d.VectorAngle(vec, xAxis));
    }
  }

  private void ContractNodes(Dictionary<Node, List<Node>> graph, List<Node> toContract, int newType)
  {
    // Find neighborhood of nodes to be contracted (without the nodes themselves).
    // TODO: Make more efficient by tracking the neighbors that were already added (instead of invoking Contains every time.)
    List<Node> neighbors = new List<Node>();
    foreach (Node contract in toContract)
    {
      foreach (Node neighbor in graph[contract])
      {
        if (!toContract.Contains(neighbor) && !neighbors.Contains(neighbor))
        {
          neighbors.Add(neighbor);
        }
      }
    }

    // Delete each node which was to be contracted.
    foreach (Node contract in toContract)
    {
      DeleteNode(graph, contract);
    }

    // Construct new node from nodes that were contracted.
    Brep newBrep = MergeBreps(toContract); // New brep.

    // Breaking the convention that there can only be two delimiting points now.
    List<Point3d> newDelimPoints = new List<Point3d>();
    foreach (Node contract in toContract)
    {
      foreach (Point3d delimPoint in contract.delimitingPoints)
      {
        bool tooClose = false;
        foreach (Point3d added in newDelimPoints)
        {
          if (added.DistanceTo(delimPoint) <= 1.0)
          {
            tooClose = true;
            break;
          }
        }
        if (!tooClose)
        {
          newDelimPoints.Add(delimPoint);
        }
      }
    }
    Node newNode = new Node(newBrep, newType, ComputePolyCenter(new List<Brep> { newBrep }), newDelimPoints);

    // Add node to the graph.
    graph[newNode] = neighbors;

    // Add node to all neighbors.
    foreach (Node neighbor in neighbors)
    {
      graph[neighbor].Add(newNode);
    }
  }

  // Returns old neighborhood if successful.
  private void DeleteNode(Dictionary<Node, List<Node>> graph, Node toDelete)
  {
    List<Node> neighbors;
    if (!graph.TryGetValue(toDelete, out neighbors))
    {
      throw new Exception("The node to be deleted was not present in the graph.");
    }

    // Delete the node.
    graph.Remove(toDelete);

    // Remove node from neighbor's adjacency list.
    foreach (Node neighbor in neighbors)
    {
      graph[neighbor].Remove(toDelete);
    }
  }

  private Brep MergeBreps(List<Node> nodes)
  {
    List<Brep> brepsToBeMerged = new List<Brep>();
    foreach (Node contract in nodes)
    {
      brepsToBeMerged.Add(contract.brep);
    }
    Point3d center = ComputePolyCenter(brepsToBeMerged);
    List<Point3d> corners = new List<Point3d>();
    foreach (Brep brep in brepsToBeMerged)
    {
      foreach (BrepVertex bVert in brep.Vertices)
      {
        bool tooClose = false;
        foreach (Point3d added in corners)
        {
          if (added.DistanceTo(bVert.Location) < 0.1)
          {
            tooClose = true;
            break;
          }
        }
        if (!tooClose)
        {
          corners.Add(bVert.Location);
        }
      }
    }
    Point3d[] sortedCorners = SortPointsWithAngle(center, corners);

    // Check if any of the corners lies on the straight line segment connecting the previous and next corner.
    // If so, this corner is redundant.
    bool[] redundant = new bool[sortedCorners.Length];

    // Starting from 1 to avoid needing to deal with negative remainders.
    for (int i = 1; i < sortedCorners.Length + 1; i++)
    {
      LineCurve connector = new LineCurve(sortedCorners[i - 1], sortedCorners[(i + 1) % sortedCorners.Length]);

      // Find closest point.
      double closestParam;
      connector.ClosestPoint(sortedCorners[i % sortedCorners.Length], out closestParam);
      Point3d closestPoint = connector.PointAt(closestParam);
      if (closestPoint.DistanceTo(sortedCorners[i % sortedCorners.Length]) < 0.1)
      {
        redundant[i % sortedCorners.Length] = true;
      }
    }

    List<Point3d> nonRedundantCorners = new List<Point3d>();
    for (int i = 0; i < sortedCorners.Length; i++)
    {
      if (!redundant[i])
      {
        nonRedundantCorners.Add(sortedCorners[i]);
      }
    }
    List<LineCurve> newBrepEdges = new List<LineCurve>();
    for (int i = 0; i < nonRedundantCorners.Count; i++)
    {
      newBrepEdges.Add(new LineCurve(nonRedundantCorners[i], nonRedundantCorners[(i + 1) % nonRedundantCorners.Count]));
    }
    Brep[] res = Brep.CreatePlanarBreps(newBrepEdges, RhinoMath.SqrtEpsilon);
    if (res == null)
    {
      string msg = "";
      for (int i = 0; i < redundant.Length; i++)
      {
        msg += redundant[i].ToString() + ", ";
      }
      throw new Exception("Merged surface was null");
    }
    if (res.Length != 1)
    {
      throw new Exception("Too few or too many breps resulted from merging: " + res.Length);
    }
    return res[0];
  }

  private Tuple<List<Point3d>, List<LineCurve>> GetPointsAndEdges(Dictionary<Node, List<Node>> graph)
  {
    List<Point3d> nodeLocs = new List<Point3d>();
    List<LineCurve> edges = new List<LineCurve>();
    foreach (KeyValuePair<Node, List<Node>> keyVal in graph)
    {
      Node node = keyVal.Key;
      List<Node> neighbors = keyVal.Value;
      nodeLocs.Add(node.location);
      foreach (Node neighbor in neighbors)
      {
        edges.Add(new LineCurve(node.location, neighbor.location));
      }
    }
    return new Tuple<List<Point3d>, List<LineCurve>>(nodeLocs, edges);
  }

  private void DeconstructGraph(
    Dictionary<Node, List<Node>> graph,
    ref List<Brep> breps,
    ref List<int> types,
    ref List<Point3d> locations,
    ref DataTree<Point3d> delimitingPoints,
    ref Matrix adjacencyMatrix)
  {
    List<Node> allNodes = new List<Node>();
    foreach (KeyValuePair<Node, List<Node>> keyValue in graph)
    {
      allNodes.Add(keyValue.Key);
    }
    int branchIdx = 0;
    foreach (KeyValuePair<Node, List<Node>> keyValue in graph)
    {
      Node currNode = keyValue.Key;
      List<Node> neighbors = keyValue.Value;

      // Transform into lists.
      breps.Add(currNode.brep);
      types.Add(currNode.type);
      locations.Add(currNode.location);
      delimitingPoints.AddRange(currNode.delimitingPoints, new GH_Path(new int[] { 0, branchIdx }));
      branchIdx++;

      int currIdx = allNodes.IndexOf(currNode);
      foreach (Node neighbor in neighbors)
      {
        int neighIdx = allNodes.IndexOf(neighbor);
        adjacencyMatrix[currIdx, neighIdx] = 1;
      }
    }
  }
# ---------- end mergecorners_2 ----------
# ---- group: Centering nodes
pt_4 = Point(mergecorners_2.NodeLocations)
ma = MassAddition(Input=pt_4)  # -> Result, PartialResults
lng = ListLength(List=pt_4)
division = Division(A=ma.Result, B=lng)
subtraction = Subtraction(A=pt_4, B=division)

# ---- group: Scaling nodes
pt_5 = Point(subtraction)
number_slider_7 = Slider(0.1, range=0..10)
multiplication = Multiplication(A=pt_5, B=number_slider_7)

# ---- group: Displacement vector into X, -Y quadrant
devec = DeconstructVector(Vector=multiplication)  # -> XComponent, YComponent, ZComponent
sort = SortList(Keys=devec.XComponent)  # -> Keys, ValuesA
sort_2 = SortList(Keys=devec.YComponent)  # -> Keys, ValuesA
rev = ReverseList(List=sort_2.Keys)
int_2 = Integer(0)
item_3 = ListItem(List=sort.Keys, Index=int_2, Wrap=True)
item_4 = ListItem(List=rev, Index=int_2, Wrap=True)
int_3 = Integer(-1)
multiplication_2 = Multiplication(A=item_3, B=int_3)
multiplication_3 = Multiplication(A=int_3, B=item_4)
vec = VectorXYZ(XComponent=multiplication_2, YComponent=multiplication_3, ZComponent=0)  # -> Vector, Length

# ---- group: Displace Geometry into X, -Y quadrant (with margin)
addition = Addition(A=multiplication, B=vec.Vector)
int_4 = Integer(-1)
pt_6 = Point(addition)
multiplication_4 = Multiplication(B=int_4)
vec_2 = VectorXYZ(XComponent=Slider(0, range=0..100), YComponent=Slider(0, range=0..100), ZComponent=0)  # -> Vector, Length
addition_2 = Addition(A=addition, B=vec_2.Vector)

# ---- group: Transform boundary and edge positions for display "Graph Builder"
explode_4 = Explode(Curve=topoly.Polyline, Recursive=True)  # -> flatten(Segments), Vertices
vec_3 = Vector(division)
int_5 = Integer(-1)
crv_4 = Curve([mergecorners_2.Edges, explode_4.Segments])
multiplication_5 = Multiplication(A=vec_3, B=int_5)
move = Move(Geometry=crv_4, Motion=multiplication_5)  # -> Geometry, Transform
scale = Scale(Geometry=move.Geometry, Center=Point(0, 0, 0), Factor=number_slider_7)  # -> Geometry, Transform
move_2 = Move(Geometry=scale.Geometry, Motion=vec.Vector)  # -> Geometry, Transform
move_3 = Move(Geometry=move_2.Geometry, Motion=vec_2.Vector)  # -> Geometry, Transform
crv_5 = Curve(flatten(move_3.Geometry))
lng_2 = ListLength(List=explode_4.Segments)
split = SplitList(List=crv_5, Index=lng_2)  # -> ListA, ListB

# ----
node_positions = Point(addition_2)

# ---- group: Display Nodes
cir = Circle(Plane=node_positions, Radius=1)
swatch_12 = ColourSwatch(SwatchColor=RGBA(255, 0, 0, 0))
shapes = CreateShapes(Shapes=cir, FillColor=swatch_12, StrokeColor=swatch_12, Scale=graph_size, ClickMode=1)
shapes_2 = CreateShapes(Shapes=cir, FillColor=swatch_12, StrokeColor=swatch_12, Scale=graph_size, ClickMode=1)
shapes_3 = CreateShapes(Shapes=cir, FillColor=swatch_12, StrokeColor=swatch_12, Scale=graph_size, ClickMode=1)
shapes_4 = CreateShapes(Shapes=cir, FillColor=swatch_12, StrokeColor=swatch_12, Scale=graph_size, ClickMode=1)
shapes_5 = CreateShapes(Shapes=cir, FillColor=swatch_12, StrokeColor=swatch_12, Scale=graph_size, ClickMode=1)
shapes_6 = CreateShapes(Shapes=cir, FillColor=swatch_12, StrokeColor=swatch_12, Scale=graph_size, ClickMode=1)
shapes_7 = CreateShapes(Shapes=cir, FillColor=swatch_12, StrokeColor=swatch_12, Scale=graph_size, ClickMode=1)
shapes_8 = CreateShapes(Shapes=cir, FillColor=swatch_12, StrokeColor=swatch_12, Scale=graph_size, ClickMode=1)
shapes_9 = CreateShapes(Shapes=cir, FillColor=swatch_12, StrokeColor=swatch_12, Scale=graph_size, ClickMode=1)

# ----
merge_4 = Merge(
    Data1=shapes,
    Data2=shapes_2,
    Data3=shapes_3,
    Data4=shapes_4,
    Data5=shapes_5,
    Data6=shapes_6,
    Data7=shapes_7,
    Data8=shapes_8,
    Data9=shapes_9)
values_3 = ValueListener(Elements=merge_4, SomeProperty=True)  # -> flatten(Values), Indices
lng_3 = ListLength(List=node_positions)
filter_3 = StreamFilter(
    Gate=mindex.Index,
    Stream0=shapes,
    Stream1=shapes_2,
    Stream2=shapes_3,
    Stream3=shapes_4,
    Stream4=shapes_5,
    Stream5=shapes_6,
    Stream6=shapes_7,
    Stream7=shapes_8,
    Stream8=shapes_9)
colorgraphcomponents = GhPythonScript(
    Labels=values_3.Values,
    LabelNames=merge,
    ColorsPerLabel=col_2,
    NodeNumber=lng_3,
    NodePositions=node_positions,
    DeadColor=swatch_10,
    BoundaryColor=ColourSwatch(SwatchColor=RGB(0, 0, 0)),
    EdgeColor=swatch_10,
    Boundaries=split.ListA,
    Edges=split.ListB)  # -> out, Geometry, Colors, LabelText, Centers; inputs Labels: list of Boolean, LabelNames: list, ColorsPerLabel: list of Color, NodePositions: list of Point3d, DeadColor: Color, Boundaries: list of Curve, Edges: list of Curve
# ---------- colorgraphcomponents: Python ----------
__author__ = "rapha"
__version__ = "2022.01.30"

import rhinoscriptsyntax as rs

Geometry = []
Colors = []
LabelText = []
Centers = []

labels_per_room_type = [Labels[x:x+NodeNumber] for x in range(0, len(Labels), NodeNumber)]

for i in range(NodeNumber):
    
    # Isolate all labels per node.
    labels_per_node = [label[i] for label in labels_per_room_type]
    
    # Determine how many labels are assigned to the node.
    num_labels = len([bool for bool in labels_per_node if bool])
    
    # Create circle around node position.
    center = NodePositions[i]
    circle = rs.AddCircle(center, 1.0)
    
    if (num_labels > 1):
        # Subdivide circle to create outer boundaries for segments.
        split_points = [rs.CurveDomain(circle)[1] / num_labels * j for j in range(num_labels)]
        split_circle = rs.SplitCurve(circle, split_points)
        split_circle_idx = 0
        for j, label in enumerate(labels_per_node):
            
            # This room type is not assigned to the current node.
            if not label:
                continue
            
            # Construct sector.
            sector_border = split_circle[split_circle_idx]
            sector_start = rs.CurveStartPoint(sector_border)
            sector_end = rs.CurveEndPoint(sector_border)
            mid_to_start = rs.AddLine(center, sector_start)
            mid_to_end = rs.AddLine(center, sector_end)
            sector = rs.JoinCurves([mid_to_start, sector_border, mid_to_end])[0]
            Geometry.append(sector)
            Colors.append(ColorsPerLabel[j])
            split_circle_idx += 1
    else:
        Geometry.append(circle)
        Centers.append(center)
        if (num_labels == 1):
            Colors.append(ColorsPerLabel[labels_per_node.index(True)])
            LabelText.append(LabelNames[labels_per_node.index(True)])
        else:
            Colors.append(DeadColor)
            LabelText.append("")

Geometry += Boundaries
Geometry += Edges
Colors += len(Boundaries) * [BoundaryColor]
Colors += len(Edges) * [EdgeColor]
# ---------- end colorgraphcomponents ----------
label = CreateLabel(LabelText=colorgraphcomponents.LabelText, LabelSize=12, Justification=0)
crv_6 = Curve(colorgraphcomponents.Geometry)

# ---- group: some Graph Builder Logic
flatten = FlattenTree(Tree=merge_2, Path="{0}")
flatten_2 = FlattenTree(Tree=merge_3, Path="{1}")
data = Data([flatten_2, flatten])
arc = Arc(Plane=PlaneXY(0, 0, 0), Radius=1, Angle=Domain(0, 3.141592654))  # -> Arc, Length
shapes_10 = CreateShapes(
    Shapes=crv_6,
    FillColor=colorgraphcomponents.Colors,
    StrokeColor=colorgraphcomponents.Colors,
    Scale=graph_size,
    ClickMode=3)
simplegrid = CreateSimpleGrid(UIElements=data, RowDefinitions="Auto", ColumnDefinitions="Auto")
number_slider_8 = Slider(10, range=0..10)
merge_5 = Merge(Data1=simplegrid, Data2=shapes_10)  # -> flatten(Result)
vec_4 = VectorXYZ(XComponent=number_slider_8, YComponent=number_slider_8, ZComponent=0)  # -> Vector, Length
multiplication_6 = Multiplication(A=colorgraphcomponents.Centers, B=graph_size)
move_4 = Move(Geometry=multiplication_6, Motion=vec_4.Vector)  # -> Geometry, Transform
lng_4 = ListLength(List=merge_5)
addelem2shape = AddElementsToShapeS(ShapeToAddTo=flatten(shapes_10), ElementToAdd=label, ElementLocation=move_4.Geometry, Scale=1)
true_button = CreateTrueOnlyButton(ButtonStyle=0)
ins = InsertItems(List=merge_5, Item=filter_3, Indices=lng_4, Wrap=True)
addelems = AddElements(Window=launchwin, Elements=[ins, true_button], DoVLChecking=False)  # -> AddedElements, ElementNames
python_2 = GhPythonScript(nodes=mergecorners_2.NodeLocations, edges=mergecorners_2.Edges)  # -> out, ICD, contributing_nodes, contributing_degrees, min_degree, max_degree; inputs nodes: list of Point3d, edges: list of Curve
# ---------- python_2: Python ----------
__author__ = "rapha"
__version__ = "2021.10.08"

import rhinoscriptsyntax as rs

end_points = []

for edge in edges:
    start_point = rs.CurveStartPoint(edge)
    end_point = rs.CurveEndPoint(edge)
    both = [start_point, end_point]
    end_points.append(both)

node_degrees = []
contributing = 0
contributing_degrees = []
contributing_nodes = []
min_degree = float("inf")
max_degree = 0
for node in nodes:
    degree = 0
    for end_point in end_points:
        s = end_point[0]
        e = end_point[1]
        if (rs.Distance(node, s) < 0.1 or rs.Distance(node, e) < 0.1):
            degree += 1
    node_degrees.append(degree)
    if degree > 0:
        if degree < min_degree:
            min_degree = degree
        if degree > max_degree:
            max_degree = degree
        contributing_degrees.append(degree)
        contributing_nodes.append(node)
        contributing += 1
ICD = sum(node_degrees) / contributing
ICD /= 2
# ---------- end python_2 ----------

# ---- group: Adjust Position of Graph Elements in Graph Builder
merge_6 = Merge(
    Data1=shapes_10,
    Data2=filter_3,
    Data3=shapes,
    Data4=shapes_2,
    Data5=shapes_3,
    Data6=shapes_4,
    Data7=shapes_5,
    Data8=shapes_6,
    Data9=shapes_7,
    Data10=shapes_8,
    Data11=shapes_9)  # -> flatten(Result)
definemargin = GhPythonScript(
    Left=displacement_left_pixels,
    Top=displacement_top_pixels,
    Right=Slider(0, range=0..1000),
    Bottom=Slider(0, range=0..1000))  # -> out, string; inputs Left: Int32, Top: Int32, Right: Int32, Bottom: Int32
# ---------- definemargin: Python ----------
__author__ = "rapha"
__version__ = "2022.04.20"

import rhinoscriptsyntax as rs

string = str(Left) + ", " + str(Top) + ", " + str(Right) + ", " + str(Bottom)
# ---------- end definemargin ----------
adjustpos = AdjustElementPositioning(ElementsToAdjust=merge_6, Margin=definemargin.string, AbsolutePositioning=Toggle(True))

# ----
partitionbylabel = GhPythonScript(Labels=colorgraphcomponents.LabelText, Points=mergecorners_2.NodeLocations)  # -> out, PatientRoom, NurseStation, UtilityRoom, Elevator, ElevatorLobby, MedicalClinic, Pantry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; inputs Labels: list, Points: list of Point3d
# ---------- partitionbylabel: Python ----------
__author__ = "rapha"
__version__ = "2022.03.31"

import rhinoscriptsyntax as rs

# Hold the nodes.
PatientRoom = []
NurseStation = []
UtilityRoom = []
Elevator = []
ElevatorLobby = []
MedicalClinic = []
Pantry = []
MedicationRoom = []
JanitorCloset = []
Additional = []

# Mapping from names to containers.
map = {
    "Patient Room": PatientRoom,
    "Nurse Station": NurseStation,
    "Utility Room": UtilityRoom,
    "Elevator": Elevator,
    "Elevator Lobby": ElevatorLobby, 
    "Medical Clinic": MedicalClinic,
    "Pantry": Pantry,
    "Medication Room": MedicationRoom,
    "Janitor Closet": JanitorCloset
}

for i, label in enumerate(Labels):
    if label in map:
        map[label].append(Points[i])
    else:
        Additional.append(Points[i])
# ---------- end partitionbylabel ----------
filter_4 = StreamFilter(Gate=visualize_yti, Stream1=partitionbylabel.PatientRoom)
filter_5 = StreamFilter(Gate=visualize_yti, Stream1=partitionbylabel.NurseStation)
filter_6 = StreamFilter(Gate=visualize_yti, Stream1=partitionbylabel.UtilityRoom)
filter_7 = StreamFilter(Gate=visualize_yti, Stream1=partitionbylabel.Elevator)
filter_8 = StreamFilter(Gate=visualize_yti, Stream1=partitionbylabel.ElevatorLobby)
filter_9 = StreamFilter(Gate=visualize_yti, Stream1=partitionbylabel.MedicalClinic)
filter_10 = StreamFilter(Gate=visualize_yti, Stream1=partitionbylabel.Pantry)
filter_11 = StreamFilter(Gate=visualize_yti, Stream1=partitionbylabel.MedicationRoom)
filter_12 = StreamFilter(Gate=visualize_yti, Stream1=partitionbylabel.JanitorCloset)

cloud = CloudDisplay(Points=filter_4, Colours=swatch, Size=number_slider_3, SpriteType=0)
cloud_2 = CloudDisplay(Points=filter_5, Colours=swatch_4, Size=number_slider_3, SpriteType=0)
cloud_3 = CloudDisplay(Points=filter_6, Colours=swatch_2, Size=number_slider_3, SpriteType=0)
cloud_4 = CloudDisplay(Points=filter_7, Colours=swatch_5, Size=number_slider_3, SpriteType=0)
cloud_5 = CloudDisplay(Points=filter_8, Colours=swatch_6, Size=number_slider_3, SpriteType=0)
cloud_6 = CloudDisplay(Points=filter_9, Colours=swatch_3, Size=number_slider_3, SpriteType=0)
cloud_7 = CloudDisplay(Points=filter_10, Colours=swatch_7, Size=number_slider_3, SpriteType=0)
cloud_8 = CloudDisplay(Points=filter_11, Colours=swatch_8, Size=number_slider_3, SpriteType=0)
cloud_9 = CloudDisplay(Points=filter_12, Colours=swatch_9, Size=number_slider_3, SpriteType=0)

nurse_station = Point(partitionbylabel.NurseStation)
utility_room = Point(partitionbylabel.UtilityRoom)
medication_room = Point(partitionbylabel.MedicationRoom)
additional = Point(partitionbylabel.Additional)
patient_room = Point(partitionbylabel.PatientRoom)
elevator = Point(partitionbylabel.Elevator)
elevator_lobby = Point(partitionbylabel.ElevatorLobby)
medical_clinic = Point(partitionbylabel.MedicalClinic)
pantry = Point(partitionbylabel.Pantry)
janitor_closet = Point(partitionbylabel.JanitorCloset)

nodes = Point([nurse_station, patient_room, utility_room, elevator, elevator_lobby, medical_clinic, pantry, medication_room, janitor_closet])
createlocationpairings = GhPythonScript(
    PatientRoom=patient_room,
    NurseStation=nurse_station,
    UtilityRoom=utility_room,
    Elevator=elevator,
    ElevatorLobby=elevator_lobby,
    MedicalClinic=medical_clinic,
    Pantry=pantry,
    MedicationRoom=medication_room,
    JanitorCloset=janitor_closet)  # -> out, PatientRoom_PatientRoom, NurseStation_PatientRoom, UtilityRoom_PatientRoom, NurseStation_UtilityRoom, NurseStation_Elevator, NurseStation_MedicalClinic, PatientRoom_Pantry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; inputs PatientRoom: list of Point3d, NurseStation: list of Point3d, UtilityRoom: list of Point3d, Elevator: list of Point3d, ElevatorLobby: list of Point3d, MedicalClinic: list of Point3d, Pantry: list of Point3d, MedicationRoom: list of Point3d, JanitorCloset: list of Point3d
# ---------- createlocationpairings: Python ----------
__author__ = "rapha"
__version__ = "2021.10.07"

import rhinoscriptsyntax as rs

def create_pairs(set1, set2, lines):
    for i in range(len(set1)):
        for j in range(len(set2)):
            p1 = set1[i]
            p2 = set2[j]
            
            # Do not consider paths that are too short.
            if rs.Distance(p1, p2) < 0.1:
                continue
            
            # Add a line between both locations.
            lines.append(rs.AddLine(p1, p2))

# Sets of pairs (connected by lines).
PatientRoom_PatientRoom = []
NurseStation_PatientRoom = []
UtilityRoom_PatientRoom = []
NurseStation_UtilityRoom = []
NurseStation_Elevator = []
NurseStation_MedicalClinic = []
PatientRoom_Pantry = []
PatientRoom_Elevator = []
MedicationRoom_PatientRoom = []
UtilityRoom_ElevatorLobby = []
UtilityRoom_MedicalClinic = []
UtilityRoom_Pantry = []
UtilityRoom_JanitorCloset = []
NurseStation_Pantry = []

# Fill pairs.
create_pairs(PatientRoom, PatientRoom, PatientRoom_PatientRoom)
create_pairs(NurseStation, PatientRoom, NurseStation_PatientRoom)
create_pairs(UtilityRoom, PatientRoom, UtilityRoom_PatientRoom)
create_pairs(NurseStation, UtilityRoom, NurseStation_UtilityRoom)
create_pairs(NurseStation, Elevator, NurseStation_Elevator)
create_pairs(NurseStation, MedicalClinic, NurseStation_MedicalClinic)
create_pairs(PatientRoom, Pantry, PatientRoom_Pantry)
create_pairs(PatientRoom, Elevator, PatientRoom_Elevator)
create_pairs(MedicationRoom, PatientRoom, MedicationRoom_PatientRoom)
create_pairs(UtilityRoom, ElevatorLobby, UtilityRoom_ElevatorLobby)
create_pairs(UtilityRoom, MedicalClinic, UtilityRoom_MedicalClinic)
create_pairs(UtilityRoom, Pantry, UtilityRoom_Pantry)
create_pairs(UtilityRoom, JanitorCloset, UtilityRoom_JanitorCloset)
create_pairs(NurseStation, Pantry, NurseStation_Pantry)
# ---------- end createlocationpairings ----------
flatten_3 = FlattenTree(Tree=createlocationpairings.PatientRoom_PatientRoom, Path="{0}")
flatten_4 = FlattenTree(Tree=createlocationpairings.NurseStation_PatientRoom, Path="{1}")
flatten_5 = FlattenTree(Tree=createlocationpairings.UtilityRoom_PatientRoom, Path="{2}")
flatten_6 = FlattenTree(Tree=createlocationpairings.NurseStation_UtilityRoom, Path="{3}")
flatten_7 = FlattenTree(Tree=createlocationpairings.NurseStation_Elevator, Path="{4}")
flatten_8 = FlattenTree(Tree=createlocationpairings.NurseStation_MedicalClinic, Path="{5}")
flatten_9 = FlattenTree(Tree=createlocationpairings.NurseStation_MedicalClinic, Path="{6}")
flatten_10 = FlattenTree(Tree=createlocationpairings.PatientRoom_Pantry, Path="{7}")
flatten_11 = FlattenTree(Tree=createlocationpairings.PatientRoom_Elevator, Path="{8}")
flatten_12 = FlattenTree(Tree=createlocationpairings.MedicationRoom_PatientRoom, Path="{9}")
flatten_13 = FlattenTree(Tree=createlocationpairings.UtilityRoom_ElevatorLobby, Path="{10}")
flatten_14 = FlattenTree(Tree=createlocationpairings.UtilityRoom_MedicalClinic, Path="{11}")
flatten_15 = FlattenTree(Tree=createlocationpairings.UtilityRoom_Pantry, Path="{12}")
flatten_16 = FlattenTree(Tree=createlocationpairings.NurseStation_Pantry, Path="{13}")
data_2 = Data([flatten_4, flatten_3, flatten_5, flatten_6, flatten_7, flatten_8, flatten_9, flatten_10, flatten_11, flatten_12, flatten_13, flatten_14, flatten_15, flatten_16])
viewer = ParamViewer(data_2)

closepathtomedialaxis = CSharpScript(medialAxisCurveList=crv_3, nodePoint3dList=nodes)  # -> out, connectingCurveList; inputs medialAxisCurveList: list of Curve, nodePoint3dList: list of Point3d
# ---------- closepathtomedialaxis: C# ----------
    // Check.
    List<Curve> result = new List<Curve>();
    foreach (Point3d node in nodePoint3dList)
    {
      if (node == null)
      {
        continue;
      }
      Point3d closestPoint = new Point3d();
      double minDist = double.MaxValue;
      double minParam = -1.0;
      Curve minCurve = medialAxisCurveList[0];

      // Find the closest point over all medial axis curves.
      foreach (Curve medialAxisCurve in medialAxisCurveList)
      {
        if (medialAxisCurve == null)
        {
          continue;
        }
        double closeParam;
        medialAxisCurve.ClosestPoint(node, out closeParam);
        Point3d closePoint = medialAxisCurve.PointAt(closeParam);
        double dist = node.DistanceTo(closePoint);
        if (dist < minDist)
        {
          closestPoint = closePoint;
          minDist = dist;
          minParam = closeParam;
          minCurve = medialAxisCurve;
        }
      }

      // We need to split the curve and add the split segment to the list as well.
      Curve[] splitMedialAxisCurves = minCurve.Split(minParam);
      if (splitMedialAxisCurves == null)
      {
        continue;
      }
      foreach (Curve splitCurve in splitMedialAxisCurves)
      {
        result.Add(splitCurve);
      }

      // Construct connecting curve to closest point.
      result.Add(new LineCurve(node, closestPoint));
    }
    connectingCurveList = result;
# ---------- end closepathtomedialaxis ----------
scriptpar_16 = ScriptParasite(Enable=toggle, Folder=panel)

lng_5 = ListLength(List=viewer)
medialaxisandextensions = Curve(flatten([closepathtomedialaxis.connectingCurveList, crv_3]))
subtraction_2 = Subtraction(A=lng_5, B=int)
range = Range(Domain=dom, Steps=subtraction_2)
gradient_2 = Gradient(
    LowerLimit=0,
    UpperLimit=1,
    Parameter=range,
    stops=[0: RGB(243, 57, 0), 0.1: RGB(236, 27, 60), 0.2: RGB(210, 0, 118), 0.3: RGB(103, 0, 120), 0.4: RGB(39, 72, 161), 0.5: RGB(1, 192, 229), 0.6: RGB(18, 178, 90), 0.7: RGB(79, 186, 8), 0.814: RGB(220, 237, 32), 1: RGB(247, 159, 20)])
col_3 = Colour(gradient_2)

# ---- group: Shortest Paths
pr_pr = ShortestWalk(Curves=flatten(medialaxisandextensions), WantedPath=createlocationpairings.PatientRoom_PatientRoom)  # -> ShortestWalk, Succession, Direction, Length
ns_pr = ShortestWalk(Curves=flatten(medialaxisandextensions), WantedPath=createlocationpairings.NurseStation_PatientRoom)  # -> ShortestWalk, Succession, Direction, Length
ur_pr = ShortestWalk(Curves=flatten(medialaxisandextensions), WantedPath=createlocationpairings.UtilityRoom_PatientRoom)  # -> ShortestWalk, Succession, Direction, Length
ns_ur = ShortestWalk(Curves=flatten(medialaxisandextensions), WantedPath=createlocationpairings.NurseStation_UtilityRoom)  # -> ShortestWalk, Succession, Direction, Length
ns_e = ShortestWalk(Curves=flatten(medialaxisandextensions), WantedPath=createlocationpairings.NurseStation_Elevator)  # -> ShortestWalk, Succession, Direction, Length
ns_mc = ShortestWalk(Curves=flatten(medialaxisandextensions), WantedPath=createlocationpairings.NurseStation_MedicalClinic)  # -> ShortestWalk, Succession, Direction, Length
pr_p = ShortestWalk(Curves=flatten(medialaxisandextensions), WantedPath=createlocationpairings.PatientRoom_Pantry)  # -> ShortestWalk, Succession, Direction, Length
pr_e = ShortestWalk(Curves=flatten(medialaxisandextensions), WantedPath=createlocationpairings.PatientRoom_Elevator)  # -> ShortestWalk, Succession, Direction, Length
mr_pr = ShortestWalk(Curves=flatten(medialaxisandextensions), WantedPath=createlocationpairings.MedicationRoom_PatientRoom)  # -> ShortestWalk, Succession, Direction, Length
ur_el = ShortestWalk(Curves=flatten(medialaxisandextensions), WantedPath=createlocationpairings.UtilityRoom_ElevatorLobby)  # -> ShortestWalk, Succession, Direction, Length
ur_mc = ShortestWalk(Curves=flatten(medialaxisandextensions), WantedPath=createlocationpairings.UtilityRoom_MedicalClinic)  # -> ShortestWalk, Succession, Direction, Length
ur_p = ShortestWalk(Curves=flatten(medialaxisandextensions), WantedPath=createlocationpairings.UtilityRoom_Pantry)  # -> ShortestWalk, Succession, Direction, Length
ur_jc = ShortestWalk(Curves=flatten(medialaxisandextensions), WantedPath=createlocationpairings.UtilityRoom_JanitorCloset)  # -> ShortestWalk, Succession, Direction, Length
ns_p = ShortestWalk(Curves=flatten(medialaxisandextensions), WantedPath=createlocationpairings.NurseStation_Pantry)  # -> ShortestWalk, Succession, Direction, Length

# ----
flatten_17 = FlattenTree(Tree=pr_pr.ShortestWalk, Path="{0}")
flatten_18 = FlattenTree(Tree=ns_pr.ShortestWalk, Path="{1}")
flatten_19 = FlattenTree(Tree=ur_pr.ShortestWalk, Path="{2}")
flatten_20 = FlattenTree(Tree=ns_ur.ShortestWalk, Path="{3}")
flatten_21 = FlattenTree(Tree=ns_e.ShortestWalk, Path="{4}")
flatten_22 = FlattenTree(Tree=ns_mc.ShortestWalk, Path="{5}")
flatten_23 = FlattenTree(Tree=pr_p.ShortestWalk, Path="{6}")
flatten_24 = FlattenTree(Tree=pr_e.ShortestWalk, Path="{7}")
flatten_25 = FlattenTree(Tree=mr_pr.ShortestWalk, Path="{8}")
flatten_26 = FlattenTree(Tree=ur_el.ShortestWalk, Path="{9}")
flatten_27 = FlattenTree(Tree=ur_mc.ShortestWalk, Path="{10}")
flatten_28 = FlattenTree(Tree=ur_p.ShortestWalk, Path="{11}")
flatten_29 = FlattenTree(Tree=ur_jc.ShortestWalk, Path="{12}")
flatten_30 = FlattenTree(Tree=ns_p.ShortestWalk, Path="{13}")
data_3 = Data([flatten_18, flatten_17, flatten_19, flatten_20, flatten_21, flatten_22, flatten_23, flatten_24, flatten_25, flatten_26, flatten_27, flatten_28, flatten_29, flatten_30])
python_3 = GhPythonScript(
    PR_PR=pr_pr.Succession,
    NS_PR=ns_pr.Succession,
    UR_PR=ur_pr.Succession,
    NS_UR=ns_ur.Succession,
    NS_E=ns_e.Succession,
    NS_MC=ns_mc.Succession,
    PR_P=pr_p.Succession,
    PR_E=pr_e.Succession,
    MR_PR=mr_pr.Succession,
    UR_EL=ur_el.Succession,
    UR_MC=ur_mc.Succession,
    UR_P=ur_p.Succession,
    UR_JC=ur_jc.Succession,
    NS_P=ns_p.Succession,
    MedaxCurves=medialaxisandextensions,
    PathProbabilities=mergedpathprobabilities,
    Width=yti_maximal_path_width,
    ColorPerPath=col_3)  # -> out, OutCurvesPlain, MidOffset, OutWidths, OutColors, PathTypes; inputs PR_PR: tree of Int32, NS_PR: tree of Int32, UR_PR: tree of Int32, NS_UR: tree of Int32, NS_E: tree of Int32, NS_MC: tree of Int32, PR_P: tree of Int32, PR_E: tree of Int32, MR_PR: tree of Int32, UR_EL: tree, UR_MC: tree, UR_P: tree of Int32, UR_JC: tree of Int32, NS_P: tree of Int32, MedaxCurves: list of Curve, PathProbabilities: list, ColorPerPath: list
# ---------- python_3: Python ----------
__author__ = "rapha"
__version__ = "2022.04.04"

import rhinoscriptsyntax as rs

path_types = [
    "PatientRoom_PatientRoom",
    "NurseStation_PatientRoom",
    "UtilityRoom_PatientRoom",
    "NurseStation_UtilityRoom",
    "NurseStation_Elevator",
    "NurseStation_MedicalClinic",
    "PatientRoom_Pantry",
    "PatientRoom_Elevator",
    "MedicationRoom_PatientRoom",
    "UtilityRoom_ElevatorLobby",
    "UtilityRoom_MedicalClinic",
    "UtilityRoom_Pantry",
    "UtilityRoom_JanitorCloset",
    "NurseStation_Pantry"
]

def tree_to_list(tree):
    if tree is None:
        return []
    return [list(tree.Branch(i)) for i in range(tree.BranchCount)]

# This is so fucking stupid, but still less stupid than Grasshopper's datatrees.
path_successions = {
    path_types[0]: tree_to_list(PR_PR),
    path_types[1]: tree_to_list(NS_PR),
    path_types[2]: tree_to_list(UR_PR),
    path_types[3]: tree_to_list(NS_UR),
    path_types[4]: tree_to_list(NS_E),
    path_types[5]: tree_to_list(NS_MC),
    path_types[6]: tree_to_list(PR_P),
    path_types[7]: tree_to_list(PR_E),
    path_types[8]: tree_to_list(MR_PR),
    path_types[9]: tree_to_list(UR_EL),
    path_types[10]: tree_to_list(UR_MC),
    path_types[11]: tree_to_list(UR_P),
    path_types[12]: tree_to_list(UR_JC),
    path_types[13]: tree_to_list(NS_P)
}

# Map medialaxis curves to the paths types that lead over it.
crv_to_path_type = {}
for path_type in path_types:
    successions = path_successions[path_type]
    for succession in successions:
        for crv_idx in succession:
            if crv_idx not in crv_to_path_type:
                crv_to_path_type[crv_idx] = [path_types.index(path_type)]
            else:
                if path_types.index(path_type) not in crv_to_path_type[crv_idx]:
                    crv_to_path_type[crv_idx].append(path_types.index(path_type))


for i, (key, val) in enumerate(crv_to_path_type.items()):
    print(str(i) + " | " + str(key) + ": " + str(val))

OutCurvesPlain = []
MidOffset = []
OutWidths = []
OutColors = []
PathTypes = []
for key, val in crv_to_path_type.items():
    width = Width * sum([PathProbabilities[idx] for idx in val])
    offset = -width / 2
    for path_type_idx in val:
        OutCurvesPlain.append(MedaxCurves[key])
        MidOffset.append(offset + Width * PathProbabilities[path_type_idx] / 2)
        OutWidths.append(Width * PathProbabilities[path_type_idx])
        OutColors.append(ColorPerPath[path_type_idx])
        PathTypes.append(path_type_idx)
        offset += Width * PathProbabilities[path_type_idx]
# ---------- end python_3 ----------
computeyti = GhPythonScript(ShortestPaths=data_3, PathProbabilities=mergedpathprobabilities, DownscaleLength=downscalelength)  # -> out, YTI; inputs ShortestPaths: tree of Curve, PathProbabilities: list
# ---------- computeyti: Python ----------
__author__ = "rapha"
__version__ = "2022.03.31"

import rhinoscriptsyntax as rs
import ghpythonlib.treehelpers as th

print(ShortestPaths.BranchCount)
shortest_paths = [list(ShortestPaths.Branch(i)) for i in range(ShortestPaths.BranchCount)]

# Not all path pairings are necessarily present.
# If a pairing is missing, the remaining path probabilities are upscaled to compensate.
p_mass = sum(PathProbabilities)
scale_factor = 1.0 / p_mass

YTI = 0
for i, sps in enumerate(shortest_paths):
    if len(sps) == 0:
        continue
    lens = [rs.CurveLength(crv) for crv in sps]
    avg_len = sum(lens) / len(lens)
    print(avg_len)
    print(PathProbabilities[i])
    YTI += scale_factor * PathProbabilities[i] * avg_len * DownscaleLength
# ---------- end computeyti ----------
offset = OffsetCurve(Curve=python_3.OutCurvesPlain, Distance=python_3.MidOffset, Corners=Slider(1, range=0..100))

# ---- group: Compute Vantage Points for Isovists
div_pr_pr = DivideLength(Curve=pr_pr.ShortestWalk, Length=isovist_sample_distance)  # -> flatten(Points), Tangents, Parameters
div_ns_pr = DivideLength(Curve=ns_pr.ShortestWalk, Length=isovist_sample_distance)  # -> flatten(Points), Tangents, Parameters
div_mr_pr = DivideLength(Curve=mr_pr.ShortestWalk, Length=isovist_sample_distance)  # -> flatten(Points), Tangents, Parameters
div_ns_mc = DivideLength(Curve=ns_mc.ShortestWalk, Length=isovist_sample_distance)  # -> flatten(Points), Tangents, Parameters

# ----
isovist = Isovist(
    VantagePointS=div_ns_pr.Points,
    ObstacleLines=flatten(explode_2.Segments),
    ViewingDirection=Vector(0, 1, 0),
    ViewingRange=1000,
    ViewingAngle=360,
    Precision=360,
    ShowPolygon=True,
    ShowRadials=False,
    UseGPU=use_gpu)  # -> IsovistPolygon, Radials, ObstacleVisibility, IsovistProperties
isovist_2 = Isovist(
    VantagePointS=div_mr_pr.Points,
    ObstacleLines=flatten(explode_2.Segments),
    ViewingDirection=Vector(0, 1, 0),
    ViewingRange=1000,
    ViewingAngle=360,
    Precision=360,
    ShowPolygon=True,
    ShowRadials=False,
    UseGPU=use_gpu)  # -> IsovistPolygon, Radials, ObstacleVisibility, IsovistProperties
isovist_3 = Isovist(
    VantagePointS=div_ns_mc.Points,
    ObstacleLines=flatten(explode_2.Segments),
    ViewingDirection=Vector(0, 1, 0),
    ViewingRange=1000,
    ViewingAngle=360,
    Precision=360,
    ShowPolygon=True,
    ShowRadials=False,
    UseGPU=use_gpu)  # -> IsovistPolygon, Radials, ObstacleVisibility, IsovistProperties
isovist_4 = Isovist(
    VantagePointS=div_pr_pr.Points,
    ObstacleLines=flatten(explode_2.Segments),
    ViewingDirection=Vector(0, 1, 0),
    ViewingRange=1000,
    ViewingAngle=360,
    Precision=360,
    ShowPolygon=True,
    ShowRadials=False,
    UseGPU=use_gpu)  # -> IsovistPolygon, Radials, ObstacleVisibility, IsovistProperties
path_mapper = PathMapper(offset, source="{A;B;C;D}", target="{D}")
python_4 = GhPythonScript(
    Curves=path_mapper,
    C_PR=swatch,
    C_NS=swatch_4,
    C_UR=swatch_2,
    C_E=swatch_5,
    C_EL=swatch_6,
    C_MC=swatch_3,
    C_P=swatch_7,
    C_MR=swatch_8,
    C_JC=swatch_9,
    PathTypes=python_3.PathTypes,
    Widths=python_3.OutWidths,
    DashWidth=number_slider)  # -> out, Colors, OutWidths, OutCurves; inputs Curves: tree, C_PR: Color, C_NS: Color, C_UR: Color, C_E: Color, C_EL: Color, C_MC: Color, C_P: Color, C_MR: Color, C_JC: Color, PathTypes: list of Int32, Widths: list
# ---------- python_4: Python ----------
__author__ = "rapha"
__version__ = "2022.04.04"

import rhinoscriptsyntax as rs

path_type_to_palette = {
    0: [C_PR],
    1: [C_NS, C_PR],
    2: [C_UR, C_PR],
    3: [C_NS, C_UR],
    4: [C_NS, C_E],
    5: [C_NS, C_MC],
    6: [C_PR, C_P],
    7: [C_PR, C_E],
    8: [C_MR, C_PR],
    9: [C_UR, C_EL],
    10: [C_UR, C_MC],
    11: [C_UR, C_P],
    12: [C_UR, C_JC],
    13: [C_NS, C_P]
}

curves_per_path = [list(Curves.Branch(i)) for i in range(Curves.BranchCount)]

# print(len(curves_per_path))

Colors = []
OutWidths = []
OutCurves = []
for i, crvs in enumerate(curves_per_path):
    new_crvs = []
    for j in range(len(crvs) - 1):
        crv = crvs[j]
        new_crvs.append(crv)
        new_crvs.append(rs.AddLine(rs.CurveEndPoint(crv), rs.CurveStartPoint(crvs[j + 1])))
    join_res = []
    if len(new_crvs) >= 2:
        join_res = rs.JoinCurves(new_crvs)
        print(len(join_res))
    else:
        join_res = crvs
    div_params = [rs.DivideCurveEquidistant(c, DashWidth, return_points=False) for c in join_res]
    subdivided = [rs.SplitCurve(c, p) for (c, p) in zip(join_res, div_params)]
    subdivided = [c for sublist in subdivided for c in sublist]
    for j, crv in enumerate(subdivided):
        OutCurves.append(crv)
        OutWidths.append(0.8 * Widths[i])
        path_type = PathTypes[i]
        Colors.append(path_type_to_palette[path_type][j % len(path_type_to_palette[path_type])])
# ---------- end python_4 ----------

# ---- group: SCI Computation
averageisovistmeasure = GhPythonScript(measuresPerPointTree=isovist_3.IsovistProperties, whichMeasure=measureindex)  # -> out, average, selectedMeasures, minimum, maximum; inputs measuresPerPointTree: tree
# ---------- averageisovistmeasure: Python ----------
__author__ = "rapha"
__version__ = "2021.10.08"

import rhinoscriptsyntax as rs
import ghpythonlib.treehelpers as th

measuresPerPoint = []
for i in range(measuresPerPointTree.BranchCount):
    measuresPerPoint.append(measuresPerPointTree.Branch(i))
selectedMeasures = [perPoint[whichMeasure] for perPoint in measuresPerPoint]
minimum = min(selectedMeasures)
maximum = max(selectedMeasures)
average = sum(selectedMeasures) / len(selectedMeasures)
# ---------- end averageisovistmeasure ----------
averageisovistmeasure_2 = GhPythonScript(measuresPerPointTree=isovist_2.IsovistProperties, whichMeasure=measureindex)  # -> out, average, selectedMeasures, minimum, maximum; inputs measuresPerPointTree: tree; same code as averageisovistmeasure
averageisovistmeasure_3 = GhPythonScript(measuresPerPointTree=isovist_4.IsovistProperties, whichMeasure=measureindex)  # -> out, average, selectedMeasures, minimum, maximum; inputs measuresPerPointTree: tree; same code as averageisovistmeasure
averageisovistmeasure_4 = GhPythonScript(measuresPerPointTree=isovist.IsovistProperties, whichMeasure=measureindex)  # -> out, average, selectedMeasures, minimum, maximum; inputs measuresPerPointTree: tree; same code as averageisovistmeasure
num = Number([averageisovistmeasure_3.minimum, averageisovistmeasure_4.minimum, averageisovistmeasure_2.minimum, averageisovistmeasure.minimum])
num_2 = Number([averageisovistmeasure_4.maximum, averageisovistmeasure_3.maximum, averageisovistmeasure_2.maximum, averageisovistmeasure.maximum])
multiplication_7 = Multiplication(A=averageisovistmeasure_3.average, B=p_patientroom_patientroom)
multiplication_8 = Multiplication(A=averageisovistmeasure_4.average, B=p_patientroom_nursestation)
multiplication_9 = Multiplication(A=averageisovistmeasure_2.average, B=p_patientroom_medicationroom)
multiplication_10 = Multiplication(A=averageisovistmeasure.average, B=p_nursestation_medicalclinic)
min = GhPythonScript(input=num)  # -> out, output; inputs input: list
# ---------- min: Python ----------
__author__ = "rapha"
__version__ = "2021.10.11"

import rhinoscriptsyntax as rs

output = min(input)
# ---------- end min ----------
max = GhPythonScript(input=num_2)  # -> out, output; inputs input: list
# ---------- max: Python ----------
__author__ = "rapha"
__version__ = "2021.10.11"

import rhinoscriptsyntax as rs

output = max(input)
# ---------- end max ----------
ma_2 = MassAddition(Input=[multiplication_7, multiplication_8, multiplication_9, multiplication_10])  # -> Result, PartialResults
lng_6 = ListLength(List=patient_room)
division_2 = Division(A=Slider(1, range=0..1), B=downscalelength)
num_3 = Number(2)
multiplication_11 = Multiplication(A=lng_6, B=number_of_beds_per_patient_room)
pow = Power(A=division_2, B=num_3)
division_3 = Division(A=ma_2.Result, B=multiplication_11)
division_4 = Division(A=division_3, B=pow)

# ----
panel_13 = Panel(python_4.out)
filter_13 = StreamFilter(Gate=visualize_yti, Stream1=python_4.OutCurves)
previewlw_5 = CustomPreviewLineweights(Geometry=filter_13, Shader=python_4.Colors, Thickness=python_4.OutWidths, Absolute=Toggle(True))
gradient_3 = Gradient(
    LowerLimit=min.output,
    UpperLimit=max.output,
    Parameter=averageisovistmeasure_3.selectedMeasures,
    stops=[0: RGBA(67, 12, 156, 157), 0.5: RGB(214, 51, 89), 1: RGB(251, 255, 0)])
gradient_4 = Gradient(
    LowerLimit=min.output,
    UpperLimit=max.output,
    Parameter=averageisovistmeasure_4.selectedMeasures,
    stops=[0: RGBA(67, 12, 156, 107), 0.5: RGB(214, 51, 89), 1: RGB(251, 255, 0)])
gradient_5 = Gradient(
    LowerLimit=min.output,
    UpperLimit=max.output,
    Parameter=averageisovistmeasure_2.selectedMeasures,
    stops=[0: RGBA(67, 12, 156, 103), 0.5: RGB(214, 51, 89), 1: RGB(251, 255, 0)])
gradient_6 = Gradient(
    LowerLimit=min.output,
    UpperLimit=max.output,
    Parameter=averageisovistmeasure.selectedMeasures,
    stops=[0: RGBA(67, 12, 156, 133), 0.5: RGB(214, 51, 89), 1: RGB(251, 255, 0)])

# ---- group: Metrics Tag
yale_traffic_index = Number(computeyti.YTI)
sci = Number(division_4)
icd = Number(python_2.ICD)

int_6 = Integer(3)
pointlist = GhPythonScript(BasePoint=measures_position, Items=int_6, Displacement=measures_displacement)  # -> out, Positions; inputs BasePoint: Point3d, Items: Int32
# ---------- pointlist: Python ----------
__author__ = "rapha"
__version__ = "2021.10.08"

import rhinoscriptsyntax as rs

Positions = []

for i in range(Items):
    Positions.append(BasePoint + i * Displacement)
# ---------- end pointlist ----------
python_5 = GhPythonScript(YTI=yale_traffic_index, SCI=sci, ICD=icd)  # -> out, strings
# ---------- python_5: Python ----------
__author__ = "rapha"
__version__ = "2021.10.08"

import rhinoscriptsyntax as rs

strings = []

if YTI:
    strings.append("YTI: " + str(round(YTI, 2)))
if SCI:
    strings.append("SCI: " + str(round(SCI, 2)))
if ICD:
    strings.append("ICD: " + str(round(ICD, 2)))
# ---------- end python_5 ----------
textdot = DefineTextDot(Text=python_5.strings, Location=pointlist.Positions, Font="Arial", Size=Slider(24, range=0..24))
material_3 = CreateMaterial(
    Diffuse=[ColourSwatch(SwatchColor=RGB(0, 0, 0)), ColourSwatch(SwatchColor=RGB(0, 0, 0)), ColourSwatch(SwatchColor=RGB(0, 0, 0))],
    Specular=RGB(255, 255, 255),
    Emission=RGB(0, 0, 0),
    Transparency=0,
    Shine=0)
preview_3 = CustomPreview(Geometry=textdot, Material=material_3)

# ---- group: Filtering Based On Visualization Selection
filter_14 = StreamFilter(Gate=visualize_sci, Stream1=div_pr_pr.Points)
filter_15 = StreamFilter(Gate=visualize_sci, Stream1=div_ns_pr.Points)
filter_16 = StreamFilter(Gate=visualize_sci, Stream1=div_mr_pr.Points)
filter_17 = StreamFilter(Gate=visualize_sci, Stream1=div_ns_mc.Points)

# ---- group: Visualize SCI
cloud_10 = CloudDisplay(Points=filter_14, Colours=gradient_3, Size=sci_vantage_point_size, SpriteType=0)
cloud_11 = CloudDisplay(Points=filter_15, Colours=gradient_4, Size=sci_vantage_point_size, SpriteType=0)
cloud_12 = CloudDisplay(Points=filter_16, Colours=gradient_5, Size=sci_vantage_point_size, SpriteType=0)
cloud_13 = CloudDisplay(Points=filter_17, Colours=gradient_6, Size=sci_vantage_point_size, SpriteType=0)

# ==== cluster ProbabilitiesYTI
p_patient_room_patient_room = Number(19.1)
p_nurse_station_patient_room = Number(16.7)
p_utility_room_patient_room = Number(14.1)
p_nurse_station_utility_room = Number(9.8)
p_nurse_station_elevator = Number(6.1)
p_nurse_station_medical_clinic = Number(5.8)
p_patient_room_pantry = Number(4.6)
p_patient_room_elevator = Number(3.7)
p_medication_room_patient_room = Number(4.8)
p_utility_room_elevator_lobby = Number(2.5)
p_utility_room_medical_clinic = Number(2.8)
p_utility_room_pantry = Number(0.7)
p_utility_room_janitor_closet = Number(1.1)
p_nurse_station_pantry = Number(1)
p_utility_room_pantry_2 = ClusterOutput(p_utility_room_pantry)
p_patient_room_pantry_2 = ClusterOutput(p_patient_room_pantry)
p_nurse_station_pantry_2 = ClusterOutput(p_nurse_station_pantry)
p_patient_room_elevator_2 = ClusterOutput(p_patient_room_elevator)
p_nurse_station_elevator_2 = ClusterOutput(p_nurse_station_elevator)
p_utility_room_patient_room_2 = ClusterOutput(p_utility_room_patient_room)
p_utility_room_janitor_closet_2 = ClusterOutput(p_utility_room_janitor_closet)
p_nurse_station_utility_room_2 = ClusterOutput(p_nurse_station_utility_room)
p_utility_room_medical_clinic_2 = ClusterOutput(p_utility_room_medical_clinic)
p_patient_room_patient_room_2 = ClusterOutput(p_patient_room_patient_room)
p_utility_room_elevator_lobby_2 = ClusterOutput(p_utility_room_elevator_lobby)
p_nurse_station_patient_room_2 = ClusterOutput(p_nurse_station_patient_room)
p_nurse_station_medical_clinic_2 = ClusterOutput(p_nurse_station_medical_clinic)
p_medication_room_patient_room_2 = ClusterOutput(p_medication_room_patient_room)
